# Grasshopper definition Curl noise.gh (Grasshopper 1.0.7)
# Copyright: Co-de-iT

_3d = BooleanToggle(False)
pt = Point(Point(0, 0, 0))
# Curl Noise function
# 
# © a3 _/TH.esis 2019 _ Creative Commons Attribution-NonCommercial-ShareAlike3.0 UnportedLicense.
sqgrid = Square(Plane=pt, Size=Slider(0.5, range=0..1), ExtentX=Slider(30, range=1..100), ExtentY=Slider(30, range=1..100))  # -> Cells, Points
range = Range(Domain=Slider(10, range=0..10), Steps=Slider(10, range=0..20))
panel = Panel("0")
Z = UnitZ(Factor=range)
move = Move(Geometry=graft(sqgrid.Points), Motion=Z)  # -> simplify(flatten(Geometry)), Transform

# ---- group: curl noise parallel
c_script = CSharpScript(
    P=move.Geometry,
    S=Slider(0.163, range=-1..1),
    t=Slider(0, range=0..1),
    D3=_3d,
    Reference="C:\Users\Alessio\AppData\Roaming\Grasshopper\Libraries\Noises.dll")  # -> out, V, C; inputs P: list of Point3d, S: Double, t: Double, D3: Boolean
# ---------- c_script: C# usings ----------
using System.Drawing;
using System.Threading;
using System.Threading.Tasks;
using Noises;
# ---------- c_script: C# ----------
        if (P == null || P.Count == 0) return;

        GH_Vector[] v = new GH_Vector[P.Count];
        GH_Colour[] c = new GH_Colour[P.Count];

            Parallel.For(0, P.Count, i =>
            {
                CurlNoise(P[i], S, t, D3, out v[i], out c[i]);
            });

        V = v;
        C = c;
# ---------- c_script: C# additional code ----------
 


    public void CurlNoise(Point3d P, double S, double t, bool is3D, out GH_Vector V, out GH_Colour C)
    {
        V = new GH_Vector();
        C = new GH_Colour();

        float fS = (float)S;
        float fT = (float)t;
        float nX = (float)P.X * fS + fT; // num5
        float nY = (float)P.Y * fS + fT; // num6
        float nZ = (float)P.Z * fS + fT; // num7

        //double num8 = Noise.Generate(nX, nY, nZ); // noise in position (redundant)
        float dT = 1.0f;
        float nPlus = Noise.Generate(nX, nY + dT, nZ);
        float nMinus = Noise.Generate(nX, nY - dT, nZ);
        float nDiff = (nPlus - nMinus) / (2f * dT);
        nPlus = Noise.Generate(nX, nY, nZ + dT);
        nMinus = Noise.Generate(nX, nY, nZ - dT);
        float num13 = (nPlus - nMinus) / (2f * dT);
        float num14 = nDiff - num13;
        nX -= fT;
        nY -= fT;
        nPlus = Noise.Generate(nX, nY, nZ + dT);
        nMinus = Noise.Generate(nX, nY, nZ - dT);
        nDiff = (nPlus - nMinus) / (2f * dT);
        nPlus = Noise.Generate(nX + dT, nY, nZ);
        nMinus = Noise.Generate(nX - dT, nY, nZ);
        num13 = (nPlus - nMinus) / (2f * dT);
        float num15 = nDiff - num13;
        nPlus = Noise.Generate(nX + dT, nY, nZ);
        nMinus = Noise.Generate(nX - dT, nY, nZ);
        nDiff = (nPlus - nMinus) / (2f * dT);
        nPlus = Noise.Generate(nX, nY + dT, nZ);
        nMinus = Noise.Generate(nX, nY - dT, nZ);
        num13 = (nPlus - nMinus) / (2f * dT);
        float num16 = nDiff - num13;
        Vector3d val2 = new Vector3d((double)num14, (double)num15, (double)num16);
        if (!is3D)
        {
            //nPlus = Generate(nX, nY + dT);
            //nMinus = Generate(nX, nY - dT);
            //nDiff = (nPlus - nMinus) / (2f * dT); // weird... this value is not used later
            nPlus = Noise.Generate(nX + dT, nY);
            nMinus = Noise.Generate(nX - dT, nY);
            nDiff = (nPlus - nMinus) / (2f * dT); // diffferential in Y
            val2 = new Vector3d((double)nDiff, (double)( -num13), 0.0);
        }
        V = new GH_Vector(val2);
        val2.Unitize();
        int red = (int)Math.Floor(Remap((float)val2.X, -1f, 1f, 0f, 255f));
        int green = (int)Math.Floor(Remap((float)val2.Y, -1f, 1f, 0f, 255f));
        int blue = (int)Math.Floor(Remap((float)val2.Z, -1f, 1f, 0f, 255f));
        C = new GH_Colour(Color.FromArgb(red, green, blue));

    }

    public float Remap(float val, float from1, float to1, float from2, float to2)
    {
        return (val - from1) / (to1 - from1) * (to2 - from2) + from2;
    }
# ---------- end c_script ----------

# ----
multiplication = Multiplication(A=c_script.V, B=Slider(1, range=0..1))
vdisex = VectorDisplayEx(Point=move.Geometry, Vector=multiplication, Colour=c_script.C, Width=1)
