# Grasshopper definition Symmetric noise - displace.gh (Grasshopper 1.0.7)
# Copyright: Co-de-iT
# plug-ins: Weaverbird, Noise 4D

# ---- group: TRI-MESH
mesh = Mesh(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)

# ---- group: QUAD-MESH
mesh_2 = Mesh(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)

# ----
mirror = Mirror(Geometry=mesh, Plane=PlaneYZ(0, 0, 0))  # -> Geometry, Transform
number_slider = Slider(1, range=0..2)
# Symmetric Noise on Mesh
# 
# Generates a Symmetric noise on a mesh
# 
# © a3 _/TH.esis 2019 _ Creative Commons Attribution-NonCommercial-ShareAlike3.0 UnportedLicense.
wbjoin = WeaverbirdsJoinMeshesAndWeld(Mesh=[mirror.Geometry, mesh], Weld=False)
wbcatmullclark = WeaverbirdsCatmullClarkSubdivision(MeshCurves=wbjoin, Level=Slider(3, range=1..3), SmoothNakedEdges=Slider(2, range=0..2))
wbcatmullclark_2 = WeaverbirdsCatmullClarkSubdivision(MeshCurves=mesh_2, Level=Slider(3, range=1..3), SmoothNakedEdges=number_slider)
wbloop = WeaverbirdsLoopSubdivision(MeshCurves=wbcatmullclark, Level=Slider(3, range=1..3), SmoothNakedEdges=Slider(2, range=0..2))
wbcatmullclark_3 = WeaverbirdsCatmullClarkSubdivision(MeshCurves=wbcatmullclark_2, Level=Slider(2, range=1..3), SmoothNakedEdges=number_slider)
list = ValueList({"TriMesh": 0, "QuadMesh": 1}, selected="TriMesh")
filter = StreamFilter(Gate=list, Stream0=wbloop, Stream1=wbcatmullclark_3)
bbox = BoundingBox(Content=filter, Plane=PlaneXY(0, 0, 0), UnionBox=True)  # -> Box, Box_2
boxprop = BoxProperties(Box=bbox.Box)  # -> Center, Diagonal, Area, Volume, Degeneracy
demesh = DeconstructMesh(Mesh=filter)  # -> Vertices, Faces, Colours, Normals
xz = XZPlane(Origin=boxprop.Center)
yz = YZPlane(Origin=boxprop.Center)
filter_2 = StreamFilter(Gate=list, Stream0=yz, Stream1=xz)
deplane = DeconstructPlane(Plane=filter_2)  # -> Origin, XAxis, YAxis, ZAxis
plcoord = PlaneCoordinates(Point=demesh.Vertices, System=filter_2)  # -> XCoordinate, YCoordinate, ZCoordinate

animate_this = Slider(0, range=0..2)

abs = Absolute(Value=plcoord.ZCoordinate)
multiplication = Multiplication(A=Slider(5, range=0..10), B=animate_this)
pt = PointOriented(BasePlane=filter_2, UComponent=plcoord.XCoordinate, VComponent=plcoord.YCoordinate, WComponent=abs)
xprod = CrossProduct(VectorA=demesh.Normals, VectorB=deplane.ZAxis, Unitize=False)  # -> Vector, Length
perlin = PerlinNoise(Values=pt, Time=multiplication, Scale=Slider(0.05, range=0..1))
num = Number(perlin)
displacement_amount = Slider(2, range=0..10)
bnd = Bounds(Numbers=flatten(num))
dom = ConstructDomain(DomainStart=0, DomainEnd=1)
gradient = Gradient(LowerLimit="-1", UpperLimit=1, Parameter=perlin, stops=[0: RGB(255, 255, 255), 1: RGB(187, 0, 255)])
pi = Pi(Factor=Slider(8, range=0..30))
remap = RemapNumbers(Value=num, Source=bnd, Target=dom)  # -> Mapped, Clipped

# ---- group: sign
c_script = CSharpScript(N=plcoord.ZCoordinate)  # -> out, S; inputs N: Double
# ---------- c_script: C# ----------
    S = (N == 0) ? 0 : (N / Math.Abs(N));
# ---------- end c_script ----------

# ----
multiplication_2 = Multiplication(A=remap.Mapped, B=pi)
sin = Sine(Value=multiplication_2)
multiplication_3 = Multiplication(A=multiplication_2, B=c_script.S)
multiplication_4 = Multiplication(A=remap.Mapped, B=demesh.Normals, C=displacement_amount, D=sin)
vrot = Rotate(Vector=xprod.Vector, Axis=demesh.Normals, Angle=multiplication_3)
move = Move(Geometry=demesh.Vertices, Motion=multiplication_4)  # -> Geometry, Transform
conmesh = ConstructMesh(Vertices=move.Geometry, Faces=demesh.Faces)
conmesh_2 = ConstructMesh(Vertices=demesh.Vertices, Faces=demesh.Faces, Colours=gradient)
vdisex = VectorDisplayEx(Point=move.Geometry, Vector=vrot, Colour=gradient, Width=2)
preview = CustomPreview(Geometry=conmesh, Material=ColourSwatch(SwatchColor=RGB(255, 255, 255)))
adjust_zoom = Slider(1.528, range=0..10)
lens = Slider(21, range=21..50)
xy = XYPlane(Origin=Point(0, 0, 0))
geo = Geometry(conmesh)
bbox_2 = BoundingBox(Content=geo, Plane=xy, UnionBox=True)  # -> Box, Box_2
boxprop_2 = BoxProperties(Box=bbox_2.Box)  # -> Center, Diagonal, Area, Volume, Degeneracy
vlen = VectorLength(Vector=boxprop_2.Diagonal)
expression = Expression(x=vlen, y=lens, z=adjust_zoom, Expression="x*(y/21)*z")
cir = Circle(Plane=boxprop_2.Center, Radius=expression)
seam = Seam(Curve=reparameterize(cir), Seam=Slider(0.25, range=-1..1))
mod = Modulus(A=animate_this, B="1")
eval = EvaluateCurve(Curve=reparameterize(seam), Parameter=mod)  # -> Point, Tangent, Angle
deplane_2 = DeconstructPlane(Plane=xy)  # -> Origin, XAxis, YAxis, ZAxis
c_script_2 = CSharpScript(location=eval.Point, target=boxprop_2.Center, lens=eval.Angle, up=deplane_2.ZAxis, run=Toggle(True))  # inputs location: Point3d, target: Point3d, lens: Double, up: Vector3d, run: Boolean
# ---------- c_script_2: C# usings ----------
using System.IO;
using System.Linq;
using System.Data;
using System.Drawing;
using System.Reflection;
using System.Windows.Forms;
using System.Xml;
using System.Xml.Linq;
using System.Runtime.InteropServices;

using Rhino.DocObjects;
using Rhino.Collections;
using GH_IO;
using GH_IO.Serialization;
# ---------- c_script_2: C# ----------
    Component.Message = "Set Camera";

    if (run){
      //Get current viewport
      vp = Rhino.RhinoDoc.ActiveDoc.Views.ActiveView.ActiveViewport;
      //Set new camera
      vp.SetCameraLocations(target, location);
      vp.CameraUp = up;
      vp.ChangeToPerspectiveProjection(true, lens);
    }
# ---------- c_script_2: C# additional code ----------
  //To get and set camera properties
  Rhino.Display.RhinoViewport vp;
# ---------- end c_script_2 ----------
