# Grasshopper definition Util-03_record animation.gh (Grasshopper 1.0.7)
# Copyright: Co-de-iT
# plug-ins: Mesh Pipe

animate_this = Slider(1, range=0..1)
crv = Curve(reparameterize(flatten([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])))
mesh = Mesh(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)
# Util_Record Animation
# 
# Records animation from agents trails; it can be implemented to use the same camera control components used in turntable.
# 
# © a3 _/TH.esis 2019 _ Creative Commons Attribution-NonCommercial-ShareAlike3.0 UnportedLicense.
demesh = DeconstructMesh(Mesh=mesh)  # -> Vertices, Faces, Colours, Normals
subcrv = SubCurve(BaseCurve=crv, Domain=animate_this)
eval = EvaluateCurve(Curve=crv, Parameter=animate_this)  # -> Point, Tangent, Angle
vec = Vector([Vector(-0.03321605826, 0.02287177361, -0.9983709381), Vector(0.01531888857, -0.01476128759, -0.9995472349), Vector(-0.1087215403, 0.1175458639, -0.9736692993), Vector(-0.1416201899, 0.1115228667, -0.9663757524), Vector(0.029890656, -0.0389889487, -0.9975805383), Vector(0.0269930029, -0.04783448052, -0.996974058)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])
mpipe = MeshPipe(Curve=subcrv, Radius=Slider(0.25, range=0..1), Accuracy=0.2, Rotation=0, Segments="4", Caps="1")
amp = Amplitude(Vector=vec, Amplitude=Slider(0.5, range=0..5))
amp_2 = Amplitude(Vector=eval.Tangent, Amplitude=Slider(2, range=0..5))
vector_field = ColourSwatch(SwatchColor=RGB(158, 158, 158))
agents = ColourSwatch(SwatchColor=RGB(255, 0, 191))
mesh_2 = ColourSwatch(SwatchColor=RGBA(184, 184, 184, 126))
trails = ColourSwatch(SwatchColor=RGB(0, 0, 0))
preview = CustomPreview(Geometry=mesh, Material=mesh_2)
preview_2 = CustomPreview(Geometry=mpipe, Material=trails)
vdisex = VectorDisplayEx(Point=eval.Point, Vector=amp_2, Colour=agents, Width=2)
vdisex_2 = VectorDisplayEx(Point=demesh.Vertices, Vector=amp, Colour=vec, Width=2)
