# Grasshopper definition Util_post-processing-Dendro.gh (Grasshopper 1.0.7)
# Copyright: Co-de-iT
# plug-ins: Mesh Pipe, DendroGH

# ---- group: input Agent Body curves
# post processing (Dendro)
# INSTRUCTIONS: Set test mode to tweak the curve radius first.
# 
# Voxel size damper is the size ratio between curve radius and voxel size. Voxel size must be smaller than curve radius: the smaller the voxel size, the higher the resolution of the output, but also the longer the calculation time will be. Start with high values and decrease gradually
crv = Curve([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])

# ----
mode = ValueList({"isomesh": 0, "test": 1}, selected="test")
curve_radius = Slider(0.4, range=0.01..3)
# post-processing - Dendro
# 
# Transform lines into isomesh model for additive fabrication
# 
# © a3 _/TH.esis 2019 _ Creative Commons Attribution-NonCommercial-ShareAlike3.0 UnportedLicense.
gate = StreamGate(Stream=crv, Gate=mode)  # -> Target0, Target1
mpipe = MeshPipe(Curve=gate.Target1, Radius=curve_radius, Accuracy=0.2, Rotation=0, Segments="4", Caps="1")
mjoin = MeshJoin(Meshes=mpipe)

# ----
# WARNING: the smaller the voxel size, the finer the mesh but the longer the calculation. Check the statistics for the number of cells the example is using
# in case of invalid mesh output: 1. try to increase the Isovalue to 0.001 or 0.002
# 
# 2. if that doesn't do the trick, increase the radius multiplier
voxel_size_damper = Slider(0.5, range=0..1)
multiplication = Multiplication(A=curve_radius, B=voxel_size_damper)
vsettings = CreateSettings(
    VoxelSize=multiplication,
    Bandwidth=Slider(0.5, range=0..3),
    Isovalue=Slider(0, range=0..1),
    Adaptivity=Slider(0.6, range=0..1))
vcurve = CurveToVolume(Curves=gate.Target0, CurveRadius=curve_radius, Settings=vsettings)
list = ValueList({"Gaussian": 0, "Laplacian": 1, "Mean": 2, "Median": 3}, selected="Mean")
vsmooth = SmoothVolume(Volume=vcurve, Width=1, Type=list, Iterations=Slider(1, range=1..10))

dir_type = ValueList({"desktop": 0, "documents": 1, "GH file path": 2, "C:": 3}, selected="GH file path")
f_pathg = PathGenerator(type=dir_type)  # -> dir; inputs type: Int32, subDir: String
# ---------- f_pathg: C# ----------
                           /*
    froGH - a sparse collection of (in)utilities for Grasshopper

    Path Generator
    code by Alessio Erioli - value list generation based on code by James Ramsden

    froGH by Co-de-iT is licensed under a Creative Commons Attribution 4.0 International License.
    http://creativecommons.org/licenses/by/4.0/

    */
    initComp();


    String S = "";
    String root = "";
    String end = "\\";
    String eol = Environment.NewLine;

    // __________________ autoList part __________________

    // variable for the list
    Grasshopper.Kernel.Special.GH_ValueList vList;
    // tries to cast input as list
    try{

      // if the list is not the first parameter then change Input[0] to the corresponding value
      vList = (Grasshopper.Kernel.Special.GH_ValueList) Component.Params.Input[0].Sources[0];
      // Print("value list connected");
      // check if the list must be created
      //if (vList.NickName != "dir type"){
      if (!vList.NickName.Equals("dir type")){
        vList.ClearData();
        vList.ListItems.Clear();
        vList.NickName = "dir type";
        var item1 = new Grasshopper.Kernel.Special.GH_ValueListItem("desktop", "0");
        var item2 = new Grasshopper.Kernel.Special.GH_ValueListItem("documents", "1");
        var item3 = new Grasshopper.Kernel.Special.GH_ValueListItem("GH file path", "2");
        var item4 = new Grasshopper.Kernel.Special.GH_ValueListItem("C:", "3");
        vList.ListItems.Add(item1);
        vList.ListItems.Add(item2);
        vList.ListItems.Add(item3);
        vList.ListItems.Add(item4);

        vList.ListItems[0].Value.CastTo(out type);
      }
    }
    catch{
      // handles anything that is not a value list
    }


    switch(type){
      case 0:
        root = Environment.GetFolderPath(Environment.SpecialFolder.Desktop) + end;
        S = "Desktop";
        break;
      case 1:
        root = Environment.GetFolderPath(Environment.SpecialFolder.MyDocuments) + end;
        S = "Documents";
        break;
      case 2:
        GH_Document ghDoc = owner.OnPingDocument();

        if (ghDoc.IsFilePathDefined)
        {
          int nameLen = ghDoc.DisplayName.TrimEnd('*').Length + 3; // +3 accounts for the '.gh' extension
          int fileLen = ghDoc.FilePath.TrimEnd('*').Length;

          //F = ghDoc.DisplayName.TrimEnd('*');
          root = ghDoc.FilePath.Substring(0, fileLen - nameLen);
          //root = gh_d.FilePath;
          S = "GH File path";
        }
        else
        {
          Print("No path defined. Saving to Desktop until then");
          root = Environment.GetFolderPath(Environment.SpecialFolder.Desktop);
          S = "Desktop";
        }
        break;
      case 3:
        root = "C:" + end;
        S = root + end;
        break;
    }
    dir = root + (subDir != null ? (subDir + end) : "");
    Component.Message = S;
# ---------- f_pathg: C# additional code ----------
  void initComp(){
    Component.Name = "Path Generator";
    Component.NickName = "f_PathG";
    Component.Description = "generates a path based on local direcories such as Desktop, Documents, GH file path";
    Component.Params.Input[0].Name = "dir type";
    Component.Params.Input[0].Description = "directory type: 0 desktop, 1 documents, 2 GH file path, 3 C:\nconnect a value list for automatic list generation";
    Component.Params.Input[1].Name = "custom subdir";
    Component.Params.Input[1].Description = "(optional) custom subdirectory";
  }
# ---------- end f_pathg ----------
vdb_file_to_save = Panel("Volume_complete.vdb")
vdb_file_to_read = Panel("Volume01.vdb")
# read/write .vdb files
concat = Concatenate(FragmentA=f_pathg, FragmentB=vdb_file_to_save)
concat_2 = Concatenate(FragmentA=f_pathg, FragmentB=vdb_file_to_read)
write = Button()
read = Button()
vread = ReadVolume(FilePath=concat_2, Read=read)  # disabled
vwrite = WriteVolume(Volume=vcurve, FilePath=concat, Write=write)

voxel_size = Panel(multiplication)

bbox = BoundingBox(Content=gate.Target0, Plane=PlaneXY(0, 0, 0), UnionBox=True)  # -> Box, Box_2
boxprop = BoxProperties(Box=bbox.Box)  # -> Center, Diagonal, Area, Volume, Degeneracy
one_over_x = OneOverX(Value=multiplication)
c_script = CSharpScript(D=boxprop.Diagonal, s=one_over_x)  # -> out, A; inputs D: Vector3d, s: Double
# ---------- c_script: C# ----------
    int x,y,z,t;

    x = (int) Math.Floor(D.X * s);
    y = (int) Math.Floor(D.Y * s);
    z = (int) Math.Floor(D.Z * s);
    t = x * y * z;

    A = String.Format("{0:0,0} Cells\n\n X: {1}\n Y: {2}\n Z: {3}", t, x, y, z);
# ---------- end c_script ----------
# statistics
stats = Panel(c_script.A)

# ---- group: BAKE THIS
# isomeshing
mvolume = VolumeToMesh(Volume=vsmooth, VolumeSettings=vsettings)

# ----
filter = StreamFilter(Gate=mode, Stream0=mvolume, Stream1=mjoin)
# You can save Dendro volume data to a .vdb file to retrieve and isomesh later (with the file reader). Once loaded, you can connect the V output to the V input of Volume to Mesh component
swatch = ColourSwatch(SwatchColor=RGB(255, 255, 255))
preview = CustomPreview(Geometry=filter, Material=swatch)
