# Grasshopper definition AgentSystemFlock_progress.gh (Grasshopper 1.0.7)
# Copyright: Co-de-iT
# plug-ins: FileToScript

# ---- group: file reference
dir_type = ValueList({"desktop": 0, "documents": 1, "GH file path": 2, "C:": 3}, selected="GH file path")
f_pathg = PathGenerator(type=dir_type, subDir="AgentSystemFlock")  # -> dir; inputs type: Int32, subDir: String
# ---------- f_pathg: C# ----------
                           /*
    froGH - a sparse collection of (in)utilities for Grasshopper

    Path Generator
    code by Alessio Erioli - value list generation based on code by James Ramsden

    froGH by Co-de-iT is licensed under a Creative Commons Attribution 4.0 International License.
    http://creativecommons.org/licenses/by/4.0/

    */
    initComp();


    String S = "";
    String root = "";
    String end = "\\";
    String eol = Environment.NewLine;

    // __________________ autoList part __________________

    // variable for the list
    Grasshopper.Kernel.Special.GH_ValueList vList;
    // tries to cast input as list
    try{

      // if the list is not the first parameter then change Input[0] to the corresponding value
      vList = (Grasshopper.Kernel.Special.GH_ValueList) Component.Params.Input[0].Sources[0];
      // Print("value list connected");
      // check if the list must be created
      //if (vList.NickName != "dir type"){
      if (!vList.NickName.Equals("dir type")){
        vList.ClearData();
        vList.ListItems.Clear();
        vList.NickName = "dir type";
        var item1 = new Grasshopper.Kernel.Special.GH_ValueListItem("desktop", "0");
        var item2 = new Grasshopper.Kernel.Special.GH_ValueListItem("documents", "1");
        var item3 = new Grasshopper.Kernel.Special.GH_ValueListItem("GH file path", "2");
        var item4 = new Grasshopper.Kernel.Special.GH_ValueListItem("C:", "3");
        vList.ListItems.Add(item1);
        vList.ListItems.Add(item2);
        vList.ListItems.Add(item3);
        vList.ListItems.Add(item4);

        vList.ListItems[0].Value.CastTo(out type);
      }
    }
    catch{
      // handles anything that is not a value list
    }


    switch(type){
      case 0:
        root = Environment.GetFolderPath(Environment.SpecialFolder.Desktop) + end;
        S = "Desktop";
        break;
      case 1:
        root = Environment.GetFolderPath(Environment.SpecialFolder.MyDocuments) + end;
        S = "Documents";
        break;
      case 2:
        GH_Document ghDoc = owner.OnPingDocument();

        if (ghDoc.IsFilePathDefined)
        {
          int nameLen = ghDoc.DisplayName.TrimEnd('*').Length + 3; // +3 accounts for the '.gh' extension
          int fileLen = ghDoc.FilePath.TrimEnd('*').Length;

          //F = ghDoc.DisplayName.TrimEnd('*');
          root = ghDoc.FilePath.Substring(0, fileLen - nameLen);
          //root = gh_d.FilePath;
          S = "GH File path";
        }
        else
        {
          Print("No path defined. Saving to Desktop until then");
          root = Environment.GetFolderPath(Environment.SpecialFolder.Desktop);
          S = "Desktop";
        }
        break;
      case 3:
        root = "C:" + end;
        S = root + end;
        break;
    }
    dir = root + (subDir != null ? (subDir + end) : "");
    Component.Message = S;
# ---------- f_pathg: C# additional code ----------
  void initComp(){
    Component.Name = "Path Generator";
    Component.NickName = "f_PathG";
    Component.Description = "generates a path based on local direcories such as Desktop, Documents, GH file path";
    Component.Params.Input[0].Name = "dir type";
    Component.Params.Input[0].Description = "directory type: 0 desktop, 1 documents, 2 GH file path, 3 C:\nconnect a value list for automatic list generation";
    Component.Params.Input[1].Name = "custom subdir";
    Component.Params.Input[1].Description = "(optional) custom subdirectory";
  }
# ---------- end f_pathg ----------
concat = Concatenate(FragmentA=f_pathg, FragmentB="AgentSystemFlock.cs")
path = FilePath(concat)

# ----
bounding_box_sizee = Slider(30, range=0..100)
n_agents = Slider(500, range=2..5000)
list = ValueList({"2D": 0, "3D": 1}, selected="2D")
pt = Point(Point(1, 1, 1))
X = XSize(Domain(-1, 1))
neg = Negative(Value=pt)
pt_2 = ConstructPoint(XCoordinate=bounding_box_sizee, YCoordinate=bounding_box_sizee, ZCoordinate=bounding_box_sizee)
pt_3 = Point(Point(0, 0, 0))
# Agent System - Reynolds Flocking
# 
# Implementation of Craig Reynolds' classical flocking system
# 
# © a3 _/TH.esis 2019 _ Creative Commons Attribution-NonCommercial-ShareAlike3.0 UnportedLicense.
rectangle = Rectangle(Plane=PlaneXY(0, 0, 0), XSize=bounding_box_sizee, YSize=bounding_box_sizee, Radius=0)  # -> Rectangle, Length
rectangle_2 = Rectangle(Plane=PlaneXY(0, 0, 0), XSize=X, YSize=X, Radius=0)  # -> Rectangle, Length
box = Box2Pt(PointA=pt_3, PointB=pt_2, Plane=PlaneXY(0, 0, 0))
box_2 = Box2Pt(PointA=neg, PointB=pt, Plane=PlaneXY(0, 0, 0))
gate = StreamGate(Stream=n_agents, Gate=list)  # -> Target0, Target1

# ---- group: positions
pop2d = Populate2D(Region=rectangle.Rectangle, Count=gate.Target0, Seed=1)
pop3d = Populate3D(Region=box, Count=gate.Target1, Seed=1)

# ---- group: vectors
pop2d_2 = Populate2D(Region=rectangle_2.Rectangle, Count=gate.Target0, Seed="3")

# ----
pop3d_2 = Populate3D(Region=box_2, Count=gate.Target1, Seed="3")
unit = UnitVector(Vector=pop2d_2)
unit_2 = UnitVector(Vector=pop3d_2)
edges = BrepEdges(Brep=box)  # -> Naked, Interior, NonManifold
filter = StreamFilter(Gate=list, Stream0=pop2d, Stream1=pop3d)
filter_2 = StreamFilter(Gate=list, Stream0=unit, Stream1=unit_2)
filter_3 = StreamFilter(Gate=list, Stream0=rectangle.Rectangle, Stream1=[edges.Naked, edges.Interior, edges.NonManifold])
reset = Button()
go = BooleanToggle(False)
pt_4 = Point(filter)
vec = Vector(filter_2)
nr = Slider(3.5, range=0..5)
ser = Slider(0.25, range=0..1)
preview = CustomPreview(Geometry=filter_3, Material=ColourSwatch(SwatchColor=RGB(153, 153, 153)))
multiplication = Multiplication(A=nr, B=ser)
c_script = CSharpScript(
    reset=reset,
    go=go,
    P=pt_4,
    V=vec,
    nR=nr,
    coS=Slider(0.25, range=0..30),
    alS=Slider(9, range=0..30),
    seS=Slider(2, range=0..30),
    seR=multiplication)  # -> out, Ap, Av; inputs reset: Boolean, go: Boolean, P: list of Point3d, V: list of Vector3d, nR: Double, coS: Double, alS: Double, seS: Double, seR: Double
# ---------- c_script: C# ----------
        // token code
        // VS rulez
# ---------- c_script: C# additional code ----------
 

    public class AgentSystem
    {
        // fields
        public double MaxSpeed;

        // constructor

        // methods
    }


    public class Agent
    {
        // fields
        public Point3d position;
        public Vector3d velocity;
        public Vector3d desiredVelocity;
        public AgentSystem Flock;

        // constructor
        public Agent(Point3d position, Vector3d velocity)
        {
            this.position = position;
            this.velocity = velocity;
            desiredVelocity = this.velocity;
            // newVelocity = 0.85 * velocity + 0.15 * desiredVelocity;
        }

        // methods

        public void UpdateVelocityAndPosition()
        {
            // steering
            velocity = 0.97 * velocity + 0.03 * desiredVelocity;

            // limit velocity to MaxSpeed
            if (velocity.Length > Flock.MaxSpeed)
            {
                velocity.Unitize();
                velocity *= Flock.MaxSpeed;
            }

            position += velocity;
        }
    }
# ---------- end c_script ----------
ftsv2 = FileToScriptV2(File=path)
