# Grasshopper definition CS_00_intro.gh (Grasshopper 1.0.7)
# Copyright: Co-de-iT

# Rhino/GH
# https://developer.rhino3d.com/ - Rhino developer home page
# 
# https://developer.rhino3d.com/api/ - API references
# 
# http://developer.rhino3d.com/guides/rhinocommon/what-is-rhinocommon/
# 
# https://developer.rhino3d.com/api/RhinoCommon - RhinoCommon SDK
# 
# https://developer.rhino3d.com/api/grasshopper - Grasshopper SDK
# C# component
# warning/error messages
# and results of Print() function
# outputs
# inputs
# double-click
# to open editor
# right-click to
# set output name
# 
# zoom in
# to add or remove
# right-click to
# set input name,
# type and structure
# 
# zoom in
# to add or remove
c_script = CSharpScript()  # -> Out, A
# CS_00_intro
# 
# C# - intro definition
# 
# © a3 _/TH.esis 2019 _ Creative Commons Attribution-NonCommercial-ShareAlike3.0 UnportedLicense.
# https://msdn.microsoft.com/en-gb/library/67ef8sbd.aspx - C# programming guide
# not Hello World (but sort of)
panel = Panel("<input your name>")
# sum of 2 numbers
number_slider = Slider(25.915, range=0..100)
# create Point
number_slider_2 = Slider(47.361, range=0..100)
c_script_2 = CSharpScript(A=number_slider, B=Slider(63.292, range=0..100))  # -> out, S; inputs A: Double, B: Double
# ---------- c_script_2: C# ----------
    S = A + B;

    Print("The sum of A and B is {0}", A+B);
# ---------- end c_script_2 ----------
c_script_3 = CSharpScript(x=number_slider_2, y=Slider(47.361, range=0..100), z=Slider(0, range=0..100))  # -> out, A; inputs x: Double, y: Double, z: Double
# ---------- c_script_3: C# ----------
    A = new Point3d(x, y, z);
# ---------- end c_script_3 ----------
c_script_4 = CSharpScript(x=panel, y="<input your age>")  # -> out, A
# ---------- c_script_4: C# ----------
    Print("Hello {0}, 'tis a fine day to learn C#!\n\nAnd at the tender age of {1}!", x, y);
# ---------- end c_script_4 ----------
# C#
panel_2 = Panel(c_script_4.out)
panel_3 = Panel(c_script_2.out)
panel_4 = Panel(c_script_2.S)
pt = Point(c_script_3.A)
