# Grasshopper definition 01-02_boundary behaviors intuition.gh (Grasshopper 1.0.7)
# Copyright: Co-de-iT
# plug-ins: Anemone

# Rectangular boundary + wrap mode automatically disables bounce mode.
# 
# Curve boundary automatically disables wrap mode and enables bounce mode.
boundary_curve = ValueList({"rectangular": 0, "curve": 1}, selected="curve")
wrap_boundary = BooleanToggle(True)
number_slider = Slider(200, range=2..1000)
seed = Slider(10, range=1..100)
start = Button()
rectangle = Rectangle(Plane=PlaneXY(0, 0, 0), XSize="-5 to 5", YSize="-5 to 5", Radius=0)  # -> Rectangle, Length
pop2d = Populate2D(Region=rectangle.Rectangle, Count=number_slider, Seed=1)  # -> simplify(graft(Population))
random_vectors = CSharpScript(n=number_slider, S=seed)  # -> out, simplify(graft(V)); inputs n: Int32, S: Int32
# ---------- random_vectors: C# ----------
    if (n <= 0 || S < 0) return;

    List <Vector3d> vecs = new List<Vector3d>();
    Vector3d v;
    rnd = new Random(S);

    for (int i = 0; i < n; i++)
    {
      v = new Vector3d(1, 0, 0);
      v.Rotate(rnd.NextDouble() * Math.PI * 2, Vector3d.ZAxis);
      vecs.Add(v);
    }

    V = vecs;
# ---------- random_vectors: C# additional code ----------
  Random rnd;
# ---------- end random_vectors ----------
not = GateNot(A=boundary_curve)

# ---- group: curve boundary
crv = Curve(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)

# ---- group: rectangular boundary
number_slider_2 = Slider(50, range=0..100)
number_slider_3 = Slider(25, range=0..100)
c_script = CSharpScript(n=number_slider_2)  # -> D; inputs n: Double
# ---------- c_script: C# ----------
    D = new Interval(-n, n);
# ---------- end c_script ----------
c_script_2 = CSharpScript(n=number_slider_3)  # -> D; inputs n: Double; same code as c_script
rectangle_2 = Rectangle(Plane=PlaneXY(0, 0, 0), XSize=c_script, YSize=c_script_2, Radius=0)  # -> Rectangle, Length
filter = StreamFilter(Gate=boundary_curve, Stream0=rectangle_2.Rectangle, Stream1=crv)

# ---- group: curve to avoid/repel
crv_2 = Curve(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)

# ----
and = GateAnd(A=not, B=wrap_boundary)
loop_start = LoopStart(N=Slider(200, range=0..300), T=start, D0=pop2d, D1=random_vectors.V)  # -> port, Counter, Data, Data_2; disabled
vdisex = VectorDisplayEx(Point=pop2d, Vector=random_vectors.V, Colour=RGB(0, 0, 0), Width=2)
# 01-02_boundary behaviors - intuition
# 
# wrap, bounce, repel, avoid behavior - intuition approach
# 
# © a3 _/TH.esis 2019 _ Creative Commons Attribution-NonCommercial-ShareAlike3.0 UnportedLicense.
panel = Panel(loop_start.Counter)
item = ListItem(List=loop_start.Data, Index="-1", Wrap=True)
item_2 = ListItem(List=loop_start.Data_2, Index="-1", Wrap=True)
crv_cp = CurveClosestPoint(Point=item, Curve=filter)  # -> Point, Parameter, Distance
crv_cp_2 = CurveClosestPoint(Point=item, Curve=crv_2)  # -> Point, Parameter, Distance
eval = EvaluateCurve(Curve=filter, Parameter=crv_cp.Parameter)  # -> Point, Tangent, Angle
eval_2 = EvaluateCurve(Curve=crv_2, Parameter=crv_cp_2.Parameter)  # -> Point, Tangent, Angle

# ---- group: acceleration influence
# anything (internal or external) affecting the motion of the particle is a vector that feeds here
vec = Vector()

# ----
boundary_behavior_type = ValueList({"repel": 0, "avoid": 1}, selected="avoid")
max_speed = Slider(1, range=0..2)

far_dist = Slider(5, range=0..10)
close_intensity = Slider(0.1, range=0..10)
# avoid behavior
far_intensity = Slider(0, range=0..10)
close_dist = Slider(0.05, range=0..10)
num = Number(crv_cp_2.Distance)
Z = UnitZ(Factor=1)
dom = ConstructDomain(DomainStart=close_dist, DomainEnd=far_dist)
dom_2 = ConstructDomain(DomainStart=close_intensity, DomainEnd=far_intensity)
xprod = CrossProduct(VectorA=eval_2.Tangent, VectorB=Z, Unitize=False)  # -> Vector, Length
remap = RemapNumbers(Value=num, Source=dom, Target=dom_2)  # -> Mapped, Clipped

# ---- group: steering vector
subtraction = Subtraction(A=xprod.Vector, B=item_2)

# ----
multiplication = Multiplication(A=remap.Clipped, B=subtraction)

close_dist_2 = Slider(0.1, range=0..10)
far_dist_2 = Slider(5, range=0..10)
close_intensity_2 = Slider(1, range=0..10)
far_intensity_2 = Slider(0, range=0..10)
Z_2 = UnitZ(Factor=1)
dom_3 = ConstructDomain(DomainStart=close_dist_2, DomainEnd=far_dist_2)
dom_4 = ConstructDomain(DomainStart=close_intensity_2, DomainEnd=far_intensity_2)
dprod = DotProduct(VectorA=item_2, VectorB=eval_2.Tangent, Unitize=False)
remap_2 = RemapNumbers(Value=crv_cp_2.Distance, Source=dom_3, Target=dom_4)  # -> Mapped, Clipped

amp = Amplitude(Vector=eval_2.Tangent, Amplitude=dprod)

multiplication_2 = Multiplication(A=remap_2.Clipped, B=amp)

filter_2 = StreamFilter(Gate=boundary_behavior_type, Stream0=multiplication, Stream1=multiplication_2)
vdisex_2 = VectorDisplayEx(Point=item, Vector=filter_2, Colour=ColourSwatch(SwatchColor=RGB(255, 212, 0)), Width="4")

# ----
# bounce behavior - boundary
close_dist_3 = Slider(0.05, range=0..10)
far_dist_3 = Slider(1, range=0..10)
close_intensity_3 = Slider(2, range=0..10)
# repel behavior
far_intensity_3 = Slider(0, range=0..10)
Z_3 = UnitZ(Factor=1)
dom_5 = ConstructDomain(DomainStart=close_dist_3, DomainEnd=far_dist_3)
dom_6 = ConstructDomain(DomainStart=close_intensity_3, DomainEnd=far_intensity_3)
xprod_2 = CrossProduct(VectorA=eval.Tangent, VectorB=Z_3, Unitize=False)  # -> Vector, Length
remap_3 = RemapNumbers(Value=crv_cp.Distance, Source=dom_5, Target=dom_6)  # -> Mapped, Clipped

# ---- group: invert direction (stay inside the curve)
rev = Reverse(Vector=xprod_2.Vector)

# ----
multiplication_3 = Multiplication(A=remap_3.Clipped, B=rev)

gate = StreamGate(Stream=multiplication_3, Gate=and)  # -> Target0, Target1

# ---- group: add to speed
addition = Addition(A=item_2, B=vec, C=gate.Target0, D=filter_2)

# ----
vlen = VectorLength(Vector=addition)
min = Minimum(A=vlen, B=max_speed)

# ---- group: limit speed
amp_2 = Amplitude(Vector=addition, Amplitude=min)

# ---- group: move point
move = Move(Geometry=item, Motion=amp_2)  # -> Geometry, Transform

# ---- group: wrap boundary
# wrap boundary logic: the environment is a rectangle which size is (-x to x) and (-y to y).
# 
# For each point:
# if (P.x < -x) then P.x = x
# else if (P.x > x) then P.x = -x
# else do nothing (passes P.x)
# 
# same logic for P.y, tested on (-y to y)
# 
# since it is 2D, P.z is always 0
# 
# NOTE: wrap logic makes sense only for "theoretical" environments, limiting the euclidean coordinates extension - the underlying hypothesis is that the universe is "closed" (if you go along one direction sooner or later you come back to your original position, like on a sphere)
expression = Expression(
    x=number_slider_2,
    y=number_slider_3,
    P=move.Geometry,
    Expression="{If(P.x<-x, x,If(P.x>x,-x,P.x)),If(P.y<-y, y,If(P.y>y,-y,P.y)),0}")

# ----
filter_3 = StreamFilter(Gate=and, Stream0=move.Geometry, Stream1=expression)
merge = Merge(Data1=loop_start.Data, Data2=simplify(filter_3))
merge_2 = Merge(Data1=loop_start.Data_2, Data2=simplify(amp_2))

# ---- group: display current velocity
swatch = ColourSwatch(SwatchColor=RGB(156, 107, 118))
vdisex_3 = VectorDisplayEx(Point=filter_3, Vector=amp_2, Colour=swatch, Width=2)

# ---- group: limit trail length
trail_length = Slider(10, range=1..50)
larger = LargerThan(FirstNumber=loop_start.Counter, SecondNumber=expr("x-1", trail_length))  # -> LargerThan, OrEqualTo
shift = ShiftList(List=merge, Shift=larger.OrEqualTo, Wrap="false")
shift_2 = ShiftList(List=merge_2, Shift=larger.OrEqualTo, Wrap="false")
range = Range(Domain=Domain(0, 1), Steps=expr("x-1", trail_length))

# ----
merge_3 = Merge(Data1=ColourSwatch(SwatchColor=RGBA(255, 255, 255, 0)), Data2=swatch)
running = Running(
    port=loop_start.port,
    Exit=False,
    Data=simplify(shift),
    Data_2=simplify(shift_2),
    TimeOutVal=0,
    pausedState=False,
    state="Constant output")  # -> D0, D1
interp = InterpolateData(Data=merge_3, Parameter=range, Interpolation=2)
pt = Point(running.D0)
vec_2 = Vector(running.D1)
vdisex_4 = VectorDisplayEx(Point=pt, Vector=vec_2, Colour=interp, Width=1)
