# Grasshopper definition AgentSystemFinal_full optional.gh (Grasshopper 1.0.7)
# Copyright: Co-de-iT
# plug-ins: FileToScript, Chromodoris, ghgl

# ---- group: File referencing
# file sources
dir_type = ValueList({"desktop": 0, "documents": 1, "GH file path": 2, "C:": 3}, selected="GH file path")
file_name = Panel("changelog.txt")
file_name_2 = Panel("AgentSystemFinal.cs")
file_name_3 = Panel("AgentSystemFinal - Align Planes.cs")
f_pathg = PathGenerator(type=dir_type)  # -> dir; inputs type: Int32, subDir: String
# ---------- f_pathg: C# ----------
                           /*
    froGH - a sparse collection of (in)utilities for Grasshopper

    Path Generator
    code by Alessio Erioli - value list generation based on code by James Ramsden

    froGH by Co-de-iT is licensed under a Creative Commons Attribution 4.0 International License.
    http://creativecommons.org/licenses/by/4.0/

    */
    initComp();


    String S = "";
    String root = "";
    String end = "\\";
    String eol = Environment.NewLine;

    // __________________ autoList part __________________

    // variable for the list
    Grasshopper.Kernel.Special.GH_ValueList vList;
    // tries to cast input as list
    try{

      // if the list is not the first parameter then change Input[0] to the corresponding value
      vList = (Grasshopper.Kernel.Special.GH_ValueList) Component.Params.Input[0].Sources[0];
      // Print("value list connected");
      // check if the list must be created
      //if (vList.NickName != "dir type"){
      if (!vList.NickName.Equals("dir type")){
        vList.ClearData();
        vList.ListItems.Clear();
        vList.NickName = "dir type";
        var item1 = new Grasshopper.Kernel.Special.GH_ValueListItem("desktop", "0");
        var item2 = new Grasshopper.Kernel.Special.GH_ValueListItem("documents", "1");
        var item3 = new Grasshopper.Kernel.Special.GH_ValueListItem("GH file path", "2");
        var item4 = new Grasshopper.Kernel.Special.GH_ValueListItem("C:", "3");
        vList.ListItems.Add(item1);
        vList.ListItems.Add(item2);
        vList.ListItems.Add(item3);
        vList.ListItems.Add(item4);

        vList.ListItems[0].Value.CastTo(out type);
      }
    }
    catch{
      // handles anything that is not a value list
    }


    switch(type){
      case 0:
        root = Environment.GetFolderPath(Environment.SpecialFolder.Desktop) + end;
        S = "Desktop";
        break;
      case 1:
        root = Environment.GetFolderPath(Environment.SpecialFolder.MyDocuments) + end;
        S = "Documents";
        break;
      case 2:
        GH_Document ghDoc = owner.OnPingDocument();

        if (ghDoc.IsFilePathDefined)
        {
          int nameLen = ghDoc.DisplayName.TrimEnd('*').Length + 3; // +3 accounts for the '.gh' extension
          int fileLen = ghDoc.FilePath.TrimEnd('*').Length;

          //F = ghDoc.DisplayName.TrimEnd('*');
          root = ghDoc.FilePath.Substring(0, fileLen - nameLen);
          //root = gh_d.FilePath;
          S = "GH File path";
        }
        else
        {
          Print("No path defined. Saving to Desktop until then");
          root = Environment.GetFolderPath(Environment.SpecialFolder.Desktop);
          S = "Desktop";
        }
        break;
      case 3:
        root = "C:" + end;
        S = root + end;
        break;
    }
    dir = root + (subDir != null ? (subDir + end) : "");
    Component.Message = S;
# ---------- f_pathg: C# additional code ----------
  void initComp(){
    Component.Name = "Path Generator";
    Component.NickName = "f_PathG";
    Component.Description = "generates a path based on local direcories such as Desktop, Documents, GH file path";
    Component.Params.Input[0].Name = "dir type";
    Component.Params.Input[0].Description = "directory type: 0 desktop, 1 documents, 2 GH file path, 3 C:\nconnect a value list for automatic list generation";
    Component.Params.Input[1].Name = "custom subdir";
    Component.Params.Input[1].Description = "(optional) custom subdirectory";
  }
# ---------- end f_pathg ----------
f_pathg_2 = PathGenerator(type=dir_type, subDir="AgentSystemFinal")  # -> dir; inputs type: Int32, subDir: String; same code as f_pathg
concat = Concatenate(FragmentA=f_pathg_2, FragmentB=file_name_3)
concat_2 = Concatenate(FragmentA=f_pathg, FragmentB=file_name)
concat_3 = Concatenate(FragmentA=f_pathg_2, FragmentB=file_name_2)
file = ReadFile(File=concat_2, PerLineParse=False)
path = FilePath(concat)
path_2 = FilePath(concat_3)

# ----
changelog_txt = Panel(file)
# Agent Bodies on Mesh
# 
# Agent System patrolling mesh and building bodies-based structure
# 
# © a3 _/TH.esis 2019 _ Creative Commons Attribution-NonCommercial-ShareAlike3.0 UnportedLicense.
# preview
# input data & parameters
# main controls
referenced_script_files = Panel([concat_3, path])

# ---- group: base mesh (uncolored)
# output & exportable data
mesh = Mesh(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)

# ----
demesh = DeconstructMesh(Mesh=mesh)  # -> Vertices, Faces, Colours, Normals

# ---- group: Mesh Vertices
pt = Point(demesh.Vertices)

# ---- group: Vector field
vec = Vector([Vector(-0.0332211639, 0.02287567517, -0.9983703835), Vector(0.0153180461, -0.01476040479, -0.9995472632), Vector(-0.1087222269, 0.1175470216, -0.9736688524), Vector(-0.1416207492, 0.1115239847, -0.9663753198), Vector(0.02989168629, -0.03899025882, -0.9975804009), Vector(0.02699331982, -0.04783485097, -0.9969740372)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])

# ---- group: vector field
vec_2 = Vector(vec)

# ---- group: normalized scalar field
num = Number([0.6517018921, 0.7042763317, 0.7343410065, 0.6909366206, 0.7445720781, 0.7756869701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])

# ---- group: scalar field
num_2 = Number(num)

# ---- group: Agents Positions
pt_2 = Point([Point(37.83466721, 10.35859299, 35.09539795), Point(50.77505112, 50, 55.30277634), Point(92.41492462, 76.41574097, 36.99228668), Point(40.17069626, 75.55685425, 39.63570404), Point(37.94506836, 5.20778656, 62.44431305), Point(108.5765686, 37.05151749, 51.12462616)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])

# ---- group: Agents Velocities
vec_3 = Vector([Vector(-0.3169609159, 0.4206988344, 0.8500283928), Vector(-0.869591722, 0.3234346007, -0.3730955589), Vector(0.9246102932, 0.07728714657, -0.3729912905), Vector(-0.0360646025, -0.3275795065, 0.9441350599), Vector(0.6968077336, 0.6897782949, -0.196633889), Vector(0.2691810756, -0.5066738109, 0.819037971)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])

# ----
gradient = Gradient(LowerLimit=0, UpperLimit=1, Parameter=num_2, stops=[0.218: RGB(0, 0, 0), 0.7: RGBA(255, 255, 255, 0)])
# preview pre-simulation data
number_slider = Slider(0.5, range=0..1)
point_size = Slider(5, range=1..20)
unit = UnitVector(Vector=vec_2)
amp = Amplitude(Vector=vec_2, Amplitude=Slider(0.8, range=0..1))

# ---- group: Convert data to color
# pre-simulation
# NOTE: this gradient MUST be black to white, with black corresponding to the lowest value and white to the highest
gradient_2 = Gradient(LowerLimit=0, UpperLimit=1, Parameter=num, stops=[0: RGB(0, 0, 0), 1: RGB(255, 255, 255)])

# ---- group: Convert data to color / Vector to Color conversion
c_script = CSharpScript(V=vec)  # -> out, C; inputs V: list of Vector3d
# ---------- c_script: C# usings ----------
using System.Drawing;
using System.Threading;
using System.Threading.Tasks;
# ---------- c_script: C# ----------
    Color[] cols = new Color[V.Count];

    Parallel.For(0, V.Count, i =>
      {
      cols[i] = Color.FromArgb((int) Map(V[i].X, -1, 1, 0, 255), (int) Map(V[i].Y, -1, 1, 0, 255), (int) Map(V[i].Z, -1, 1, 0, 255));
      });

    C = cols;
# ---------- c_script: C# additional code ----------
  public double Map(double val, double fromMin, double fromMax, double toMin, double toMax)
  {
    return toMin + (val - fromMin) * (toMax - toMin) / (fromMax - fromMin);
  }
# ---------- end c_script ----------

# ---- group: scalar field as mesh
gl_mesh = GLMeshShader(
    M=mesh,
    VCol=gradient,
    LightIntens=number_slider,
    DrawMode=4,
    FragmentShader="""#version 330

uniform vec3 _lightDirection[4];
uniform mat3 _worldToCameraNormal;

uniform float lightIntens;

in  vec3 normal;
in vec4 vertexColor;
out vec4 FragColor;

void main()
{
  vec3 l = normalize(_lightDirection[0]);
  vec3 camNormal = _worldToCameraNormal * normal;
  float intensity = dot(l,normalize(camNormal.xyz));
  vec4 diffuse = vec4(1,1,1,1) * 0.5;

  vec3 ambient = vec3(0.1,0.1,0.1) * diffuse.rgb;
  vec3 c = ambient + diffuse.rgb * abs(intensity);
  vec4 mixColor = vertexColor + (vec4(c, diffuse.a) * lightIntens);
  FragColor = mixColor;
}""",
    GLShader=(0, 1, 0),
    VertexShader="""#version 330

layout(location = 0) in vec3 _meshVertex;
layout(location = 1) in vec3 _meshNormal;
layout(location = 2) in vec4 vCol;

out vec4 vertexColor;

uniform mat4 _worldToClip;
out vec3 normal;

void main() 
{
  normal = _meshNormal;
vertexColor = vCol;
  gl_Position = _worldToClip * vec4(_meshVertex,1);
}""",
    glLineWidth=3,
    glPointSize=8)

# ---- group: scalar field as points
gl_shader = GLShader(
    Vertex=pt,
    Vcolor=gradient,
    Size=point_size,
    DrawMode=0,
    FragmentShader="""#version 330

in vec4 vertex_color;

void main()
{
  gl_FragColor = vertex_color;
}""",
    GLShader=(0, 1, 0),
    VertexShader="""#version 330

layout(location = 0) in vec3 vertex;
layout(location = 1) in vec4 vcolor;
uniform mat4 _worldToClip;
uniform int size;
out vec4 vertex_color;

void main() 
{
  vertex_color = vcolor;
  gl_Position = _worldToClip * vec4(vertex,1);
  gl_PointSize = size;
}""",
    glLineWidth=3,
    glPointSize=8)

# ---- group: vector field
vdisex = VectorDisplayEx(Point=pt, Vector=amp, Colour=unit, Width=2)

# ---- group: Mesh with scalar field
conmesh = ConstructMesh(Vertices=demesh.Vertices, Faces=demesh.Faces, Colours=gradient_2)

# ---- group: Mesh with vector field
conmesh_2 = ConstructMesh(Vertices=demesh.Vertices, Faces=demesh.Faces, Colours=c_script.C)

# ---- group: agent body polylines
crv = Curve([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])

# ---- group: Body Collision Rectangle sizes
half_length_x = Slider(7.46, range=0..10)
half_width_y = Slider(3.151, range=0..10)

# ----
reset = Button()
go = BooleanToggle(False)

# ---- group: agent parameters
number_slider_2 = Slider(0.3, range=0..1)
number_slider_3 = Slider(1.5, range=1..3)

# ---- group: trail flocking parameters
agangvis_deg = Slider(86, range=0..180)
number_slider_4 = Slider(5, range=0..5)
number_slider_5 = Slider(0.1, range=0..5)
number_slider_6 = Slider(3, range=0..50)
number_slider_7 = Slider(1.5, range=0..50)
number_slider_8 = Slider(2, range=0..5)
number_slider_9 = Slider(10, range=1..30)

# ---- group: fields parameters
number_slider_10 = Slider(0.92, range=0..10)
number_slider_11 = Slider(0.08, range=0..1)

# ---- group: mesh parameters
number_slider_12 = Slider(5, range=0..10)
number_slider_13 = Slider(5, range=0..50)

# ---- group: Agent Body Collision Rectangle
symdom = CSharpScript(x=half_length_x, TooltipDescriptionOverride="Create Symmetric Domain", TooltipTextOverride="Symmetric Domain")  # -> D; inputs x: Double
# ---------- symdom: C# ----------
    D = new Interval(-x, x);
# ---------- end symdom ----------
symdom_2 = CSharpScript(x=half_width_y, TooltipDescriptionOverride="Create Symmetric Domain", TooltipTextOverride="Symmetric Domain")  # -> D; inputs x: Double; same code as symdom
rectangle = Rectangle(Plane=PlaneXY(0, 0, 0), XSize=symdom, YSize=symdom_2, Radius=0)  # -> Rectangle, Length

# ----
# Agent Body Rectangle & Body Plane: While the agents are running they scan (at the same frequency for trail update) for neighbour agents. If the current position projected on the mesh does not fall in any of the (eventually present) other agents' collision rectangle then a new body plane is deposited.
# 
# To check if the current point is inside or outside a rectangle, the steps in the algorithm are:
# 
# . project the point on a neighbour agent's body plane
# 
# . check if the point (in the plane coordinates) is inside the rectangle sizes or not: since the rectangle is always aligned with the X-Y axis couple it is sufficient to chek that the absolute values of the projected point coordinates are smaller than the rectangle half-length and half-width.
# example for the collision rectangle
# agent body
# agent collision rectangle
group = Group(Objects=crv)

rad = Radians(Degrees=agangvis_deg)
c_script_2 = CSharpScript(
    reset=reset,
    go=go,
    MScalar=conmesh,
    MVector=conmesh_2,
    vectorStrength=number_slider_10,
    scalarStrength=number_slider_11,
    meshSeekRad=number_slider_12,
    meshStrength=number_slider_13,
    agPos=pt_2,
    agVel=vec_3,
    agMaxSpeed=number_slider_2,
    futPosMult=number_slider_3,
    trailSeekRad=number_slider_4,
    agAngVis=rad,
    coheStrength=number_slider_5,
    aligStrength=number_slider_6,
    sepaStrength=number_slider_7,
    sepaRadius=number_slider_8,
    trailFreq=number_slider_9,
    BodyRectangle=rectangle.Rectangle)  # -> out, Ap, Av, neigh, Tr, BPl; inputs reset: Boolean, go: Boolean, MScalar: Mesh, MVector: Mesh, vectorStrength: Double, scalarStrength: Double, meshSeekRad: Double, meshStrength: Double, agPos: list of Point3d, agVel: list of Vector3d, agMaxSpeed: Double, futPosMult: Double, trailSeekRad: Double, agAngVis: Double, coheStrength: Double, aligStrength: Double, sepaStrength: Double, sepaRadius: Double, trailFreq: Int32, BodyRectangle: Rectangle3d
# ---------- c_script_2: C# ----------
        // output geometry initialization
        OutputGeom geomOut;

        // if base inputs are null return and do nothing
        if (MScalar == null || MVector == null || agPos == null || agVel == null) return;

        // initialize system on reset (or at first component run)
        if (reset || AgSys == null)
        {
            // initializing Mesh related variables
            MEnvironment = MScalar;                                 // Here you can use either one between MScalar and MVector
            MeshRTree = RTreeFromMesh(MScalar);                     // initialize Mesh RTree
            TensorField = TensorFieldFromMeshes(MScalar, MVector);    // initialize Tensor Point Field

            // initializing Trail related variables
            TrailPoints = new List<TrailPoint>();                   // List of all trail points
            TrailsRTree = new RTree();                              // initialize trails RTree
            TrailPtCount = 0;                                       // total count of trail points (as index to insert points in trails RTree)

            // initializing Body Planes related variables
            BodyPlanes = new List<Plane>();                         // List of all Body Planes
            BodyPlanesRTree = new RTree();                          // initialize Body Planes RTree
            bodyPlCount = 0;                                        // total count of Body Planes (as index to insert points in Body Planes RTree)

            // initializing Agent System and global variables
            AgSys = new AgentSystem(agPos, agVel);
            count = 0;

            debug = ""; // debug string
            /*
             * HOW TO USE DEBUG STRING
             * Since it is not possible to compile directly this code in VS, the trick is to define a debug string and add
             * checks and flags messages (or variable values) to it. Then uncheck the Print(debug) instruction at the bottom of this method.
             * 
             * Examples:
             * 
             * . check if a part of the code is executed:
             * debug += "I have been executed\n"; // the \n is an excape sequence equivalent to the Return button on the keyboard
             * 
             * . store a variable:
             * debug += Agent.position.ToString() + "\n"; // remember to convert to string (and add the new line escape sequence)
             */
        }

        if (go)
        {
            // update parameters 
            AgSys.VectorFieldStrength = vectorStrength;
            AgSys.ScalarFieldStrength = scalarStrength;
            AgSys.MeshSeekRadius = meshSeekRad;
            AgSys.MeshStrength = meshStrength;
            AgSys.MaxSpeed = agMaxSpeed;
            AgSys.futPosMultiplier = futPosMult;
            AgSys.TrailSeekRadius = trailSeekRad;
            AgSys.AngVis = agAngVis;
            AgSys.CohesionStrength = coheStrength;
            AgSys.AlignmentStrength = aligStrength;
            AgSys.SeparationStrength = sepaStrength;
            AgSys.SeparationRadius = sepaRadius;
            AgSys.TrailFrequency = trailFreq;
            AgentBodyWidth = BodyRectangle.X[1];
            AgentBodyHeight = BodyRectangle.Y[1];

            // update system
            AgSys.UpdateRTree();

            // update counter
            count++;

            // run component
            Component.ExpireSolution(true);
        }

        // extract geometries for output
        geomOut = AgSys.GetAllOut();

        // uncomment for DEBUG ONLY
        //geomOut.neighOut = AgSys.GetNeighbours(); // 1 of 2 - uncomment to output neighbour points for agents (debug mode)
        //Print(debug); // Prints debug messages stored in debug string

        Ap = geomOut.ptsOut;
        Av = geomOut.vecsOut;
        //neigh = geomOut.neighOut; // 2 of 2 - uncomment to output neighbour points for agents (debug mode)
        Tr = geomOut.trailsOut;
        BPl = BodyPlanes;
# ---------- c_script_2: C# additional code ----------
 

    // global variables
    public AgentSystem AgSys;                   // the agent system
    public static TensorPoint[] TensorField;    // tensor point array
    public static Mesh MEnvironment;            // the environment mesh
    public static RTree MeshRTree;              // RTree of mesh vertices

    public static List<TrailPoint> TrailPoints; // List of all TrailPoints
    public static RTree TrailsRTree;            // RTree of trail points
    public static int TrailPtCount;             // counter for Trail Points RTree

    public static List<Plane> BodyPlanes;       // List of all body planes
    public static RTree BodyPlanesRTree;        // Rree of body planes
    public static int bodyPlCount;              // counter for body planes RTree

    public static int count;                    // global counter for frequency
    public static double AgentBodyWidth;        // Agent Body Width
    public static double AgentBodyHeight;       // Agent Body Height

    public static String debug;                // the debug String

    // classes

    /// <summary>
    /// This class is the global Agent System simulation
    /// </summary>
    public class AgentSystem
    {
        public List<Agent> Agents;
        public List<Polyline> AgentsTrails;

        public double VectorFieldStrength;
        public double ScalarFieldStrength;
        public double MeshSeekRadius;
        public double MeshStrength;

        public double MaxSpeed;
        public double futPosMultiplier;
        public double TrailSeekRadius;
        public double AngVis;

        public double CohesionStrength;
        public double AlignmentStrength;
        public double SeparationStrength;
        public double SeparationRadius;

        public int TrailFrequency;


        public AgentSystem(List<Point3d> P, List<Vector3d> V)
        {
            Agents = new List<Agent>();

            for (int i = 0; i < P.Count; i++)
            {
                Agent ag = new Agent(P[i], V[i]);
                ag.Agents = this;

                Agents.Add(ag);
            }

        }


        /// <summary>
        /// This method is used with RTree for fast neighbour points search.
        /// </summary>
        public void UpdateRTree()
        {
            // debug string
            debug = "";

            // Flock with trails (OLD method)
            //List<Polyline> AllTrails = new List<Polyline>();
            //foreach (Agent ag in Agents)
            //    AllTrails.Add(ag.trail);

            foreach (Agent ag in Agents)
            {
                // if agent is not alive do not update and go to the next
                if (!ag.isAlive) continue;

                // clear neighbours list
                ag.neighTens.Clear();

                List<TrailPoint> neighTrails = new List<TrailPoint>();

                // Eventhandler callback function for Mesh RTree search
                EventHandler<RTreeEventArgs> MeshRTreeCallback = (object sender, RTreeEventArgs args) =>
                {
                    //Vector3d dir = Menv.Vertices[args.Id] - (ag.position + ag.velocity * futPosMultiplier);
                    //if (Vector3d.VectorAngle(ag.velocity, dir) < AngVis)
                    //{
                    //ag.neighbours.Add(MVector.Vertices[args.Id]);
                    ag.neighTens.Add(TensorField[args.Id]);
                    //}
                };

                // Eventhandler callback function for Trails RTree search
                EventHandler<RTreeEventArgs> TrailsRTreeCallback = (object sender, RTreeEventArgs args) =>
                {
                    // if trail point found is within angle of vision include in trail points neighbours
                    Vector3d dir = TrailPoints[args.Id].position - (ag.position + ag.velocity * futPosMultiplier);
                    if (Vector3d.VectorAngle(ag.velocity, dir) < AngVis)
                    {
                        neighTrails.Add(TrailPoints[args.Id]);
                    }
                };

                //                   Sphere(                     future position projected on Mesh                 ,   radius      ), callback function
                MeshRTree.Search(new Sphere(MEnvironment.ClosestPoint(ag.position + ag.velocity * futPosMultiplier), MeshSeekRadius), MeshRTreeCallback);

                //                   Sphere(               future position                ,   radius          ), callback function
                TrailsRTree.Search(new Sphere(ag.position + ag.velocity * futPosMultiplier, TrailSeekRadius), TrailsRTreeCallback);

                ag.ResetDesired();

                // the search neighbours functions for the Mesh points and TensorPoints
                // have been combined as:
                ag.SeekCombined(MeshStrength, ScalarFieldStrength, VectorFieldStrength);

                // Flock with trails
                if (neighTrails.Count > 0)
                    ag.FlockTrails(neighTrails);

                // Flock with trails (OLD METHOD)
                //ag.FlockTrailsClosestPt(AllTrails);


                // calls custom behavior (go to function implementation to write your code)
                ag.CustomBehavior();
            }

            // Update Agents Velocity and Positions (parallelized if n. of agents > 500)
            if (Agents.Count > 500)
            {
                Parallel.ForEach(Agents, ag =>
                {
                    ag.UpdateVelocityAndPosition();
                });
            }
            else
                foreach (Agent ag in Agents)
                    ag.UpdateVelocityAndPosition();
        }

        /// <summary>
        /// This method extracts output geometries and data in output separate arrays.
        /// </summary>
        public void GetAllOut(out GH_Point[] pts, out GH_Vector[] vecs, out Polyline[] trailsOut)
        {
            pts = new GH_Point[Agents.Count];
            vecs = new GH_Vector[Agents.Count];
            trailsOut = new Polyline[Agents.Count];

            for (int i = 0; i < Agents.Count; i++)
            {
                pts[i] = new GH_Point(Agents[i].position);
                vecs[i] = new GH_Vector(Agents[i].velocity);
                trailsOut[i] = Agents[i].trail;
            }
        }

        /// <summary>
        /// This method extracts output geometries and data in a dedicated class.
        /// </summary>
        public OutputGeom GetAllOut()
        {
            OutputGeom gOut = new OutputGeom(Agents.Count);


            //Parallel.For(0, Agents.Count, i =>
            for (int i = 0; i < Agents.Count; i++)
            {
                gOut.ptsOut[i] = new GH_Point(Agents[i].position);
                gOut.vecsOut[i] = new GH_Vector(Agents[i].velocity);
                gOut.trailsOut[i] = Agents[i].trail;
            }//);

            return gOut;
        }

        /// <summary>
        /// This method gets all Agents neighbours for debug output
        /// </summary>
        /// <returns>Neighbours for all agents as a Data Tree of GH_Point</returns>
        public DataTree<GH_Point> GetNeighbours()
        {
            DataTree<GH_Point> neighOut = new DataTree<GH_Point>();

            for (int i = 0; i < Agents.Count; i++)
            {
                neighOut.AddRange(Agents[i].GetNeighbours(), new GH_Path(i));
            }

            return neighOut;
        }

    }

    /// <summary>
    /// This class is a typical agent capable of Reynolds classic behaviors + customizable ones
    /// </summary>
    public class Agent
    {
        // fields
        public Point3d position;
        public Vector3d velocity;
        public Vector3d desiredVelocity;
        public Polyline trail;
        public AgentSystem Agents;
        public List<Point3d> neighbours;
        public List<TensorPoint> neighTens;
        public bool isAlive; // allows us to stop updating the agent in certain situations - not used yet but checked by AgentSystem.Update()

        // constructor
        public Agent(Point3d position, Vector3d velocity)
        {
            this.position = position;
            this.velocity = velocity;
            desiredVelocity = this.velocity;
            trail = new Polyline { this.position, this.position + this.velocity };

            // trail points added to a list and RTree for fast search
            TrailPoints.Add(new TrailPoint(this.position, this.velocity));
            TrailsRTree.Insert(this.position, TrailPtCount);
            TrailPtCount++;

            // neighbour points lists
            neighbours = new List<Point3d>(); // not used in this simulation
            neighTens = new List<TensorPoint>();
            isAlive = true;
        }

        // methods
        public void ResetDesired()
        {
            desiredVelocity = velocity;
        }

        /// <summary>
        /// This method implements flocking with trails neighbour points
        /// </summary>
        /// <param name="trailNeighbours">the neighbour trail points</param>
        public void FlockTrails(List<TrailPoint> trailNeighbours)
        {
            // ................................... COHESION BEHAVIOUR .....................
            //
            // find neighbours average
            Point3d average = new Point3d();

            foreach (TrailPoint neighbour in trailNeighbours)
                average += neighbour.position;

            average /= trailNeighbours.Count;

            // go there
            Vector3d cohesion = average - position;

            desiredVelocity += cohesion * Agents.CohesionStrength;

            // ................................... ALIGNMENT BEHAVIOUR .....................
            //
            Vector3d alignment = Vector3d.Zero;

            foreach (TrailPoint neighbour in trailNeighbours)
                alignment += neighbour.velocity;

            alignment /= trailNeighbours.Count;

            desiredVelocity += alignment * Agents.AlignmentStrength;

            // ................................... SEPARATION BEHAVIOUR .....................
            //
            Vector3d separation = Vector3d.Zero;

            foreach (TrailPoint trailNeighbour in trailNeighbours)
            {
                double distanceToNeighbour = position.DistanceTo(trailNeighbour.position);
                if (distanceToNeighbour < Agents.SeparationRadius)
                {
                    Vector3d getAway = position - trailNeighbour.position;
                    separation += getAway /= (getAway.Length * distanceToNeighbour);
                }

            }
            // sometimes, separation may result in a vector whose coordinates are NaN (Not a Number - the equivalent of null for int and double)
            // so, we need to check for NaN
            if (!Double.IsNaN(separation.X))
                desiredVelocity += separation * Agents.SeparationStrength;

        }

        /// <summary>
        /// This method implements flocking with the closest point to the closest trail
        /// </summary>
        /// <param name="AllTrails">all Agents trails as a List of Polyline</param>
        public void FlockTrailsClosestPt(List<Polyline> AllTrails)
        {
            // find closest trail point and dir

            double trailParameter;
            Point3d testPoint = new Point3d();
            Point3d nearest = new Point3d();
            Point3d futPos = position + velocity;
            Vector3d nearestDir = new Vector3d();
            double dd;
            double MinD = Double.MaxValue;
            foreach (Polyline tr in AllTrails)
            {
                // if it's not the trail of the current agent....
                if (AllTrails.IndexOf(tr) != Agents.Agents.IndexOf(this))
                {
                    // evaluate closest point and its distance
                    trailParameter = tr.ClosestParameter(futPos);
                    testPoint = tr.PointAt(trailParameter);
                    dd = testPoint.DistanceToSquared(futPos);
                    // if closer that the min distance
                    if (dd < MinD)
                    {
                        MinD = dd;
                        nearest = new Point3d(testPoint);
                        nearestDir = tr.TangentAt(trailParameter);
                    }
                }

            }

            FlockSinglePoint(nearest, nearestDir);
        }

        /// <summary>
        /// Implements flocking with a single point - used by FlockTrailsClosestPt
        /// </summary>
        /// <param name="target"></param>
        /// <param name="targetVel"></param>
        public void FlockSinglePoint(Point3d target, Vector3d targetVel)
        {
            // ................................... COHESION BEHAVIOUR .....................
            //
            // go there
            Vector3d cohesion = target - position;

            desiredVelocity += cohesion * Agents.CohesionStrength;

            // ................................... ALIGNMENT BEHAVIOUR .....................
            //
            Vector3d alignment = Vector3d.Zero;

            desiredVelocity += targetVel * Agents.AlignmentStrength;

            // ................................... SEPARATION BEHAVIOUR .....................
            //
            Vector3d separation = Vector3d.Zero;

            double distanceToNeighbour = position.DistanceTo(target);
            if (distanceToNeighbour < Agents.SeparationRadius)
            {
                Vector3d getAway = position - target;
                separation += getAway /= (getAway.Length * distanceToNeighbour);
            }
            desiredVelocity += separation * Agents.SeparationStrength;
        }

        /// <summary>
        /// Seek behavior with a target Point3d and a given strength
        /// </summary>
        /// <param name="target"></param>
        /// <param name="strength"></param>
        public void SeekPoint(Point3d target, double strength)
        {
            Vector3d seek = target - position;
            seek.Unitize();
            seek *= Agents.MaxSpeed;

            desiredVelocity += seek * strength;
        }

        /// <summary>
        /// Seek the neighbour TensorPoint List aiming for the highest value in scalar field and aligning with vector field
        /// </summary>
        /// <param name="meshStrength">strength with which to seek mesh points</param>
        /// <param name="scalarStrength">strength with which to seek point with highest scalar value</param>
        /// <param name="vectorStrength">strength with which to align with highest value direction</param>
        public void SeekCombined(double meshStrength, double scalarStrength, double vectorStrength)
        {
            // if there are no neighbours return
            if (neighTens.Count <= 0) return;

            double val;
            double MaxVal = -1.0;
            int MaxInd = -1;
            Point3d average = new Point3d();

            // find point with max intensity
            for (int i = 0; i < neighTens.Count; i++)
            {
                average += neighTens[i].position;

                val = neighTens[i].scalar; // brightness is 0-1 and RGB 0-255
                if (val > MaxVal)
                {
                    MaxVal = val;
                    MaxInd = i;
                }
            }

            // mesh contribution
            average /= neighTens.Count;
            SeekPoint(average, meshStrength);

            // field (vector + scalar) contribution
            Vector3d seek = (neighTens[MaxInd].position - position) * scalarStrength + neighTens[MaxInd].vector * vectorStrength;

            desiredVelocity += seek;
        }

        public void CustomBehavior()
        {
            // add your custom behavior here

            // end of custom behavior
        }

        /// <summary>
        /// Updates velocity and position for the agent, trail points and calls body plane deposition
        /// </summary>
        public void UpdateVelocityAndPosition()
        {
            // steering method
            velocity = 0.97 * velocity + 0.03 * desiredVelocity;

            // limit the velocity to maximum speed (0.5)
            if (velocity.Length > Agents.MaxSpeed)
            {
                velocity.Unitize();
                velocity *= Agents.MaxSpeed;
            }

            position += velocity;

            // update trail on given frequency
            if (count % Agents.TrailFrequency == 0)
            {
                // ad trail point to global list and RTree
                TrailPoints.Add(new TrailPoint(position, velocity));
                TrailsRTree.Insert(position, TrailPtCount);
                TrailPtCount++;

                // add trail point to trail polyline
                trail.Add(position);

                // tries to deposit a body plane
                DepositPlane();
            }

        }

        /// <summary>
        /// checks if a body plane can be deposited and if so adds it to the List
        /// </summary>
        public void DepositPlane()
        {
            List<Plane> neighPlanes = new List<Plane>();

            // Eventhandler callback function for Mesh RTree search
            EventHandler<RTreeEventArgs> BodyRTreeCallback = (object sender, RTreeEventArgs args) =>
            {
                neighPlanes.Add(BodyPlanes[args.Id]);
            };

            MeshPoint mp = MEnvironment.ClosestMeshPoint(position, 100);

            //                 Sphere(position projected on Mesh, radius), callback function
            BodyPlanesRTree.Search(new Sphere(mp.Point, 5.0), BodyRTreeCallback);

            Vector3d xAxis = new Vector3d(velocity);

            if (neighPlanes.Count > 0)
            {
                Point3d PtOnPlane;
                Vector3d alignDir = Vector3d.Zero;

                bool deposit = true;
                foreach (Plane neighPlane in neighPlanes)
                {
                    // project candidate plane origin on each neighbour plane and convert into plane coordinates
                    neighPlane.RemapToPlaneSpace(neighPlane.ClosestPoint(mp.Point), out PtOnPlane);

                    // if point is within body rectangle of at least one neighbour exit loop
                    if (Math.Abs(PtOnPlane.X) < AgentBodyWidth && Math.Abs(PtOnPlane.Y) < AgentBodyHeight)
                    {
                        deposit = false;
                        break;
                    }
                    alignDir += neighPlane.XAxis;
                }

                if (!deposit) return;

                alignDir /= neighPlanes.Count;

                xAxis = xAxis * 0.97 + alignDir * 0.03;
            }

            // build body plane
            Vector3d yAxis = Vector3d.CrossProduct(velocity, MEnvironment.NormalAt(mp));
            Plane pl = new Plane(mp.Point, xAxis, yAxis);

            // Add plane to the list of Body Planes
            BodyPlanes.Add(pl);

            // Add origin to RTree and increase count
            BodyPlanesRTree.Insert(pl.Origin, bodyPlCount);
            bodyPlCount++;
        }

        /// <summary>
        /// This function gets Agent neighbours for output
        /// </summary>
        /// <returns>a List of GH_Point</returns>
        public List<GH_Point> GetNeighbours()
        {
            List<GH_Point> neighOut = new List<GH_Point>();

            foreach (TensorPoint n in neighTens)
                neighOut.Add(new GH_Point(n.position));

            return neighOut;
        }

    }

    /// <summary>
    /// This class associates vector and scalar values with a point in 3D space.
    /// </summary>
    public class TensorPoint
    {
        public Point3d position;
        public Vector3d vector;
        public double scalar;

        public TensorPoint(Point3d position, Vector3d vector, double scalar)
        {
            this.position = position;
            this.vector = vector;
            this.scalar = scalar;
        }
    }

    /// <summary>
    /// This class acts as a container for output geometry.
    /// </summary>
    public class OutputGeom
    {

        public GH_Point[] ptsOut;
        public GH_Vector[] vecsOut;
        public Polyline[] trailsOut;
        public DataTree<GH_Point> neighOut;
        private int size;

        public OutputGeom(int size)
        {
            this.size = size;
            ptsOut = new GH_Point[this.size];
            vecsOut = new GH_Vector[this.size];
            trailsOut = new Polyline[this.size];
            neighOut = new DataTree<GH_Point>();
        }
    }

    /// <summary>
    /// This class acts as a container for trail points, storing position and agent velocity at that position.
    /// </summary>
    public class TrailPoint
    {
        public Point3d position;
        public Vector3d velocity;

        public TrailPoint(Point3d position, Vector3d velocity)
        {
            this.position = position;
            this.velocity = velocity;
        }

        // "zero" constructor
        public TrailPoint() : this(new Point3d(), Vector3d.Zero)
        { }
    }

    // utilities functions

    /// <summary>
    /// This method builds an RTree from a Mesh, adding all vertices.
    /// </summary>
    /// <param name="M">An input Mesh</param>
    /// <returns>An RTree containing the positions of the Mesh vertices</returns>
    public RTree RTreeFromMesh(Mesh M)
    {
        // compact creation mode
        return RTree.CreateFromPointArray(M.Vertices.ToPoint3dArray());

        // extensive creation mode (adding points one by one)
        //RTree MPoints = new RTree();
        //for (int i = 0; i < M.Vertices.Count; i++)
        //    MPoints.Insert(M.Vertices[i], i);
        //return MPoints;
    }

    /// <summary>
    /// This method builds a TensorPoint array from two colored Meshes, one TensorPoint for each Mesh vertex.
    /// </summary>
    /// <remarks>
    /// The Mesh colors are converted into 0 to 1 range from brightness for the scalar field and
    /// to a -1.0 to 1.0 range for Vector X, Y, Z coordinate from 0-255 RGB values respectively.
    /// MScalar and MVector must have the same number of vertices (M.Vertices.Count) and indexed identically
    /// The best strategy is to build MScalar and MVector from the same mesh, just assigning different colors:
    /// . a grayscale pattern for MScalar
    /// . an RBG pattern for MVector
    /// </remarks>
    /// <param name="MScalar">Colored Mesh for scalar field</param>
    /// <param name="MVector">Colored Mesh for Vector field</param>
    /// <returns>An array of TensorPoint, its Length equal to the number of vertices in each Mesh and with corresponding indexes.</returns>
    public TensorPoint[] TensorFieldFromMeshes(Mesh MScalar, Mesh MVector)
    {
        TensorPoint[] MeshField = new TensorPoint[MScalar.Vertices.Count];
        TensorPoint tp;


        for (int i = 0; i < MScalar.Vertices.Count; i++)
        {
            tp = new TensorPoint(MScalar.Vertices[i], VectorFromColor(MVector.VertexColors[i]), MScalar.VertexColors[i].GetBrightness());
            MeshField[i] = tp;
        }

        return MeshField;
    }

    /// <summary>
    /// This function converts a 0-255 RGB color into a -1 to 1 Vector3d
    /// </summary>
    /// <param name="col"></param>
    /// <returns>Vector3d in a -1 to 1 range</returns>
    public Vector3d VectorFromColor(Color col)
    {
        Vector3d vCol = new Vector3d();

        vCol = new Vector3d(
            Map(col.R, 0.0, 255.0, -1.0, 1.0),
            Map(col.G, 0.0, 255.0, -1.0, 1.0),
            Map(col.B, 0.0, 255.0, -1.0, 1.0)
            );
        return vCol;
    }

    /// <summary>
    /// This Function maps a value from a source domain to a destination domain
    /// </summary>
    /// <param name="val">the value</param>
    /// <param name="fromMin">low value of source domain</param>
    /// <param name="fromMax">high value of source domain</param>
    /// <param name="toMin">low value of destination domain</param>
    /// <param name="toMax">high value of destination domain</param>
    /// <returns>the remapped value</returns>
    public double Map(double val, double fromMin, double fromMax, double toMin, double toMax)
    {
        return toMin + (val - fromMin) * (toMax - toMin) / (fromMax - fromMin);
    }
# ---------- end c_script_2 ----------
ftsv2 = FileToScriptV2(File=path_2)
# simulation
debug_messages = Panel(c_script_2.out)

# ---- group: agents current velocity
vec_4 = Vector(c_script_2.Av)

# ---- group: agents trails polylines
crv_2 = Curve(c_script_2.Tr)

# ---- group: agents body planes
# preview post-simulation data
pln = Plane(c_script_2.BPl)

# ---- group: agents current positions
pt_3 = Point(c_script_2.Ap)

# ---- group: agents neighbour points (FOR DEBUG)
pt_4 = Point(c_script_2.neigh)  # disabled

# ---- group: trails preview
number_slider_14 = Slider(5, range=1..20)  # disabled
explode = Explode(Curve=crv_2, Recursive=True)  # -> Segments, flatten(Vertices); disabled
swatch = ColourSwatch(SwatchColor=RGB(145, 121, 121))

# ---- group: trails as mesh pipes and spheres - for rendering purposes only
# this component comes from Chromodoris (check food4rhino for download)
panel = Panel("0.5")
msphere = MeshSphere(Base=explode.Vertices, Radius=panel, UCount="10", VCount="10")  # -> flatten(Mesh)
gate = StreamGate(Stream=crv_2, Gate=go)  # -> Target0, Target1; disabled
mjoin = MeshJoin(Meshes=msphere)
mpipe = MeshPipe(Polylines=gate.Target0, NumberOfSides=4, Radius="0.2", Cap=False)
preview = CustomPreview(Geometry=[mjoin, mpipe], Material=ColourSwatch(SwatchColor=RGB(255, 255, 255)))

# ----
mesh_2 = Mesh(mesh)

# ----
# This is the "old" way of generating body planes, subdividing the agents trails by length corresponding to the approximate agent size.
# 
# I encourage you to use the new way, with body planes deposited during the simulation ("from algorithm" in the agent Body Plane generation - active by default)
body_size = Slider(10, range=0..10)
dam = DataDam(DataA=crv_2, BufferDelay=10000000, BufferMode=0)
cluster = Cluster(trails=dam, body_size=body_size, mesh=mesh_2)

# ---- group: trails preview / as points
gl_shader_2 = GLShader(
    Vertex=explode.Vertices,
    Vcolor=swatch,
    Size=number_slider_14,
    DrawMode=0,
    FragmentShader="""#version 330

in vec4 vertex_color;

void main()
{
  gl_FragColor = vertex_color;
}""",
    GLShader=(0, 1, 0),
    VertexShader="""#version 330

layout(location = 0) in vec3 vertex;
layout(location = 1) in vec4 vcolor;
uniform mat4 _worldToClip;
uniform int size;
out vec4 vertex_color;

void main() 
{
  vertex_color = vcolor;
  gl_Position = _worldToClip * vec4(vertex,1);
  gl_PointSize = size;
}""",
    glLineWidth=3,
    glPointSize=8)  # disabled

# ---- group: Preview size circle
# post-simulation
cir = Circle(Plane=PlaneXY(0, 0, 0), Radius=expr("x*0.5", body_size))

# ---- group: agents preview
vdisex_2 = VectorDisplayEx(Point=pt_3, Vector=vec_4, Colour=ColourSwatch(SwatchColor=RGB(255, 255, 255)), Width=2)

# ---- group: trails preview / as polylines
preview_2 = CustomPreview(Geometry=crv_2, Material=swatch)

# ----
# agent Body Plane generation
# from algorithm: new way, with better density control over the bodies
# 
# from trails: old way (discouraged - but if you feel more confident with it...)
agent_body_planes = ValueList({"from trails": 0, "from algortithm": 1}, selected="from algortithm")
filter = StreamFilter(Gate=agent_body_planes, Stream0=cluster, Stream1=pln)

# ---- group: MAKE A COPY AND INTERNALIZE DATA
# Then use it here >>>
pln_2 = Plane(filter)

# ---- group: Body Planes (from previous simulation)
pln_3 = Plane([Plane(origin=(37.73586182, 10.46860651, 35.35638691), x=(-0.3415004458, 0.3714958279, 0.8633471465), y=(-0.4589058673, -0.8675405143, 0.1917781555)), Plane(origin=(50.51986285, 50.09697956, 55.17863078), x=(-0.8621316197, 0.3231301487, -0.3902767959), y=(0.2903187922, 0.9463091349, 0.1421760182)), Plane(origin=(92.69105546, 76.44302801, 36.8783649), x=(0.9264708677, 0.09653053213, -0.3637768377), y=(-0.2137006637, 0.9305528922, -0.2973269935)), Plane(origin=(40.16310289, 75.46854494, 39.92222809), x=(-0.04804794831, -0.2977117858, 0.9534459016), y=(0.1755302628, -0.9422101997, -0.2853577866)), Plane(origin=(38.14784119, 5.419320662, 62.37999826), x=(0.6761417763, 0.7046033683, -0.215328567), y=(0.7021784235, -0.5277583198, 0.477929511)), Plane(origin=(108.65574, 36.89816985, 51.3700161), x=(0.2651083957, -0.5114960446, 0.8173673194), y=(-0.411279014, -0.8267030565, -0.3839422209))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])

# ---- group: Body Planes (from previous simulation #1)
pln_4 = Plane([Plane(origin=(37.73389807, 10.46476832, 35.35721757), x=(-0.3491272224, 0.3591274875, 0.8655273712), y=(-0.454015995, -0.8728239891, 0.1790188828)), Plane(origin=(50.5199021, 50.09708696, 55.17865058), x=(-0.862376737, 0.3234837341, -0.3894414427), y=(0.2906447918, 0.9461854829, 0.1423328385)), Plane(origin=(92.6892011, 76.45026221, 36.87653993), x=(0.9294289144, 0.1290856134, -0.345685981), y=(-0.2356053723, 0.9285957272, -0.2867055704)), Plane(origin=(40.1615318, 75.47792855, 39.92486559), x=(-0.05852721999, -0.2672048898, 0.9618607547), y=(0.174826413, -0.9513656636, -0.2536515313)), Plane(origin=(38.14928145, 5.418217961, 62.38094687), x=(0.6811367115, 0.7005014044, -0.2129567154), y=(0.6975818306, -0.5325870282, 0.4793022501)), Plane(origin=(108.6596497, 36.90599652, 51.37346583), x=(0.2768693317, -0.4850509653, 0.8294992069), y=(-0.4021530189, -0.8424998322, -0.3584229097))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])

# ---- group: Body Planes (from previous simulation #2)
pln_5 = Plane([Plane(origin=(37.73586182, 10.46860651, 35.35638691), x=(-0.3415004458, 0.3714958279, 0.8633471465), y=(-0.4589058673, -0.8675405143, 0.1917781555)), Plane(origin=(50.52836769, 50.1210208, 55.18292473), x=(-0.8393980136, 0.4032016778, -0.3644713731), y=(0.3627077476, 0.9149667071, 0.1768587422)), Plane(origin=(92.69263557, 76.43520633, 36.88049868), x=(0.9244898094, 0.06376390892, -0.3758360763), y=(-0.1897901294, 0.9320243278, -0.3087237589)), Plane(origin=(40.1646251, 75.45958101, 39.91941092), x=(-0.03137596564, -0.325884052, 0.944888953), y=(0.1760250598, -0.9323802902, -0.3157248371)), Plane(origin=(38.14784119, 5.419320662, 62.37999826), x=(0.6761417763, 0.7046033683, -0.215328567), y=(0.7021784235, -0.5277583198, 0.477929511)), Plane(origin=(108.65574, 36.89816985, 51.3700161), x=(0.2651083957, -0.5114960446, 0.8173673194), y=(-0.411279014, -0.8267030565, -0.3839422209))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])

# ---- group: alignment parameters
number_slider_15 = Slider(10, range=0..20)
number_slider_16 = Slider(0.25, range=0..1)

# ----
# second simulation
# (OPTIONAL)
# post-deposition alignment (OPTIONAL)
# This part performs a plane alignment with neighbour body planes.
# 
# It is entirely optional, when not running it acts like a bypass, outputting the original body planes
reset_2 = Button()
go_2 = BooleanToggle(False)

c_script_3 = CSharpScript(reset=reset_2, go=go_2, P=pln_3, aligRadius=number_slider_15, aligStrength=number_slider_16)  # -> out, POut; inputs reset: Boolean, go: Boolean, P: list of Plane, aligRadius: Double, aligStrength: Double
# ---------- c_script_3: C# ----------
        // return if no planes are supplied
        if (P == null) return;

        // initialize AgentPlaneSystem on reset or at first component execution
        if (reset || AgentPlaneSystem == null )
        {
            AgentPlaneSystem = new AgentSystem(P);
        }

        // Update on go
        if (go)
        {
            AlignRadius = aligRadius;
            AlignStrength = aligStrength;

            AgentPlaneSystem.Update();

            Component.ExpireSolution(true);
        }

        // output geometry
        POut = AgentPlaneSystem.GetPlanes();
# ---------- c_script_3: C# additional code ----------
 

    public static double AlignRadius;
    public static double AlignStrength;
    public AgentSystem AgentPlaneSystem;

    /// <summary>
    /// This class manages a List of AgentPlane
    /// </summary>
    public class AgentSystem
    {
        public List<AgentPlane> AgentPlanes;
        public RTree PlanesRTree;

        public AgentSystem(List<Plane> Planes)
        {
            AgentPlanes = new List<AgentPlane>();
            PlanesRTree = new RTree();

            for (int i=0; i< Planes.Count; i++)
            {
                AgentPlanes.Add(new AgentPlane(Planes[i]));
                PlanesRTree.Insert(Planes[i].Origin, i);
            }
        }

        /// <summary>
        /// Upate locates neighbours via RTree and calls eacch AgentPlane AlignWithNeighbours method
        /// </summary>
        public void Update()
        {
            foreach (AgentPlane ap in AgentPlanes)
            {
                List<AgentPlane> neighbours = new List<AgentPlane>();

                // Eventhandler callback function for Planes RTree search
                EventHandler<RTreeEventArgs> PlanesRTreeCallback = (object sender, RTreeEventArgs args) =>
                {
                    neighbours.Add(AgentPlanes[args.Id]);
                };

                //                   Sphere(                     future position projected on Mesh                 ,   radius      ), callback function
                PlanesRTree.Search(new Sphere(ap.P.Origin, AlignRadius), PlanesRTreeCallback);

                ap.ResetDesired();
                ap.AlignWithNeighbours(neighbours);
            }

            foreach (AgentPlane ap in AgentPlanes) ap.UpdateDirection();
        }

        /// <summary>
        /// This method prepares geometry for output
        /// </summary>
        /// <returns>a List of GH_Plane</returns>
        public List<GH_Plane> GetPlanes()
        {

            List<GH_Plane> planesOut = new List<GH_Plane>();

            foreach (AgentPlane ap in AgentPlanes) planesOut.Add(new GH_Plane(ap.P));

            return planesOut;
        }
    }

    /// <summary>
    /// The AgentPlane class represents agents with a plane to host bodies
    /// </summary>
    /// <remarks>The Plane X axis is the forward vector of the Agent</remarks>
    public class AgentPlane
    {
        public Plane P;
        public Vector3d desiredDir;

        public AgentPlane(Plane P)
        {

            this.P = P;
        }

        public void ResetDesired()
        {
            desiredDir = new Vector3d(P.XAxis);
        }

        /// <summary>
        /// Aligns forward vector with neighbour AgentPlanes
        /// </summary>
        /// <param name="neighbours">a List of AgentPlane</param>
        public void AlignWithNeighbours(List<AgentPlane> neighbours)
        {
            if (neighbours.Count == 0) return;

            Vector3d averageDir = Vector3d.Zero;

            foreach (AgentPlane neighPlane in neighbours)
            {
                averageDir += neighPlane.P.XAxis;
            }

            averageDir /= neighbours.Count;

            desiredDir += averageDir * AlignStrength;
        }

        /// <summary>
        /// This method performs alignment between X axis vectors. 
        /// </summary>
        /// <remarks>Y axis vector is found via cross-product with plane's Z axis</remarks>
        public void UpdateDirection()
        {
            Vector3d newX = P.XAxis * 0.97 + desiredDir * 0.03;
            Vector3d newY = Vector3d.CrossProduct(P.ZAxis, newX);
            P = new Plane(P.Origin, newX, newY);
        }

    }
# ---------- end c_script_3 ----------
ftsv2_2 = FileToScriptV2(File=path)

show_planes = ValueList({"before": 0, "after": 1}, selected="before")
filter_2 = StreamFilter(Gate=show_planes, Stream0=pln_3, Stream1=c_script_3.POut)

# ---- group: Agent Body Curves (grouped)
grp = Group(group)

# ---- group: original mesh
mesh_3 = Mesh(mesh)

# ---- group: Project bodies on Mesh
cluster_2 = Cluster_2(agent_body=grp, body_scale_adjustment=Slider(1, range=0..1), agent_body_planes=filter_2, mesh=mesh_3)

# ----
pline = PolyLine(Vertices=cluster_2, Closed=False)

# ---- group: bake this or internalize data and copy to Dendro definition
# finalization
crv_3 = Curve(pline)

# ----
color_2 = ColourSwatch(SwatchColor=RGB(255, 255, 255))

# ---- group: agent bodies preview
preview_3 = CustomPreview(Geometry=pline, Material=color_2)

# ==== cluster Cluster
mesh = ClusterInput()  # Mesh for projection
trails = ClusterInput()  # Trails Polylines
body_size = ClusterInput()  # Agent body size
divlength = DivideLength(Curve=trails, Length=body_size)  # -> Points, Tangents, Parameters
cull_i = CullIndex(List=divlength.Points, Indices="-1", Wrap=True)
meshcp = MeshClosestPoint(Point=cull_i, Mesh=mesh)  # -> Point, Index, Parameter
meval = MeshEval(Mesh=mesh, Parameter=meshcp.Parameter)  # -> Point, Normal, Colour
vec = Vector(divlength.Tangents)
xprod = CrossProduct(VectorA=vec, VectorB=meval.Normal, Unitize=False)  # -> simplify(Vector), Length
pl = ConstructPlane(Origin=cull_i, XAxis=vec, YAxis=xprod.Vector)  # -> flatten(Plane)
planes = ClusterOutput(pl)  # Output Planes for Agents Bodies

# ==== cluster Cluster_2
agent_body_planes = ClusterInput()  # Agent Body Planes
agent_body = ClusterInput()  # Agent Body polylines as group
body_scale_adjustment = ClusterInput()  # If you need to tweak body scale you can do it here
mesh = ClusterInput()  # Mesh for projection
scale = Scale(Geometry=agent_body, Center=Point(0, 0, 0), Factor=body_scale_adjustment)  # -> Geometry, Transform
orient = Orient(Geometry=scale.Geometry, Source=PlaneXY(0, 0, 0), Target=agent_body_planes)  # -> Geometry, Transform
ungroup = Ungroup(Group=orient.Geometry)
explode = Explode(Curve=ungroup, Recursive=True)  # -> Segments, Vertices
meshcp = MeshClosestPoint(Point=explode.Vertices, Mesh=mesh)  # -> Point, Index, Parameter
agent_body_points = ClusterOutput(meshcp.Point)  # Points for Agent Body Reconstruction
