# Grasshopper definition AgentSystemFlockField.gh (Grasshopper 1.0.7)
# Copyright: Co-de-iT
# plug-ins: FileToScript, Weaverbird

f_ghfilepath = GHFilePathInfo()  # -> F, P
# ---------- f_ghfilepath: C# ----------
                                      /*
    froGH - a sparse collection of (in)utilities for Grasshopper

    GH File and Path info

    code by Alessio Erioli

    froGH by Co-de-iT is licensed under a Creative Commons Attribution 4.0 International License.
    http://creativecommons.org/licenses/by/4.0/

    */

    initComp();

    GH_Document ghDoc = Grasshopper.Instances.ActiveCanvas.Document;

    int nameLen = ghDoc.DisplayName.TrimEnd('*').Length + 3; // +3 accounts for the '.gh' extension
    int fileLen = ghDoc.FilePath.TrimEnd('*').Length;

    F = ghDoc.DisplayName.TrimEnd('*');
    P = ghDoc.FilePath.Substring(0, fileLen - nameLen);
# ---------- f_ghfilepath: C# additional code ----------
  void initComp(){

    Component.Name = "GH File Path Info";
    Component.NickName = "f_GHFilePath";
    Component.Description = "Provides info on current Grasshopper Document file name and path\nUseful for exporting files with the same name as the gh file and in the same directory";
    Component.Params.Output[0].Name = "File Name";
    Component.Params.Output[0].Description = "Current GH file name";
    Component.Params.Output[1].Name = "File Path";
    Component.Params.Output[1].Description = "Current GH file path";
  }
# ---------- end f_ghfilepath ----------
panel = Panel(f_ghfilepath.P)
panel_2 = Panel(f_ghfilepath.F)

# ---- group: file reference
dir_type = ValueList({"desktop": 0, "documents": 1, "GH file path": 2, "C:": 3}, selected="GH file path")
f_pathg = PathGenerator(type=dir_type, subDir="AgentSystemFlockField")  # -> dir; inputs type: Int32, subDir: String
# ---------- f_pathg: C# ----------
                           /*
    froGH - a sparse collection of (in)utilities for Grasshopper

    Path Generator
    code by Alessio Erioli - value list generation based on code by James Ramsden

    froGH by Co-de-iT is licensed under a Creative Commons Attribution 4.0 International License.
    http://creativecommons.org/licenses/by/4.0/

    */
    initComp();


    String S = "";
    String root = "";
    String end = "\\";
    String eol = Environment.NewLine;

    // __________________ autoList part __________________

    // variable for the list
    Grasshopper.Kernel.Special.GH_ValueList vList;
    // tries to cast input as list
    try{

      // if the list is not the first parameter then change Input[0] to the corresponding value
      vList = (Grasshopper.Kernel.Special.GH_ValueList) Component.Params.Input[0].Sources[0];
      // Print("value list connected");
      // check if the list must be created
      //if (vList.NickName != "dir type"){
      if (!vList.NickName.Equals("dir type")){
        vList.ClearData();
        vList.ListItems.Clear();
        vList.NickName = "dir type";
        var item1 = new Grasshopper.Kernel.Special.GH_ValueListItem("desktop", "0");
        var item2 = new Grasshopper.Kernel.Special.GH_ValueListItem("documents", "1");
        var item3 = new Grasshopper.Kernel.Special.GH_ValueListItem("GH file path", "2");
        var item4 = new Grasshopper.Kernel.Special.GH_ValueListItem("C:", "3");
        vList.ListItems.Add(item1);
        vList.ListItems.Add(item2);
        vList.ListItems.Add(item3);
        vList.ListItems.Add(item4);

        vList.ListItems[0].Value.CastTo(out type);
      }
    }
    catch{
      // handles anything that is not a value list
    }


    switch(type){
      case 0:
        root = Environment.GetFolderPath(Environment.SpecialFolder.Desktop) + end;
        S = "Desktop";
        break;
      case 1:
        root = Environment.GetFolderPath(Environment.SpecialFolder.MyDocuments) + end;
        S = "Documents";
        break;
      case 2:
        GH_Document ghDoc = owner.OnPingDocument();

        if (ghDoc.IsFilePathDefined)
        {
          int nameLen = ghDoc.DisplayName.TrimEnd('*').Length + 3; // +3 accounts for the '.gh' extension
          int fileLen = ghDoc.FilePath.TrimEnd('*').Length;

          //F = ghDoc.DisplayName.TrimEnd('*');
          root = ghDoc.FilePath.Substring(0, fileLen - nameLen);
          //root = gh_d.FilePath;
          S = "GH File path";
        }
        else
        {
          Print("No path defined. Saving to Desktop until then");
          root = Environment.GetFolderPath(Environment.SpecialFolder.Desktop);
          S = "Desktop";
        }
        break;
      case 3:
        root = "C:" + end;
        S = root + end;
        break;
    }
    dir = root + (subDir != null ? (subDir + end) : "");
    Component.Message = S;
# ---------- f_pathg: C# additional code ----------
  void initComp(){
    Component.Name = "Path Generator";
    Component.NickName = "f_PathG";
    Component.Description = "generates a path based on local direcories such as Desktop, Documents, GH file path";
    Component.Params.Input[0].Name = "dir type";
    Component.Params.Input[0].Description = "directory type: 0 desktop, 1 documents, 2 GH file path, 3 C:\nconnect a value list for automatic list generation";
    Component.Params.Input[1].Name = "custom subdir";
    Component.Params.Input[1].Description = "(optional) custom subdirectory";
  }
# ---------- end f_pathg ----------
concat = Concatenate(FragmentA=f_pathg, FragmentB="AgentSystemFlockField.cs")
path = FilePath(concat)

# ----
bounding_box_sizee = Slider(30, range=0..100)
n_agents = Slider(1500, range=2..5000)
list = ValueList({"2D": 0, "3D": 1}, selected="2D")
pt = Point(Point(1, 1, 1))
X = XSize(Domain(-1, 1))
neg = Negative(Value=pt)
pt_2 = ConstructPoint(XCoordinate=bounding_box_sizee, YCoordinate=bounding_box_sizee, ZCoordinate=bounding_box_sizee)
pt_3 = Point(Point(0, 0, 0))
# Agent System - Reynolds Flocking
# 
# Implementation of Craig Reynolds' classical flocking system
# 
# © a3 _/TH.esis 2019 _ Creative Commons Attribution-NonCommercial-ShareAlike3.0 UnportedLicense.
rectangle = Rectangle(Plane=PlaneXY(0, 0, 0), XSize=bounding_box_sizee, YSize=bounding_box_sizee, Radius=0)  # -> Rectangle, Length
rectangle_2 = Rectangle(Plane=PlaneXY(0, 0, 0), XSize=X, YSize=X, Radius=0)  # -> Rectangle, Length
box = Box2Pt(PointA=pt_3, PointB=pt_2, Plane=PlaneXY(0, 0, 0))
box_2 = Box2Pt(PointA=neg, PointB=pt, Plane=PlaneXY(0, 0, 0))
gate = StreamGate(Stream=n_agents, Gate=list)  # -> Target0, Target1

# ---- group: positions
pop2d = Populate2D(Region=rectangle.Rectangle, Count=gate.Target0, Seed=1)
pop3d = Populate3D(Region=box, Count=gate.Target1, Seed=1)

# ---- group: vectors
pop2d_2 = Populate2D(Region=rectangle_2.Rectangle, Count=gate.Target0, Seed="3")

# ----
pop3d_2 = Populate3D(Region=box_2, Count=gate.Target1, Seed="3")
unit = UnitVector(Vector=pop2d_2)
unit_2 = UnitVector(Vector=pop3d_2)
number_slider = Slider(42, range=10..200)
filter = StreamFilter(Gate=list, Stream0=pop2d, Stream1=pop3d)
filter_2 = StreamFilter(Gate=list, Stream0=unit, Stream1=unit_2)
edges = BrepEdges(Brep=box)  # -> Naked, Interior, NonManifold
filter_3 = StreamFilter(Gate=list, Stream0=rectangle.Rectangle, Stream1=[edges.Naked, edges.Interior, edges.NonManifold])
division = Division(A="30", B=number_slider)
reset = Button()
go = BooleanToggle(False)
pt_4 = Point(filter)
vec = Vector(filter_2)
nr = Slider(3.5, range=0..5)
ser = Slider(0.564, range=0..1)
number_slider_2 = Slider(0.024, range=0..1)
number_slider_3 = Slider(0.671, range=0..1)
maxang = Slider(4.739, range=0..10)
sqgrid = Square(Plane=PlaneXY(0, 0, 0), Size=division, ExtentX=number_slider, ExtentY=number_slider)  # -> Cells, flatten(Points)
preview = CustomPreview(Geometry=filter_3, Material=ColourSwatch(SwatchColor=RGB(153, 153, 153)))
list_2 = ValueList({"Parallel": 0, "RTree": 1}, selected="RTree")
c_script = CSharpScript(
    P=sqgrid.Points,
    S=number_slider_2,
    t=number_slider_3,
    Reference="C:\Users\Alessio\AppData\Roaming\Grasshopper\Libraries\Noises.dll")  # -> out, Sn; inputs P: Point3d, S: Double, t: Double
# ---------- c_script: C# usings ----------
using Noises;
# ---------- c_script: C# ----------
    P *= S;
    P += new Point3d(0, 0, t);
    Sn = Noise.Generate((float) P.X, (float) P.Y, (float) P.Z);
# ---------- end c_script ----------
pi = Pi(Factor=maxang)
multiplication = Multiplication(A=nr, B=ser)
gradient = Gradient(LowerLimit=0, UpperLimit=1, Parameter=c_script.Sn, stops=[0: RGB(0, 0, 0), 1: RGB(255, 255, 255)])
expression = Expression(x=c_script.Sn, y=pi, Expression="(x-0.5)*2*y")
c_script_2 = CSharpScript(
    reset=reset,
    go=go,
    mode=list_2,
    P=pt_4,
    V=vec,
    nR=nr,
    coS=Slider(2.533, range=0..30),
    alS=Slider(9, range=0..30),
    seS=Slider(2, range=0..30),
    seR=multiplication,
    fieSt=Slider(3.058, range=0..30),
    fieSc=number_slider_2,
    fieT=number_slider_3,
    maxAng=pi,
    Reference="C:\Users\Alessio\AppData\Roaming\Grasshopper\Libraries\Noises.dll")  # -> out, Ap, Av; inputs reset: Boolean, go: Boolean, mode: Int32, P: list of Point3d, V: list of Vector3d, nR: Double, coS: Double, alS: Double, seS: Double, seR: Double, fieSt: Double, fieSc: Double, fieT: Double, maxAng: Double
# ---------- c_script_2: C# usings ----------
using System.Threading;
using System.Threading.Tasks;
using Noises;
# ---------- c_script_2: C# ----------
        GH_Point[] ptsOut;
        GH_Vector[] vecOut;

        if (reset || AgSys == null)
            AgSys = new AgentSystem(P, V);

        if (go)
        {
            AgSys.NeighborhoodRadius = nR;
            AgSys.CohesionStrength = coS;
            AgSys.AlignmentStrength = alS;
            AgSys.SeparationStrength = seS;
            AgSys.SeparationRadius = seR;
            AgSys.FieldStrength = fieSt;
            AgSys.FieldScale = fieSc;
            AgSys.FieldTime = fieT;
            AgSys.MaxAngle = maxAng;
            /*
             if(condition)
             {}
             else
             {}
             */
            if (AgSys.Agents.Count < 600)
                AgSys.Update();
            else
                switch (mode)
                {
                    case 0:
                        AgSys.UpdateParallel();
                        break;

                    case 1:
                        AgSys.UpdateRTree();
                        break;
                }

            Component.ExpireSolution(true);
        }

        AgSys.GetPtsVecs(out ptsOut, out vecOut);
        Ap = ptsOut;
        Av = vecOut;
# ---------- c_script_2: C# additional code ----------
 
    public AgentSystem AgSys;

    public class AgentSystem
    {
        // fields
        public List<Agent> Agents;
        public double NeighborhoodRadius;
        public double CohesionStrength;
        public double AlignmentStrength;
        public double SeparationStrength;
        public double SeparationRadius;
        public double MaxSpeed;
        public double BoundingBoxSize;
        public double ContainmentStrength;
        RTree PointsRTree;
        public double FieldStrength;
        public double FieldTime;
        public double FieldScale;
        public double MaxAngle;

        // constructor
        public AgentSystem(List<Point3d> P, List<Vector3d> V)
        {
            Agents = new List<Agent>();

            for (int i = 0; i < P.Count; i++) // i+=1
            {
                Agent ag = new Agent(P[i], V[i]);
                ag.Flock = this;

                Agents.Add(ag);
            }

            MaxSpeed = 0.3;
            BoundingBoxSize = 30.0;
            ContainmentStrength = 1.0;
        }

        // methods

        public void Update()
        {

            foreach (Agent ag in Agents)
                ComputeAgent(ag);

            // update velocity and position
            foreach (Agent ag in Agents)
                ag.UpdateVelocityAndPosition();
        }

        public void UpdateParallel()
        {
            /*
             <access> <T> <name> (<args>) {}

            (<args>) => {}

            (IEnumerable<T> name, <T> var =>{})
            (List<Agent> Agents, Agent ag =>{})
            (Agents, ag =>{})
             */
            //
            Parallel.ForEach(Agents, ag =>
            {
                ComputeAgent(ag);
            });

            //foreach (Agent ag in Agents)
            //    ComputeAgent(ag);

            // update velocity and position
            Parallel.ForEach(Agents, ag =>
            {
                ag.UpdateVelocityAndPosition();
            });


            //foreach (Agent ag in Agents)
            //    ag.UpdateVelocityAndPosition();
        }

        public void UpdateRTree()
        {
            // build RTree
            PointsRTree = new RTree();
            for (int i = 0; i < Agents.Count; i++)
                PointsRTree.Insert(Agents[i].position, i);

            // find neighbours
            List<Agent> neighbours;

            foreach (Agent ag in Agents)
            {
                neighbours = new List<Agent>();

                // callback function
                EventHandler<RTreeEventArgs> rTreeCallBack = (object sender, RTreeEventArgs args) =>
                {
                    if (Agents[args.Id] != ag)
                        neighbours.Add(Agents[args.Id]);
                };

                PointsRTree.Search(new Sphere(ag.position, NeighborhoodRadius), rTreeCallBack);

                // compute agent
                ag.ComputeDesiredVelocity(neighbours);
            }

            // update agent velocity and position
            Parallel.ForEach(Agents, ag =>
            {
                ag.UpdateVelocityAndPosition();
            });
        }

        public List<Agent> FindNeighbours(Agent ag)
        {
            List<Agent> neighbours = new List<Agent>();

            foreach (Agent neighbour in Agents)
            {
                if (neighbour != ag && neighbour.position.DistanceTo(ag.position) < NeighborhoodRadius)
                    neighbours.Add(neighbour);
            }

            return neighbours;
        }

        public void ComputeAgent(Agent ag)
        {
            List<Agent> neighbours = FindNeighbours(ag);
            ag.ComputeDesiredVelocity(neighbours);
        }

        // public GH_Point[] GetPts() { }

        public void GetPtsVecs(out GH_Point[] pts, out GH_Vector[] vecs)
        {
            pts = new GH_Point[Agents.Count];
            vecs = new GH_Vector[Agents.Count];

            for (int i = 0; i < Agents.Count; i++)
            {
                pts[i] = new GH_Point(Agents[i].position);
                vecs[i] = new GH_Vector(Agents[i].velocity);
            }
        }
    }


    public class Agent
    {
        // fields
        public Point3d position;
        public Vector3d velocity;
        public Vector3d desiredVelocity;
        public AgentSystem Flock;

        // constructor
        public Agent(Point3d position, Vector3d velocity)
        {
            this.position = position;
            this.velocity = velocity;
            desiredVelocity = this.velocity;
            // newVelocity = 0.85 * velocity + 0.15 * desiredVelocity;
        }

        // methods

        public void ComputeDesiredVelocity(List<Agent> neighbours)
        {
            desiredVelocity = Vector3d.Zero;

            // ------------------------------ CONTAINMENT -------------------------------
            Containment();
            // -------------------------------- FLOCKING --------------------------------
            if (neighbours.Count > 0)
            {
                // . . . . . . . . . . . . . COHESION BEHAVIOUR  . . . . . . . . . . . . .

                // find neighbours average
                Point3d average = new Point3d();

                foreach (Agent neighbour in neighbours)
                    average += neighbour.position;

                average /= neighbours.Count;

                // go there
                Vector3d cohesion = average - position;

                // update desired velocity
                desiredVelocity += Flock.CohesionStrength * cohesion;

                // . . . . . . . . . . . . . ALIGNMENT BEHAVIOUR  . . . . . . . . . . . . .
                Vector3d alignment = Vector3d.Zero;

                foreach (Agent neighbour in neighbours)
                    alignment += neighbour.velocity;

                alignment /= neighbours.Count;

                desiredVelocity += Flock.AlignmentStrength * alignment;

                // . . . . . . . . . . . . . SEPARATION BEHAVIOUR  . . . . . . . . . . . . .
                Vector3d separation = Vector3d.Zero;

                foreach (Agent neighbour in neighbours)
                {
                    double distanceToNeighbour = position.DistanceTo(neighbour.position);
                    if (distanceToNeighbour < Flock.SeparationRadius)
                    {
                        Vector3d getAway = position - neighbour.position;
                        separation += getAway /= (getAway.Length * distanceToNeighbour);
                    }
                }

                desiredVelocity += Flock.SeparationStrength * separation;
            }

            // -------------------------------- FIELD --------------------------------
            ComputeField();
        }

        public void ComputeField()
        {

            Point3d p = new Point3d(position);
            p *= Flock.FieldScale;
            p += new Vector3d(0, 0, Flock.FieldTime);
            double Angle = (Noise.Generate((float)p.X, (float)p.Y, (float)p.Z)-0.5)
                * 2.0 * Flock.MaxAngle;
            Vector3d field = Vector3d.XAxis;
            field.Rotate(Angle, Vector3d.ZAxis);

            desiredVelocity += Flock.FieldStrength * field;
        }

        public void Containment()
        {
            if (position.X < 0.0)
                desiredVelocity += new Vector3d(-position.X, 0, 0);
            else if (position.X > Flock.BoundingBoxSize)
                desiredVelocity += new Vector3d(Flock.BoundingBoxSize - position.X, 0, 0);

            if (position.Y < 0.0)
                desiredVelocity += new Vector3d(0, -position.Y, 0);
            else if (position.Y > Flock.BoundingBoxSize)
                desiredVelocity += new Vector3d(0, Flock.BoundingBoxSize - position.Y, 0);

            if (position.Z < 0.0)
                desiredVelocity += new Vector3d(0, 0, -position.Z);
            else if (position.Z > Flock.BoundingBoxSize)
                desiredVelocity += new Vector3d(0, 0, Flock.BoundingBoxSize - position.Z);

            desiredVelocity *= Flock.ContainmentStrength;

        }



        public void UpdateVelocityAndPosition()
        {
            // steering
            velocity = 0.97 * velocity + 0.03 * desiredVelocity;

            // limit velocity to MaxSpeed
            if (velocity.Length > Flock.MaxSpeed)
            {
                velocity.Unitize();
                velocity *= Flock.MaxSpeed;
            }

            position += velocity;
        }
    }
# ---------- end c_script_2 ----------
Z = UnitZ(Factor=1)
ftsv2 = FileToScriptV2(File=path)
X_2 = UnitX(Factor=1)
pt_5 = Point(c_script_2.Ap)
vrot = Rotate(Vector=X_2, Axis=Z, Angle=expression)
preview_2 = CustomPreview(Geometry=sqgrid.Points, Material=gradient)
xy = XYPlane(Origin=c_script_2.Ap)
vdisex = VectorDisplayEx(Point=c_script_2.Ap, Vector=c_script_2.Av, Colour=ColourSwatch(SwatchColor=RGB(255, 223, 82)), Width=2)
multiplication_2 = Multiplication(A=vrot, B=Slider(0.508, range=0..1))
cir = Circle(Plane=c_script_2.Ap, Radius="0.1")  # disabled
align = AlignPlane(Plane=xy, Direction=c_script_2.Av)  # -> Plane, Angle; disabled
vdisex_2 = VectorDisplayEx(Point=sqgrid.Points, Vector=multiplication_2, Colour=gradient, Width=2)
polygon = Polygon(Plane=PlaneXY(0, 0, 0), Radius=Slider(0.13, range=0..1), Segments="3", FilletRadius=0)  # -> Polygon, Length
scale_nu = ScaleNU(Geometry=polygon.Polygon, Plane=PlaneXY(0, 0, 0), ScaleX=Slider(2.22, range=1..3), ScaleY=1, ScaleZ=1)  # -> Geometry, Transform
f_fmesh = FastMesh(P=scale_nu.Geometry)  # -> M; inputs P: list of Polyline
# ---------- f_fmesh: C# ----------
     /*
    froGH - a sparse collection of (in)utilities for Grasshopper

    Fast mesh from closed polyline

    parallelization occurs after 10.000 elements

    base  code by James Ramsden - http://james-ramsden.com/fastmesh-v2-the-stupidly-easy-way-of-creating-efficient-meshes-from-polylines/
    parallel implementation by Alessio Erioli

    froGH by Co-de-iT is licensed under a Creative Commons Attribution 4.0 International License.
    http://creativecommons.org/licenses/by/4.0/

    */

    initComp();


    if (P.Count < 10000){ // change the number if you want to change parallelization threshold
      List<Mesh> m = new List<Mesh>();

      for (int i = 0; i < P.Count(); i++){
        m.Add(Rhino.Geometry.Mesh.CreateFromClosedPolyline(P[i]));
      }

      M = m;

    }else{


      var mp = new System.Collections.Concurrent.ConcurrentDictionary<Polyline, Mesh>(Environment.ProcessorCount, P.Count);
      foreach (Polyline p in P) mp[p] = new Mesh(); //initialise dictionary

      System.Threading.Tasks.Parallel.ForEach(P, p =>
        {
        mp[p] = Rhino.Geometry.Mesh.CreateFromClosedPolyline(p); //save your output here
        }
        );

      M = mp.Values;
    }
# ---------- f_fmesh: C# additional code ----------
  void initComp(){
    Component.Name = "Fast Mesh";
    Component.NickName = "f_FMesh";
    Component.Description = "Creates a fast mesh from a closed polyline";
    Component.Params.Input[0].Name = "Polyline";
    Component.Params.Input[0].Description = "Closed polylines (list works faster)";
    Component.Params.Output[0].Name = "Mesh";
    Component.Params.Output[0].Description = "Fast and cheap Mesh";
  }
# ---------- end f_fmesh ----------
scale = Scale(Geometry=scale_nu.Geometry, Center=Point(0, 0, 0), Factor=0.5)  # -> Geometry, Transform
Z_2 = UnitZ(Factor="0.1")
move = Move(Geometry=scale.Geometry, Motion=Z_2)  # -> Geometry, Transform
merge = Merge(Data1=scale_nu.Geometry, Data2=move.Geometry)
f_fmesh_2 = FastMesh(P=move.Geometry)  # -> M; inputs P: list of Polyline; same code as f_fmesh
f_pmloft = PolylineMeshLoft(P=merge)  # -> M; inputs P: list of Polyline, C: Boolean
# ---------- f_pmloft: C# ----------
                       /*
    froGH - a sparse collection of (in)utilities for Grasshopper

    Mesh loft from Polylines with same number of points

    code by Alessio Erioli

    froGH by Co-de-iT is licensed under a Creative Commons Attribution 4.0 International License.
    http://creativecommons.org/licenses/by/4.0/

    */

    initComp();
    
    if (C && !P[0].IsClosed){
      if (P.Count > 2){
        Mesh m1, m0 = new Mesh();
        int pCount,vCount;
        Point3d[] pts0, pts1;
        pCount = P.Count;
        for (int i = 0; i < P.Count; i++){
          pts0 = P[i % pCount].ToArray();
          pts1 = P[(i + 1) % pCount].ToArray();
          vCount = pts0.Length - 1;
          for (int j = 0; j < vCount; j++){
            m1 = new Mesh();
            m1.Vertices.Add(pts0[j]);
            m1.Vertices.Add(pts0[j + 1]);
            m1.Vertices.Add(pts1[j + 1]);
            m1.Vertices.Add(pts1[j]);
            m1.Faces.AddFace(0, 1, 2, 3);
            m0.Append(m1);
          }
        }
        m0.Weld(Math.PI * 0.5);
        m0.Normals.ComputeNormals();
        M = m0;

      }else{
        Print("you need at least 3 polylines");
        M = null;
      }

    }else{
      if (P.Count > 1){
        Mesh m1, m0 = new Mesh();
        int vCount;
        Point3d[] pts0, pts1;
        for (int i = 0; i < P.Count - 1; i++){
          pts0 = P[i].ToArray();
          pts1 = P[i + 1].ToArray();
          vCount = pts0.Length - 1;
          for (int j = 0; j < vCount; j++){
            m1 = new Mesh();
            m1.Vertices.Add(pts0[j]);
            m1.Vertices.Add(pts0[j + 1]);
            m1.Vertices.Add(pts1[j + 1]);
            m1.Vertices.Add(pts1[j]);
            m1.Faces.AddFace(0, 1, 2, 3);
            m0.Append(m1);
          }
        }
        m0.Weld(Math.PI * 0.5);
        m0.Normals.ComputeNormals();
        M = m0;
      }else{
        Print("you need at least 2 polylines");
        M = null;
      }
    }
    //M = p1.ToArray(); // get points of polyline
# ---------- f_pmloft: C# additional code ----------
  void initComp(){
    Component.Name = "Polyline Mesh Loft";
    Component.NickName = "f_PMLoft";
    Component.Description = "Lofts  polylines with the same number of vertices into a mesh";
    Component.Params.Input[0].Name = "Polylines";
    Component.Params.Input[0].Description = "Lists of polylines to interpolate as mesh loft";
    Component.Params.Input[1].Name = "Closed";
    Component.Params.Input[1].Description = "True for closed loft, False for open loft";
    Component.Params.Output[0].Name = "Mesh";
    Component.Params.Output[0].Description = "Mesh Loft";
  }
# ---------- end f_pmloft ----------
merge_2 = Merge(Data1=f_fmesh, Data2=f_pmloft, Data3=f_fmesh_2)
wbjoin = WeaverbirdsJoinMeshesAndWeld(Mesh=merge_2, Weld=True)
orient = Orient(Geometry=wbjoin, Source=PlaneXY(0, 0, 0), Target=align.Plane)  # -> Geometry, Transform
mjoin = MeshJoin(Meshes=orient.Geometry)
preview_3 = CustomPreview(
    Geometry=mjoin,
    Material={diffuse=RGB(221, 160, 221), emission=RGB(66, 48, 66), shine=0.5, specular=RGB(255, 255, 255), transparency=0})
