# Grasshopper definition DifferentialGrowth_Reeves.gh (Grasshopper 1.0.7)
# plug-ins: FileToScript, Weaverbird

sub_folder = Panel("DifferentialGrowth_Reeves")
file_name_extension = Panel(".cs")
dir_type = ValueList({"desktop": 0, "documents": 1, "GH file path": 2, "C:": 3}, selected="GH file path")
Y = UnitY(Factor=1)
X = UnitX(Factor=1)
number_slider = Slider(3.6, range=0..10)
vrot = Rotate(Vector=X, Axis=Y, Angle=Slider(0.803, range=0..3.142))
f_pathg = PathGenerator(type=dir_type, subDir=sub_folder)  # -> dir; inputs type: Int32, subDir: String
# ---------- f_pathg: C# ----------
                           /*
    froGH - a sparse collection of (in)utilities for Grasshopper

    Path Generator
    code by Alessio Erioli - value list generation based on code by James Ramsden

    froGH by Co-de-iT is licensed under a Creative Commons Attribution 4.0 International License.
    http://creativecommons.org/licenses/by/4.0/

    */
    initComp();


    String S = "";
    String root = "";
    String end = "\\";
    String eol = Environment.NewLine;

    // __________________ autoList part __________________

    // variable for the list
    Grasshopper.Kernel.Special.GH_ValueList vList;
    // tries to cast input as list
    try{

      // if the list is not the first parameter then change Input[0] to the corresponding value
      vList = (Grasshopper.Kernel.Special.GH_ValueList) Component.Params.Input[0].Sources[0];
      // Print("value list connected");
      // check if the list must be created
      //if (vList.NickName != "dir type"){
      if (!vList.NickName.Equals("dir type")){
        vList.ClearData();
        vList.ListItems.Clear();
        vList.NickName = "dir type";
        var item1 = new Grasshopper.Kernel.Special.GH_ValueListItem("desktop", "0");
        var item2 = new Grasshopper.Kernel.Special.GH_ValueListItem("documents", "1");
        var item3 = new Grasshopper.Kernel.Special.GH_ValueListItem("GH file path", "2");
        var item4 = new Grasshopper.Kernel.Special.GH_ValueListItem("C:", "3");
        vList.ListItems.Add(item1);
        vList.ListItems.Add(item2);
        vList.ListItems.Add(item3);
        vList.ListItems.Add(item4);

        vList.ListItems[0].Value.CastTo(out type);
      }
    }
    catch{
      // handles anything that is not a value list
    }


    switch(type){
      case 0:
        root = Environment.GetFolderPath(Environment.SpecialFolder.Desktop) + end;
        S = "Desktop";
        break;
      case 1:
        root = Environment.GetFolderPath(Environment.SpecialFolder.MyDocuments) + end;
        S = "Documents";
        break;
      case 2:
        GH_Document ghDoc = owner.OnPingDocument();

        if (ghDoc.IsFilePathDefined)
        {
          int nameLen = ghDoc.DisplayName.TrimEnd('*').Length + 3; // +3 accounts for the '.gh' extension
          int fileLen = ghDoc.FilePath.TrimEnd('*').Length;

          //F = ghDoc.DisplayName.TrimEnd('*');
          root = ghDoc.FilePath.Substring(0, fileLen - nameLen);
          //root = gh_d.FilePath;
          S = "GH File path";
        }
        else
        {
          Print("No path defined. Saving to Desktop until then");
          root = Environment.GetFolderPath(Environment.SpecialFolder.Desktop);
          S = "Desktop";
        }
        break;
      case 3:
        root = "C:" + end;
        S = root + end;
        break;
    }
    dir = root + (subDir != null ? (subDir + end) : "");
    Component.Message = S;
# ---------- f_pathg: C# additional code ----------
  void initComp(){
    Component.Name = "Path Generator";
    Component.NickName = "f_PathG";
    Component.Description = "generates a path based on local direcories such as Desktop, Documents, GH file path";
    Component.Params.Input[0].Name = "dir type";
    Component.Params.Input[0].Description = "directory type: 0 desktop, 1 documents, 2 GH file path, 3 C:\nconnect a value list for automatic list generation";
    Component.Params.Input[1].Name = "custom subdir";
    Component.Params.Input[1].Description = "(optional) custom subdirectory";
  }
# ---------- end f_pathg ----------
concat = Concatenate(FragmentA=sub_folder, FragmentB=file_name_extension)
amp = Amplitude(Vector=vrot, Amplitude=Slider(1.65, range=0..5))
pl = PlaneNormal(Origin=Point(0, 0, 0), ZAxis=vrot)
concat_2 = Concatenate(FragmentA=f_pathg, FragmentB=concat)
polygon = Polygon(Plane=pl, Radius=number_slider, Segments=Slider(5, range=5..30), FilletRadius=0)  # -> Polygon, Length
path = FilePath(concat_2)
move = Move(Geometry=polygon.Polygon, Motion=amp)  # -> Geometry, Transform
# Differential Growth _ Reeves
# 
# Mesh differential growth - using David Reeves method. Requires Spatial Slur library v 0.13
# 
# © a3 _/TH.esis 2019 _ Creative Commons Attribution-NonCommercial-ShareAlike3.0 UnportedLicense.
msphere = MeshSphere(Base=PlaneXY(0, 0, 0), Radius=number_slider, UCount=10, VCount=20)
tri = Triangulate(Mesh=msphere)  # -> Mesh, Count
f_pmloft = PolylineMeshLoft(P=[polygon.Polygon, move.Geometry])  # -> M; inputs P: list of Polyline, C: Boolean
# ---------- f_pmloft: C# ----------
                       /*
    froGH - a sparse collection of (in)utilities for Grasshopper

    Mesh loft from Polylines with same number of points

    code by Alessio Erioli

    froGH by Co-de-iT is licensed under a Creative Commons Attribution 4.0 International License.
    http://creativecommons.org/licenses/by/4.0/

    */

    initComp();
    
    if (C && !P[0].IsClosed){
      if (P.Count > 2){
        Mesh m1, m0 = new Mesh();
        int pCount,vCount;
        Point3d[] pts0, pts1;
        pCount = P.Count;
        for (int i = 0; i < P.Count; i++){
          pts0 = P[i % pCount].ToArray();
          pts1 = P[(i + 1) % pCount].ToArray();
          vCount = pts0.Length - 1;
          for (int j = 0; j < vCount; j++){
            m1 = new Mesh();
            m1.Vertices.Add(pts0[j]);
            m1.Vertices.Add(pts0[j + 1]);
            m1.Vertices.Add(pts1[j + 1]);
            m1.Vertices.Add(pts1[j]);
            m1.Faces.AddFace(0, 1, 2, 3);
            m0.Append(m1);
          }
        }
        m0.Weld(Math.PI * 0.5);
        m0.Normals.ComputeNormals();
        M = m0;

      }else{
        Print("you need at least 3 polylines");
        M = null;
      }

    }else{
      if (P.Count > 1){
        Mesh m1, m0 = new Mesh();
        int vCount;
        Point3d[] pts0, pts1;
        for (int i = 0; i < P.Count - 1; i++){
          pts0 = P[i].ToArray();
          pts1 = P[i + 1].ToArray();
          vCount = pts0.Length - 1;
          for (int j = 0; j < vCount; j++){
            m1 = new Mesh();
            m1.Vertices.Add(pts0[j]);
            m1.Vertices.Add(pts0[j + 1]);
            m1.Vertices.Add(pts1[j + 1]);
            m1.Vertices.Add(pts1[j]);
            m1.Faces.AddFace(0, 1, 2, 3);
            m0.Append(m1);
          }
        }
        m0.Weld(Math.PI * 0.5);
        m0.Normals.ComputeNormals();
        M = m0;
      }else{
        Print("you need at least 2 polylines");
        M = null;
      }
    }
    //M = p1.ToArray(); // get points of polyline
# ---------- f_pmloft: C# additional code ----------
  void initComp(){
    Component.Name = "Polyline Mesh Loft";
    Component.NickName = "f_PMLoft";
    Component.Description = "Lofts  polylines with the same number of vertices into a mesh";
    Component.Params.Input[0].Name = "Polylines";
    Component.Params.Input[0].Description = "Lists of polylines to interpolate as mesh loft";
    Component.Params.Input[1].Name = "Closed";
    Component.Params.Input[1].Description = "True for closed loft, False for open loft";
    Component.Params.Output[0].Name = "Mesh";
    Component.Params.Output[0].Description = "Mesh Loft";
  }
# ---------- end f_pmloft ----------
tri_2 = Triangulate(Mesh=f_pmloft)  # -> Mesh, Count

boundarysmooth = Slider(0.82, range=0..10)
smooth = Slider(10, range=0..100)
collide = Slider(1, range=0..10)
length = Slider(1, range=0..10)
merge = Merge(Data1=length, Data2=collide, Data3=smooth, Data4=boundarysmooth)

mesh = Mesh(tri_2.Mesh)

# ---- group: ToHeMesh
c_script = CSharpScript(mesh=mesh, Reference="C:\Users\Alessio\AppData\Roaming\Grasshopper\Libraries\SpatialSlur.dll")  # -> out, result; inputs mesh: Mesh
# ---------- c_script: C# ----------
    mesh.Vertices.CombineIdentical(true, true);
    result = RhinoFactory.CreateHeMesh(mesh);
# ---------- end c_script ----------

# ----
reset = Button()
go = BooleanToggle(False)

# ---- group: Differential Growth
# All custom C# components require SpatialSlur.dll to be added from Manage Assemblies
c_script_2 = CSharpScript(
    heMesh=c_script.result,
    edgeLength=Slider(1, range=0..10),
    weights=merge,
    growthRate=Slider(0.005, range=0..1),
    subSteps=Slider(1, range=0..100),
    reset=reset,
    go=go,
    Reference="C:\Users\Alessio\AppData\Roaming\Grasshopper\Libraries\SpatialSlur.dll")  # -> out, result; inputs edgeLength: Double, weights: list of Double, growthRate: Double, subSteps: Int32, reset: Boolean, go: Boolean
# ---------- c_script_2: C# usings ----------
using System.Linq;
using SpatialSlur.SlurCore;
using SpatialSlur.SlurData;
using SpatialSlur.SlurMesh;
# ---------- c_script_2: C# ----------
        // reset
        if (reset)
        {
            _mesh = null;
            return;
        }

        //
        if (_mesh == null)
        {
            InitDynamics((HeMesh)heMesh, edgeLength);
        }

        // update live fields
        _lengthWeight = weights[0];
        _collideWeight = weights[1];
        _smoothWeight = weights[2];
        _boundaryWeight = weights[3];

        _growthRate = growthRate;
        _subSteps = subSteps;

        // physics step
        Step();

        // output
        result = _mesh;

        // debug
        Print(String.Format("{0} steps", _stepCount));
        // Print(String.Format("{0} grid rebuilds", _gridRebuilds));

        // expire if playing
        if (go)
            Component.ExpireSolution(true);
# ---------- c_script_2: C# additional code ----------
 

    /*
    Differential surface growth simulation

    David Reeves
    www.spatialslur.com
    */

    HeMesh _mesh;
    HeVertexList _verts;
    HalfEdgeList _edges;
    IList<HalfEdge> _holes; // first edge of each hole in the mesh

    // vertex attributes
    List<Vec3d> _velocities;
    List<Vec3d> _moveSums;
    List<double> _weightSums;
    List<int> _degrees;

    // edge attributes
    List<double> _restLengths;
    List<int> _spinOrder;

    SpatialGrid3d<int> _grid;
    double _radius = 1.0;
    double _splitLength;
    double _targetScale;

    double _growthRate = 0.01;
    double _lengthWeight = 1.0;
    double _collideWeight = 0.1;
    double _smoothWeight = 10.0;
    double _boundaryWeight = 0.01;
    double _decay = 0.2;
    int _refineFreq = 3;

    Random _random; // used to shuffle spin order
    double _timeStep = 1.0;
    int _subSteps = 10;
    int _stepCount = 0;
    int _gridRebuilds = 0;


    //
    void InitDynamics(HeMesh mesh, double splitLength)
    {
        _mesh = new HeMesh(mesh);

        InitMeshAttributes();
        InitGrid(splitLength);

        _holes = GetHoles();
        _random = new Random(1);
        _stepCount = 0;
        _gridRebuilds = 0;
    }


    //
    void InitMeshAttributes()
    {
        _verts = _mesh.Vertices;
        _edges = _mesh.HalfEdges;

        // vertex attributes
        int nv = _verts.Count;
        _velocities = new List<Vec3d>(new Vec3d[nv]);
        _moveSums = new List<Vec3d>(new Vec3d[nv]);
        _weightSums = new List<double>(new double[nv]);
        _degrees = new List<int>(new int[nv]);

        // edge attributes
        _restLengths = new List<double>(_edges.GetEdgeLengths());
        _spinOrder = new List<int>(Enumerable.Range(0, _edges.Count >> 1));
    }


    /// <summary>
    ///
    /// </summary>
    /// <returns></returns>
    void InitGrid(double splitLength)
    {
        _splitLength = splitLength;
        _radius = _splitLength * 2.0 / 3.0; // * 0.5 - 1.0
        _targetScale = _radius;

        Domain3d d = new Domain3d();
        for (int i = 0; i < _verts.Count; i++)
            d.Include(_verts[i].Position);

        int nx = (int)Math.Ceiling(d.x.Span / _targetScale);
        int ny = (int)Math.Ceiling(d.y.Span / _targetScale);
        int nz = (int)Math.Ceiling(d.z.Span / _targetScale);

        _grid = new SpatialGrid3d<int>(d, nx, ny, nz);
    }


    /// <summary>
    /// Collects the first edge of each hole in the mesh.
    /// </summary>
    /// <returns></returns>
    List<HalfEdge> GetHoles()
    {
        List<HalfEdge> result = new List<HalfEdge>();
        bool[] visited = new bool[_edges.Count >> 1];

        for (int i = 0; i < _edges.Count; i++)
        {
            HalfEdge e = _edges[i];
            if (e.IsUnused || e.Face != null || visited[e.Index >> 1]) continue;

            // add to result
            result.Add(e);

            // flag edges in loop as visited
            foreach (HalfEdge ef in e.CirculateFace)
                visited[ef.Index >> 1] = true;
        }

        return result;
    }


    /// <summary>
    ///
    /// </summary>
    /// <returns></returns>
    void Step()
    {
        for (int i = 0; i < _subSteps; i++)
        {
            CalculateForces();
            UpdateVertices();
            _stepCount++;

            UpdateRestLengths();
            UpdateGrid();

            if (_refineFreq > 0 && _stepCount % _refineFreq == 0)
                RefineMesh();
        }
    }


    /// <summary>
    ///
    /// </summary>
    /// <returns></returns>
    void UpdateRestLengths()
    {
        var chunks = System.Collections.Concurrent.Partitioner.Create(0, _restLengths.Count);
        System.Threading.Tasks.Parallel.ForEach(chunks, range =>
          {
              for (int i = range.Item1; i < range.Item2; i++)
                  _restLengths[i] += _growthRate;
          });
    }


    /// <summary>
    /// Upddates the bounds of the grid.
    /// Also updates the resolution if the bin scale has become too large.
    /// </summary>
    /// <returns></returns>
    void UpdateGrid()
    {
        // get new bounds
        Domain3d d = new Domain3d();
        for (int i = 0; i < _verts.Count; i++)
            d.Include(_verts[i].Position);

        // set bounds of grid
        _grid.Domain = d;
        double dx = _grid.BinScaleX;
        double dy = _grid.BinScaleY;
        double dz = _grid.BinScaleZ;

        // create new grid if bin scale is too large in any dimension
        double t = _targetScale * 2.0;
        if (dx > t || dy > t || dz > t)
        {
            int nx = (int)Math.Ceiling(d.x.Span / _targetScale);
            int ny = (int)Math.Ceiling(d.y.Span / _targetScale);
            int nz = (int)Math.Ceiling(d.z.Span / _targetScale);
            _grid = new SpatialGrid3d<int>(d, nx, ny, nz);
            _gridRebuilds++;
        }
    }


    /// <summary>
    /// Calculates all forces in the system
    /// </summary>
    /// <returns></returns>
    void CalculateForces()
    {
        ConstrainEdgeLengths(_lengthWeight);

        LaplacianSmooth(_smoothWeight);
        BoundarySmooth(_boundaryWeight);

        Collide(_collideWeight);
        CollideCancel(_collideWeight);
        //CollideBrute(_collideWeight);
    }


    /// <summary>
    ///
    /// </summary>
    /// <param name="weight"></param>
    /// <returns></returns>
    void ConstrainEdgeLengths(double weight)
    {
        for (int i = 0; i < _edges.Count; i += 2)
        {
            HalfEdge e = _edges[i];
            if (e.IsUnused) continue;

            Vec3d move = e.Span;
            double d = move.Length;

            if (d > 0.0)
            {
                move *= (d - _restLengths[i >> 1]) / d * weight;

                int vi = e.Start.Index;
                _moveSums[vi] += move;
                _weightSums[vi] += weight;

                vi = e.End.Index;
                _moveSums[vi] -= move;
                _weightSums[vi] += weight;
            }
        }
    }


    /// <summary>
    ///
    /// </summary>
    /// <param name="weight"></param>
    /// <returns></returns>
    void LaplacianSmooth(double weight)
    {
        var chunks = System.Collections.Concurrent.Partitioner.Create(0, _verts.Count);
        System.Threading.Tasks.Parallel.ForEach(chunks, range =>
          {
              for (int i = range.Item1; i < range.Item2; i++)
              {
                  HeVertex v = _verts[i];
                  if (v.IsBoundary) continue; // skip boundary vertices

              // get average position of 1 ring neighbours
              Vec3d sum = new Vec3d();
                  int n = 0;
                  foreach (HeVertex cv in v.ConnectedVertices)
                  {
                      sum += cv.Position;
                      n++;
                  }

              // apply move towards average position
              Vec3d move = (sum / n - v.Position) * weight;
                  _moveSums[i] += move;
                  _weightSums[i] += weight;
              }
          });
    }


    /// <summary>
    ///
    /// </summary>
    /// <param name="weight"></param>
    /// <returns></returns>
    void BoundarySmooth(double weight)
    {
        System.Threading.Tasks.Parallel.For(0, _holes.Count, i =>
          {
              foreach (HalfEdge e in _holes[i].CirculateFace)
              {
                  HeVertex v0 = e.Start;
                  HeVertex v1 = e.End;
                  HeVertex v2 = e.Previous.Start;

                  int i0 = v0.Index;
                  int i1 = v1.Index;
                  int i2 = v2.Index;

              // apply move towards average position
              Vec3d move = ((v1.Position + v2.Position) * 0.5 - v0.Position) * weight;
                  _moveSums[i0] += move;
                  _weightSums[i0] += weight;

              // apply reverse move to neighbours
              move *= -0.5;
                  _moveSums[i1] += move;
                  _weightSums[i1] += weight;
                  _moveSums[i2] += move;
                  _weightSums[i2] += weight;
              }
          });
    }


    /// <summary>
    /// Calculates collision forces between vertices.
    /// </summary>
    /// <param name="weight"></param>
    /// <returns></returns>
    void Collide(double weight)
    {
        double rad2 = _radius * 2.0;
        double rad2sqr = rad2 * rad2;
        Vec3d offset = new Vec3d(rad2, rad2, rad2);

        // insert vertex positions into hash
        for (int i = 0; i < _verts.Count; i++)
            _grid.Insert(_verts[i].Position, i);

        // batch process collisions between particles
        var chunks = System.Collections.Concurrent.Partitioner.Create(0, _verts.Count);
        System.Threading.Tasks.Parallel.ForEach(chunks, range =>
          {
              for (int i = range.Item1; i < range.Item2; i++)
              {
                  HeVertex v = _verts[i];
                  Vec3d p = v.Position;

              // search grid and handle potential collisions
              _grid.Search(new Domain3d(p - offset, p + offset), foundIds =>
                {
                  foreach (int j in foundIds)
                  {
                      if (j == i) continue; // ignore self-collision

                  // This is more expensive than applying the reverse collision force between 1 ring neighbours in a separate method
                  // if(v.FindEdgeTo(_verts[j]) != null) continue; // ignore collisions between 1 ring neighbours

                  Vec3d move = _verts[j].Position - p;
                      double d = move.SquareLength;

                      if (d < rad2sqr && d > 0.0)
                      {
                          d = Math.Sqrt(d);
                          move *= (d - rad2) / d * weight; // *0.5;
                      _moveSums[i] += move;
                          _weightSums[i] += weight;
                      }
                  }
              });
              }
          });

        _grid.Clear();
    }


    /// <summary>
    /// Cancels out collision forces between 1 ring neighbours.
    /// </summary>
    /// <param name="weight"></param>
    /// <returns></returns>
    void CollideCancel(double weight)
    {
        double rad2 = _radius * 2.0;
        double rad2sqr = rad2 * rad2;

        var chunks = System.Collections.Concurrent.Partitioner.Create(0, _verts.Count);
        System.Threading.Tasks.Parallel.ForEach(chunks, range =>
          {
              for (int i = range.Item1; i < range.Item2; i++)
              {
                  HeVertex v = _verts[i];
                  Vec3d p = v.Position;

                  foreach (HeVertex cv in v.ConnectedVertices)
                  {
                      Vec3d move = cv.Position - p;
                      double d = move.SquareLength;

                      if (d < rad2sqr && d > 0.0)
                      {
                          d = Math.Sqrt(d);
                          move *= (d - rad2) / d * weight; // *0.5;
                      _moveSums[i] -= move;
                          _weightSums[i] += weight;
                      }
                  }
              }
          });
    }


    /// <summary>
    ///
    /// </summary>
    /// <param name="weight"></param>
    /// <returns></returns>
    void CollideBrute(double weight)
    {
        double rad2 = _radius * 2.0;
        double rad2sqr = rad2 * rad2;

        for (int i = 0; i < _verts.Count; i++)
        {
            HeVertex v = _verts[i];
            Vec3d p = v.Position;

            for (int j = i + 1; j < _verts.Count; j++)
            {
                if (v.FindHalfEdgeTo(_verts[j]) != null) continue; // ignore collisions between 1 ring neigbours

                Vec3d move = _verts[j].Position - p;
                double d = move.SquareLength;

                if (d < rad2sqr && d > 0.0)
                {
                    d = Math.Sqrt(d);
                    move *= (d - rad2) / d * weight; // *0.5;

                    _moveSums[i] += move;
                    _weightSums[i] += weight;

                    _moveSums[j] -= move;
                    _weightSums[j] += weight;
                }
            }
        }
    }


    /// <summary>
    ///
    /// </summary>
    /// <returns></returns>
    void UpdateVertices()
    {
        var chunks = System.Collections.Concurrent.Partitioner.Create(0, _verts.Count);
        System.Threading.Tasks.Parallel.ForEach(chunks, range =>
          {
              for (int i = range.Item1; i < range.Item2; i++)
              {
                  double w = _weightSums[i];
                  if (w > 0.0)
                      _velocities[i] += _moveSums[i] * (_timeStep / w);

                  _verts[i].Position += _velocities[i];
                  _velocities[i] *= _decay;
                  _moveSums[i] = Vec3d.Zero;
                  _weightSums[i] = 0.0;
              }
          });
    }


    /// <summary>
    /// Refines topology of mesh.
    /// Splits edges which have exceeded a maximum length (i.e. some factor of the collision radius).
    /// Spins edges to equalize vertex valence across the mesh.
    /// </summary>
    /// <returns></returns>
    void RefineMesh()
    {
        SplitEdges();
        EqualizeValence();
    }


    /// <summary>
    ///
    /// </summary>
    /// <returns></returns>
    void SplitEdges()
    {
        int nv = _verts.Count;
        int ne = _edges.Count;
        double max = _splitLength * _splitLength;

        // split edges that exceed the maximum length
        for (int i = 0; i < ne; i += 2)
        {
            HalfEdge e = _edges[i];
            if (e.IsUnused) continue;

            double d = e.Span.SquareLength;
            if (d > max)
            {
                _edges.SplitEdgeFace(e);
                _restLengths[i >> 1] = Math.Sqrt(d) * 0.5; // update the length of the edge that was split
            }
        }

        // add attributes for any new vertices that were created
        for (int i = nv; i < _verts.Count; i++)
        {
            _velocities.Add(Vec3d.Zero);
            _moveSums.Add(Vec3d.Zero);
            _weightSums.Add(0.0);
            _degrees.Add(0);
        }

        // add attributes for any new half-edge pairs that were created
        for (int i = ne; i < _edges.Count; i += 2)
        {
            _restLengths.Add(_edges[i].Length);
            _spinOrder.Add(i >> 1);
        }
    }


    /// <summary>
    /// Attempts to equalize the valence of vertices by spinning interior edges
    /// </summary>
    /// <returns></returns>
    void EqualizeValence()
    {
        _verts.UpdateVertexDegrees(_degrees);
        _spinOrder.Shuffle(_random); // shuffle the spin order to avoid bias

        foreach (int i in _spinOrder)
        {
            HalfEdge e = _edges[i << 1];
            if (e.IsUnused || e.IsBoundary) continue;

            HeVertex v0 = e.Start;
            HeVertex v1 = e.Previous.Start;
            e = e.Twin;
            HeVertex v2 = e.Start;
            HeVertex v3 = e.Previous.Start;

            int i0 = v0.Index;
            int i1 = v1.Index;
            int i2 = v2.Index;
            int i3 = v3.Index;

            // current valence error
            int t0 = _degrees[i0] - ((v0.IsBoundary) ? 4 : 6);
            int t1 = _degrees[i1] - ((v1.IsBoundary) ? 4 : 6);
            int t2 = _degrees[i2] - ((v2.IsBoundary) ? 4 : 6);
            int t3 = _degrees[i3] - ((v3.IsBoundary) ? 4 : 6);
            int error0 = t0 * t0 + t1 * t1 + t2 * t2 + t3 * t3;

            // flipped valence error
            t0--; t1++; t2--; t3++;
            int error1 = t0 * t0 + t1 * t1 + t2 * t2 + t3 * t3;

            // flip edge if it results in less error
            if (error1 < error0)
            {
                _edges.SpinEdge(e);
                _restLengths[i >> 1] = e.Length; // update length of edge

                // update vertex degrees
                _degrees[i0]--;
                _degrees[i1]++;
                _degrees[i2]--;
                _degrees[i3]++;
            }
        }
    }
# ---------- end c_script_2 ----------

# ----
ftsv2 = FileToScriptV2(File=path)

# ---- group: ToRhinoMesh
c_script_3 = CSharpScript(heMesh=c_script_2.result, Reference="C:\Users\Alessio\AppData\Roaming\Grasshopper\Libraries\SpatialSlur.dll")  # -> out, result
# ---------- c_script_3: C# ----------
    HeMesh m = (HeMesh) heMesh;


    result = m.ToRhinoMesh();
# ---------- end c_script_3 ----------

# ----
gate = StreamGate(Stream=c_script_3.result, Gate=go)  # -> Target0, Target1
wbloop = WeaverbirdsLoopSubdivision(MeshCurves=gate.Target0, Level=Slider(0, range=0..2), SmoothNakedEdges=1)
filter = StreamFilter(Gate=go, Stream0=wbloop, Stream1=gate.Target1)
mcol = MeshColours(Mesh=filter, Colours=ColourSwatch(SwatchColor=RGB(255, 255, 255)))
Z = UnitZ(Factor=1)

# ---- group: Normal Shader
c_script_4 = CSharpScript(
    mesh=mcol,
    direction=Z,
    color=ColourSwatch(SwatchColor=RGB(135, 0, 7)),
    intensity=Slider(0.615, range=0..1),
    Reference="C:\Users\Alessio\AppData\Roaming\Grasshopper\Libraries\SpatialSlur.dll")  # -> out, result; inputs mesh: Mesh, direction: Vector3d, color: Color, intensity: Double
# ---------- c_script_4: C# ----------
    if(mesh.Normals.Count != mesh.Vertices.Count)
      mesh.Normals.ComputeNormals();

    if(mesh.VertexColors.Count != mesh.Vertices.Count)
      mesh.VertexColors.CreateMonotoneMesh(Color.White);

    NormalShader(mesh, direction, color, intensity);
    result = mesh;
# ---------- c_script_4: C# additional code ----------
  //
  void NormalShader(Mesh mesh, Vector3d direction, Color color, double intensity)
  {
    if(!direction.Unitize())
      throw new System.ArgumentException("the direction vector cannot be zero length");

    Color[] vc = mesh.VertexColors.ToArray();

    var chunks = System.Collections.Concurrent.Partitioner.Create(0, mesh.Vertices.Count);
    System.Threading.Tasks.Parallel.ForEach(chunks, range =>
      {
      for (int i = range.Item1; i < range.Item2; i++)
      {
        double t = direction * mesh.Normals[i] * 0.5 + 0.5;
        vc[i] = vc[i].LerpTo(color, t * intensity);
      }
      });

    mesh.VertexColors.SetColors(vc);
  }
# ---------- end c_script_4 ----------
