# Grasshopper definition MeshGrowthSystem.gh (Grasshopper 1.0.7)
# plug-ins: MeshEdit Components, FileToScript, Weaverbird

# ---- group: referenced file
dir_type = ValueList({"desktop": 0, "documents": 1, "GH file path": 2, "C:": 3}, selected="GH file path")
f_pathg = PathGenerator(type=dir_type, subDir="MeshGrowthSystem")  # -> dir; inputs type: Int32, subDir: String
# ---------- f_pathg: C# ----------
                           /*
    froGH - a sparse collection of (in)utilities for Grasshopper

    Path Generator
    code by Alessio Erioli - value list generation based on code by James Ramsden

    froGH by Co-de-iT is licensed under a Creative Commons Attribution 4.0 International License.
    http://creativecommons.org/licenses/by/4.0/

    */
    initComp();


    String S = "";
    String root = "";
    String end = "\\";
    String eol = Environment.NewLine;

    // __________________ autoList part __________________

    // variable for the list
    Grasshopper.Kernel.Special.GH_ValueList vList;
    // tries to cast input as list
    try{

      // if the list is not the first parameter then change Input[0] to the corresponding value
      vList = (Grasshopper.Kernel.Special.GH_ValueList) Component.Params.Input[0].Sources[0];
      // Print("value list connected");
      // check if the list must be created
      //if (vList.NickName != "dir type"){
      if (!vList.NickName.Equals("dir type")){
        vList.ClearData();
        vList.ListItems.Clear();
        vList.NickName = "dir type";
        var item1 = new Grasshopper.Kernel.Special.GH_ValueListItem("desktop", "0");
        var item2 = new Grasshopper.Kernel.Special.GH_ValueListItem("documents", "1");
        var item3 = new Grasshopper.Kernel.Special.GH_ValueListItem("GH file path", "2");
        var item4 = new Grasshopper.Kernel.Special.GH_ValueListItem("C:", "3");
        vList.ListItems.Add(item1);
        vList.ListItems.Add(item2);
        vList.ListItems.Add(item3);
        vList.ListItems.Add(item4);

        vList.ListItems[0].Value.CastTo(out type);
      }
    }
    catch{
      // handles anything that is not a value list
    }


    switch(type){
      case 0:
        root = Environment.GetFolderPath(Environment.SpecialFolder.Desktop) + end;
        S = "Desktop";
        break;
      case 1:
        root = Environment.GetFolderPath(Environment.SpecialFolder.MyDocuments) + end;
        S = "Documents";
        break;
      case 2:
        GH_Document ghDoc = owner.OnPingDocument();

        if (ghDoc.IsFilePathDefined)
        {
          int nameLen = ghDoc.DisplayName.TrimEnd('*').Length + 3; // +3 accounts for the '.gh' extension
          int fileLen = ghDoc.FilePath.TrimEnd('*').Length;

          //F = ghDoc.DisplayName.TrimEnd('*');
          root = ghDoc.FilePath.Substring(0, fileLen - nameLen);
          //root = gh_d.FilePath;
          S = "GH File path";
        }
        else
        {
          Print("No path defined. Saving to Desktop until then");
          root = Environment.GetFolderPath(Environment.SpecialFolder.Desktop);
          S = "Desktop";
        }
        break;
      case 3:
        root = "C:" + end;
        S = root + end;
        break;
    }
    dir = root + (subDir != null ? (subDir + end) : "");
    Component.Message = S;
# ---------- f_pathg: C# additional code ----------
  void initComp(){
    Component.Name = "Path Generator";
    Component.NickName = "f_PathG";
    Component.Description = "generates a path based on local direcories such as Desktop, Documents, GH file path";
    Component.Params.Input[0].Name = "dir type";
    Component.Params.Input[0].Description = "directory type: 0 desktop, 1 documents, 2 GH file path, 3 C:\nconnect a value list for automatic list generation";
    Component.Params.Input[1].Name = "custom subdir";
    Component.Params.Input[1].Description = "(optional) custom subdirectory";
  }
# ---------- end f_pathg ----------
concat = Concatenate(FragmentA="MeshGrowthSystem", FragmentB=".cs")
concat_2 = Concatenate(FragmentA=f_pathg, FragmentB=concat)
path = FilePath(concat_2)

# ----
pt = Point(Point(0.9987959832, 1.077951599, 0))
pt_2 = Point(Point(-0.9529820765, -1.251859291, 0))
rec_2pt = Rectangle2Pt(Plane=PlaneXY(0, 0, 0), PointA=pt_2, PointB=pt, Radius=0)  # -> Rectangle, Length
mplane = MeshPlane(Boundary=rec_2pt.Rectangle, WidthCount="3", HeightCount="3")  # -> Mesh, Area
# File template
# 
# © a3 _/TH.esis 2019 _ Creative Commons Attribution-NonCommercial-ShareAlike3.0 UnportedLicense.
tri = Triangulate(Mesh=mplane.Mesh)  # -> Mesh, Count
# plane
c_script = CSharpScript(iMesh=tri.Mesh, iJitter="0.2")  # -> out, oMesh; inputs iMesh: Mesh, iJitter: Double
# ---------- c_script: C# ----------
    Random random = new Random();
    for (int i = 0; i < iMesh.Vertices.Count; i++)
    {
      Point3d v = new Point3d(iMesh.Vertices[i]);
      iMesh.Vertices.SetVertex(
        i,
        v.X + iJitter * (2.0 * random.NextDouble() - 1.0),
        v.Y + iJitter * (2.0 * random.NextDouble() - 1.0),
        v.Z + iJitter * (2.0 * random.NextDouble() - 1.0));
    }
    oMesh = iMesh;
# ---------- end c_script ----------

pt_3 = Point([Point(-8.401289166, -0.5368222646, -0.9912452102), Point(0.4224593273, -0.01398471743, 5.266420808), Point(8.837696802, -1.202102325, 6.000566423), Point(16.55690102, 0.9896826726, -0.9912452102)])
pt_4 = Point([Point(-8.401289166, 0.7892856249, -0.9912452102), Point(0.4224593273, -1.945229382, 6.755748283), Point(8.837696802, -0.9647090014, 3.410310186), Point(16.55690102, -0.1663592578, -0.9912452102)])
entwine = Entwine(Branch00=pt_4, Branch01=pt_3, FlattenInputs=True)
custom_mesh_settings = SettingsCustom(
    StitchSeams=True,
    SimplePlanes=False,
    Refine=True,
    MinCount=16,
    MaxCount=400,
    AspectRatio=20,
    MaxDistance=0,
    MaxAngle=20,
    MinEdge=0,
    MaxEdge="1")
intcrv = Interpolate(Vertices=entwine, Degree=3, Periodic=False, KnotStyle=1)  # -> flatten(Curve), Length, Domain
loft = Loft(Curves=intcrv.Curve, Options={Adjust=False, Closed=False, LoftEnds=0, LoftSimp=0, LoftType=0, Rebuild=10, Refit=0.01})
mesh = MeshBrep(Brep=loft, Settings=custom_mesh_settings)
# arc
tri_2 = Triangulate(Mesh=mesh)  # -> Mesh, Count

msphere = MeshSphere(Base=PlaneXY(0, 0, 0), Radius="2", UCount="3", VCount=6)
tri_3 = Triangulate(Mesh=msphere)  # -> Mesh, Count
# sphere 2
weld = WeldMesh(Mesh=tri_3.Mesh, Angle=3.141592654)

# ----
# sphere
wbicosahedron = WeaverbirdsMeshMeshIcosahedron(Plane=PlaneXY(0, 0, 0), Radius="1.5")

list = ValueList({"plane": 0, "arc": 1, "sphere": 2, "sphere 2": 3}, selected="sphere")
filter = StreamFilter(Gate=list, Stream0=c_script.oMesh, Stream1=tri_2.Mesh, Stream2=wbicosahedron, Stream3=weld)
bending_resistance_weight = Slider(0, range=0..20)
starting_mesh = Mesh(filter)
edgelength_weight = Slider(1, range=0..10)
collision_weight = Slider(4, range=0..10)
collision_distance = Slider(1, range=0..10)
sub_iteration = Slider(1, range=1..10)
max_vertex_count = Panel("5000")
r_tree = BooleanToggle(True)
reset = Button()
grow = BooleanToggle(True)
go = BooleanToggle(False)
c_script_2 = CSharpScript(
    reset=reset,
    go=go,
    grow=grow,
    useRTree=r_tree,
    M=starting_mesh,
    SubIterationCount=sub_iteration,
    MaxVertexCount=max_vertex_count,
    EdgeLengthWeight=edgelength_weight,
    CollisionDistance=collision_distance,
    CollisionWeight=collision_weight,
    BendingReistanceWeight=bending_resistance_weight,
    Reference=["C:\Users\Alessio\AppData\Roaming\Grasshopper\Libraries\Plankton.dll", "C:\Users\Alessio\AppData\Roaming\Grasshopper\Libraries\PlanktonGh.dll"])  # -> out, oMesh; inputs reset: Boolean, go: Boolean, grow: Boolean, useRTree: Boolean, M: Mesh, SubIterationCount: Int32, MaxVertexCount: Int32, MouseLine: Line, Attractor: Point3d, Obstacles: Line, EdgeLengthWeight: Double, CollisionDistance: Double, CollisionWeight: Double, BendingReistanceWeight: Double
# ---------- c_script_2: C# usings ----------
using Plankton;
using PlanktonGh;
# ---------- c_script_2: C# ----------
        // return if no mesh is provided
        if (M == null) return;

        // initialize system on reset button or if the system has never been defined (first run)
        if (reset || myMeshGrowthSystem == null)
            myMeshGrowthSystem = new MeshGrowthSystem(M);

        // pass live parameters to the simulation system
        myMeshGrowthSystem.Grow = grow;
        myMeshGrowthSystem.MaxVertexCount = MaxVertexCount;
        myMeshGrowthSystem.EdgeLenghtConstrainWeight = EdgeLengthWeight;
        myMeshGrowthSystem.CollisionWeight = CollisionWeight;
        myMeshGrowthSystem.BendingResistanceWeight = BendingReistanceWeight;
        myMeshGrowthSystem.UseRTree = useRTree;
        myMeshGrowthSystem.CollisionDistance = CollisionDistance;

        // update simulation
        if (go)
        {
            for (int i = 0; i < SubIterationCount; i++)
                myMeshGrowthSystem.Update();
            Component.ExpireSolution(true);
        }

        // output data
        oMesh = myMeshGrowthSystem.GetRhinoMesh();
# ---------- c_script_2: C# additional code ----------
 

    // global variables
    public MeshGrowthSystem myMeshGrowthSystem;

    /// <summary>
    /// This is the simulation system class
    /// </summary>
    public class MeshGrowthSystem
    {
        private PlanktonMesh ptMesh;

        public bool Grow = false;
        public int MaxVertexCount;

        public bool UseRTree;

        public double EdgeLenghtConstrainWeight;
        public double CollisionDistance;
        public double CollisionWeight;
        public double BendingResistanceWeight;


        private List<Vector3d> totalWeightedMoves;
        private List<double> totalWeights;


        public MeshGrowthSystem(Mesh startingMesh)
        {
            ptMesh = startingMesh.ToPlanktonMesh(); // converts a Meesh into a Plankton Mesh
        }

        public Mesh GetRhinoMesh()
        {
            return ptMesh.ToRhinoMesh(); // converts a Plankton Mesh into a Mesh
        }

        public void Update()
        {
            // splitting logic
            if (Grow) SplitAllLongEdges();

            // moving vertex away
            // initialize Weight vectors and numbers
            totalWeightedMoves = new List<Vector3d>();
            totalWeights = new List<double>();

            for (int i = 0; i < ptMesh.Vertices.Count; i++)
            {
                totalWeightedMoves.Add(new Vector3d(0, 0, 0));
                totalWeights.Add(0.0);
            }

            if (UseRTree) ProcessCollisionsUsingRTree();
            else ProcessCollisions();
            ProcessBendingReistance();
            ProcessEdgeLengthConstraint();

            UpdateVertexPositions();

        }

        private void ProcessEdgeLengthConstraint()
        {
            for (int k = 0; k < ptMesh.Halfedges.Count; k += 2)
            {
                int i = ptMesh.Halfedges[k].StartVertex;
                int j = ptMesh.Halfedges[k + 1].StartVertex;

                Point3d vI = ptMesh.Vertices[i].ToPoint3d();
                Point3d vJ = ptMesh.Vertices[j].ToPoint3d();

                if (vI.DistanceTo(vJ) < CollisionDistance) continue;

                Vector3d move = vJ - vI;
                move *= (move.Length - CollisionDistance) * 0.5 / move.Length;

                totalWeightedMoves[i] += move * EdgeLenghtConstrainWeight;
                totalWeightedMoves[j] -= move * EdgeLenghtConstrainWeight;
                totalWeights[i] += EdgeLenghtConstrainWeight;
                totalWeights[j] += EdgeLenghtConstrainWeight;
            }
        }

        private void ProcessBendingReistance()
        {
            int halfEdgeCount = ptMesh.Halfedges.Count;

            for (int k = 0; k < halfEdgeCount; k += 2)
            {
                // see day03 slides, pag. 25 for a graphic explanation

                // finding adjacent faces vertices
                int i = ptMesh.Halfedges[k].StartVertex;
                int j = ptMesh.Halfedges[k + 1].StartVertex;
                int p = ptMesh.Halfedges[ptMesh.Halfedges[k].PrevHalfedge].StartVertex;
                int q = ptMesh.Halfedges[ptMesh.Halfedges[k + 1].PrevHalfedge].StartVertex;

                Point3d vI = ptMesh.Vertices[i].ToPoint3d();
                Point3d vJ = ptMesh.Vertices[j].ToPoint3d();
                Point3d vP = ptMesh.Vertices[p].ToPoint3d();
                Point3d vQ = ptMesh.Vertices[q].ToPoint3d();

                // normals of adjacent faces
                Vector3d nP = Vector3d.CrossProduct(vJ - vI, vP - vI);
                // Vector3d nQ = Vector3d.CrossProduct(vJ - vI, vQ - vI); // this was wrong, as the normal was flipped
                Vector3d nQ = Vector3d.CrossProduct(vQ - vI, vJ - vI);

                // building target plane
                Vector3d planeNormal = nP + nQ;
                Point3d planeOrigin = 0.25 * (vI + vJ + vP + vQ);
                Plane plane = new Plane(planeOrigin, planeNormal);

                // compute move vectors
                totalWeightedMoves[i] += BendingResistanceWeight * (plane.ClosestPoint(vI) - vI);
                totalWeightedMoves[j] += BendingResistanceWeight * (plane.ClosestPoint(vJ) - vJ);
                totalWeightedMoves[p] += BendingResistanceWeight * (plane.ClosestPoint(vP) - vP);
                totalWeightedMoves[q] += BendingResistanceWeight * (plane.ClosestPoint(vQ) - vQ);
                totalWeights[i] += BendingResistanceWeight;
                totalWeights[j] += BendingResistanceWeight;
                totalWeights[p] += BendingResistanceWeight;
                totalWeights[q] += BendingResistanceWeight;


            }
        }

        private void SplitAllLongEdges()
        {
            int halfEdgeCount = ptMesh.Halfedges.Count;

            for (int k = 0; k < halfEdgeCount; k += 2)
            {
                if (ptMesh.Vertices.Count < MaxVertexCount &&
                    ptMesh.Halfedges.GetLength(k) > 0.99 * CollisionDistance)
                {
                    SplitEdge(k);
                }

            }
        }

        private void ProcessCollisions()
        {
            int VertexCount = ptMesh.Vertices.Count;

            for (int i = 0; i < VertexCount - 1; i++)
                for (int j = i + 1; j < VertexCount; j++)
                {
                    // move is [j] - [i] cause the vector tip is always in the first term of subtraction
                    Vector3d move = ptMesh.Vertices[j].ToPoint3d() - ptMesh.Vertices[i].ToPoint3d();
                    double currentDistance = move.Length;
                    // if farther than collision distance, do nothing and go to the next loop iteration
                    if (currentDistance > CollisionDistance) continue;

                    // otherwise, repulsion logic applies as follows
                    move *= 0.5 * (currentDistance - CollisionDistance) / currentDistance;
                    totalWeightedMoves[i] += CollisionWeight * move;
                    totalWeightedMoves[j] -= CollisionWeight * move;
                    totalWeights[i] += CollisionWeight;
                    totalWeights[j] += CollisionWeight;
                }
        }

        private void ProcessCollisionsUsingRTree()
        {
            RTree rTree = new RTree();

            for (int i = 0; i < ptMesh.Vertices.Count; i++)
            {
                rTree.Insert(ptMesh.Vertices[i].ToPoint3d(), i);
            }

            for (int i = 0; i < ptMesh.Vertices.Count; i++)
            {
                Point3d vI = ptMesh.Vertices[i].ToPoint3d();
                Sphere searchSphere = new Sphere(vI, CollisionDistance);

                List<int> collisionIndices = new List<int>();

                // EventHandler<RTreeEventArgs> rTreeCallback (object sender, EventArgs args) => { };

                rTree.Search(searchSphere,
                   (sender, args) => { if (i < args.Id) collisionIndices.Add(args.Id); }); // rTreeCallback integrated in search statement
                                                                                           //                           | since in collisions we process both vertices involved I need to consider
                                                                                           //                             only a half of the corresponding matrix (otherwise I process each vertex twice)
                                                                                           //                             I consider only those vertices that haven't been processed yet (index > i)
                                                                                           //                             (this is also called "football team matching" logic)

                foreach (int j in collisionIndices)
                {
                    // move is [j] - [i] cause the vector tip is always in the first term of subtraction
                    Vector3d move = ptMesh.Vertices[j].ToPoint3d() - ptMesh.Vertices[i].ToPoint3d();
                    double currentDistance = move.Length;
                    // no need to check CollisionDistance here (it's taken care of by RTree)
                    // otherwise, repulsion logic applies as follows
                    move *= 0.5 * (currentDistance - CollisionDistance) / currentDistance;
                    totalWeightedMoves[i] += CollisionWeight * move;
                    totalWeightedMoves[j] -= CollisionWeight * move;
                    totalWeights[i] += CollisionWeight;
                    totalWeights[j] += CollisionWeight;
                }
            }
        }

        private void UpdateVertexPositions()
        {
            for (int i = 0; i < ptMesh.Vertices.Count; i++)
            {
                if (totalWeights[i] == 0.0) continue; // avoid division by 0

                Vector3d move = totalWeightedMoves[i] / totalWeights[i];
                Point3d newPosition = ptMesh.Vertices[i].ToPoint3d() + move;
                ptMesh.Vertices.SetVertex(i, newPosition.X, newPosition.Y, newPosition.Z);
            }
        }


        // method pasted from Long's codestarter
        private void SplitEdge(int edgeIndex)
        {
            int newHalfEdgeIndex = ptMesh.Halfedges.SplitEdge(edgeIndex);

            ptMesh.Vertices.SetVertex(
                ptMesh.Vertices.Count - 1,
                0.5 * (ptMesh.Vertices[ptMesh.Halfedges[edgeIndex].StartVertex].ToPoint3d() + ptMesh.Vertices[ptMesh.Halfedges[edgeIndex + 1].StartVertex].ToPoint3d()));

            if (ptMesh.Halfedges[edgeIndex].AdjacentFace >= 0)
                ptMesh.Faces.SplitFace(newHalfEdgeIndex, ptMesh.Halfedges[edgeIndex].PrevHalfedge);

            if (ptMesh.Halfedges[edgeIndex + 1].AdjacentFace >= 0)
                ptMesh.Faces.SplitFace(edgeIndex + 1, ptMesh.Halfedges[ptMesh.Halfedges[edgeIndex + 1].NextHalfedge].NextHalfedge);
        }


    }
# ---------- end c_script_2 ----------
ftsv2 = FileToScriptV2(File=path)
panel = Panel(c_script_2.out)
mesh_2 = Mesh(c_script_2.oMesh)
level = Slider(1, range=0..3)
wbloop = WeaverbirdsLoopSubdivision(MeshCurves=mesh_2, Level=level, SmoothNakedEdges=1)
flip = MeshFlip(Mesh=wbloop)  # disabled
swatch = ColourSwatch(SwatchColor=RGB(230, 230, 230))  # disabled
swatch_2 = ColourSwatch(SwatchColor=RGB(178, 71, 71))  # disabled
medges = MeshEdges(Mesh=wbloop)  # -> NakedEdges, InteriorEdges, NonManifoldEdges; disabled
preview = CustomPreview(Geometry=wbloop, Material=ColourSwatch(SwatchColor=RGB(255, 255, 255)))
preview_2 = CustomPreview(Geometry=[wbloop, flip], Material=[swatch, swatch_2])  # disabled
