# Grasshopper definition MeshGrowthSystem_starter.gh (Grasshopper 1.0.7)
# plug-ins: MeshEdit Components, FileToScript, Weaverbird

# ---- group: referenced file
dir_type = ValueList({"desktop": 0, "documents": 1, "GH file path": 2, "C:": 3}, selected="GH file path")
f_pathg = PathGenerator(type=dir_type, subDir="MeshGrowthSystem")  # -> dir; inputs type: Int32, subDir: String
# ---------- f_pathg: C# ----------
                           /*
    froGH - a sparse collection of (in)utilities for Grasshopper

    Path Generator
    code by Alessio Erioli - value list generation based on code by James Ramsden

    froGH by Co-de-iT is licensed under a Creative Commons Attribution 4.0 International License.
    http://creativecommons.org/licenses/by/4.0/

    */
    initComp();


    String S = "";
    String root = "";
    String end = "\\";
    String eol = Environment.NewLine;

    // __________________ autoList part __________________

    // variable for the list
    Grasshopper.Kernel.Special.GH_ValueList vList;
    // tries to cast input as list
    try{

      // if the list is not the first parameter then change Input[0] to the corresponding value
      vList = (Grasshopper.Kernel.Special.GH_ValueList) Component.Params.Input[0].Sources[0];
      // Print("value list connected");
      // check if the list must be created
      //if (vList.NickName != "dir type"){
      if (!vList.NickName.Equals("dir type")){
        vList.ClearData();
        vList.ListItems.Clear();
        vList.NickName = "dir type";
        var item1 = new Grasshopper.Kernel.Special.GH_ValueListItem("desktop", "0");
        var item2 = new Grasshopper.Kernel.Special.GH_ValueListItem("documents", "1");
        var item3 = new Grasshopper.Kernel.Special.GH_ValueListItem("GH file path", "2");
        var item4 = new Grasshopper.Kernel.Special.GH_ValueListItem("C:", "3");
        vList.ListItems.Add(item1);
        vList.ListItems.Add(item2);
        vList.ListItems.Add(item3);
        vList.ListItems.Add(item4);

        vList.ListItems[0].Value.CastTo(out type);
      }
    }
    catch{
      // handles anything that is not a value list
    }


    switch(type){
      case 0:
        root = Environment.GetFolderPath(Environment.SpecialFolder.Desktop) + end;
        S = "Desktop";
        break;
      case 1:
        root = Environment.GetFolderPath(Environment.SpecialFolder.MyDocuments) + end;
        S = "Documents";
        break;
      case 2:
        GH_Document ghDoc = owner.OnPingDocument();

        if (ghDoc.IsFilePathDefined)
        {
          int nameLen = ghDoc.DisplayName.TrimEnd('*').Length + 3; // +3 accounts for the '.gh' extension
          int fileLen = ghDoc.FilePath.TrimEnd('*').Length;

          //F = ghDoc.DisplayName.TrimEnd('*');
          root = ghDoc.FilePath.Substring(0, fileLen - nameLen);
          //root = gh_d.FilePath;
          S = "GH File path";
        }
        else
        {
          Print("No path defined. Saving to Desktop until then");
          root = Environment.GetFolderPath(Environment.SpecialFolder.Desktop);
          S = "Desktop";
        }
        break;
      case 3:
        root = "C:" + end;
        S = root + end;
        break;
    }
    dir = root + (subDir != null ? (subDir + end) : "");
    Component.Message = S;
# ---------- f_pathg: C# additional code ----------
  void initComp(){
    Component.Name = "Path Generator";
    Component.NickName = "f_PathG";
    Component.Description = "generates a path based on local direcories such as Desktop, Documents, GH file path";
    Component.Params.Input[0].Name = "dir type";
    Component.Params.Input[0].Description = "directory type: 0 desktop, 1 documents, 2 GH file path, 3 C:\nconnect a value list for automatic list generation";
    Component.Params.Input[1].Name = "custom subdir";
    Component.Params.Input[1].Description = "(optional) custom subdirectory";
  }
# ---------- end f_pathg ----------
concat = Concatenate(FragmentA="MeshGrowthSystem", FragmentB=".cs")
concat_2 = Concatenate(FragmentA=f_pathg, FragmentB=concat)
path = FilePath(concat_2)

# ----
pt = Point(Point(0.9987959832, 1.077951599, 0))
pt_2 = Point(Point(-0.9529820765, -1.251859291, 0))
rec_2pt = Rectangle2Pt(Plane=PlaneXY(0, 0, 0), PointA=pt_2, PointB=pt, Radius=0)  # -> Rectangle, Length
mplane = MeshPlane(Boundary=rec_2pt.Rectangle, WidthCount="3", HeightCount="3")  # -> Mesh, Area
# File template
# 
# © a3 _/TH.esis 2019 _ Creative Commons Attribution-NonCommercial-ShareAlike3.0 UnportedLicense.
tri = Triangulate(Mesh=mplane.Mesh)  # -> Mesh, Count
# plane
c_script = CSharpScript(iMesh=tri.Mesh, iJitter="0.2")  # -> out, oMesh; inputs iMesh: Mesh, iJitter: Double
# ---------- c_script: C# ----------
    Random random = new Random();
    for (int i = 0; i < iMesh.Vertices.Count; i++)
    {
      Point3d v = new Point3d(iMesh.Vertices[i]);
      iMesh.Vertices.SetVertex(
        i,
        v.X + iJitter * (2.0 * random.NextDouble() - 1.0),
        v.Y + iJitter * (2.0 * random.NextDouble() - 1.0),
        v.Z + iJitter * (2.0 * random.NextDouble() - 1.0));
    }
    oMesh = iMesh;
# ---------- end c_script ----------

pt_3 = Point([Point(-8.401289166, -0.5368222646, -0.9912452102), Point(0.4224593273, -0.01398471743, 5.266420808), Point(8.837696802, -1.202102325, 6.000566423), Point(16.55690102, 0.9896826726, -0.9912452102)])
pt_4 = Point([Point(-8.401289166, 0.7892856249, -0.9912452102), Point(0.4224593273, -1.945229382, 6.755748283), Point(8.837696802, -0.9647090014, 3.410310186), Point(16.55690102, -0.1663592578, -0.9912452102)])
entwine = Entwine(Branch00=pt_4, Branch01=pt_3, FlattenInputs=True)
custom_mesh_settings = SettingsCustom(
    StitchSeams=True,
    SimplePlanes=False,
    Refine=True,
    MinCount=16,
    MaxCount=400,
    AspectRatio=20,
    MaxDistance=0,
    MaxAngle=20,
    MinEdge=0,
    MaxEdge="1")
intcrv = Interpolate(Vertices=entwine, Degree=3, Periodic=False, KnotStyle=1)  # -> flatten(Curve), Length, Domain
loft = Loft(Curves=intcrv.Curve, Options={Adjust=False, Closed=False, LoftEnds=0, LoftSimp=0, LoftType=0, Rebuild=10, Refit=0.01})
mesh = MeshBrep(Brep=loft, Settings=custom_mesh_settings)
# arc
tri_2 = Triangulate(Mesh=mesh)  # -> Mesh, Count

msphere = MeshSphere(Base=PlaneXY(0, 0, 0), Radius="2", UCount="3", VCount=6)
tri_3 = Triangulate(Mesh=msphere)  # -> Mesh, Count
# sphere 2
weld = WeldMesh(Mesh=tri_3.Mesh, Angle=3.141592654)

# ----
# sphere
wbicosahedron = WeaverbirdsMeshMeshIcosahedron(Plane=PlaneXY(0, 0, 0), Radius="1.5")

list = ValueList({"plane": 0, "arc": 1, "sphere": 2, "sphere 2": 3}, selected="plane")
filter = StreamFilter(Gate=list, Stream0=c_script.oMesh, Stream1=tri_2.Mesh, Stream2=wbicosahedron, Stream3=weld)
bending_resistance_weight = Slider(0, range=0..20)
starting_mesh = Mesh(filter)
edgelength_weight = Slider(1, range=0..10)
collision_weight = Slider(4, range=0..10)
collision_distance = Slider(1, range=0..10)
sub_iteration = Slider(1, range=0..30)
max_vertex_count = Panel("5000")
r_tree = BooleanToggle(True)
reset = Button()
grow = BooleanToggle(True)
go = BooleanToggle(False)
c_script_2 = CSharpScript(
    reset=reset,
    go=go,
    grow=grow,
    useRTree=r_tree,
    M=starting_mesh,
    SubIterationCount=sub_iteration,
    MaxVertexCount=max_vertex_count,
    EdgeLengthWeight=edgelength_weight,
    CollisionDistance=collision_distance,
    CollisionWeight=collision_weight,
    BendingReistanceWeight=bending_resistance_weight)  # -> out, oMesh; inputs reset: Boolean, go: Boolean, grow: Boolean, useRTree: Boolean, M: Mesh, SubIterationCount: Int32, MaxVertexCount: Int32, MouseLine: Line, Attractor: Point3d, Obstacles: Line, EdgeLengthWeight: Double, CollisionDistance: Double, CollisionWeight: Double, BendingReistanceWeight: Double
# ---------- c_script_2: C# ----------
        // token code
        // been in VS!
# ---------- end c_script_2 ----------
# drag up to sync code
ftsv2 = FileToScriptV2(File=path)
panel = Panel(c_script_2.out)
mesh_2 = Mesh(c_script_2.oMesh)
level = Slider(2, range=0..4)
wbloop = WeaverbirdsLoopSubdivision(MeshCurves=mesh_2, Level=level, SmoothNakedEdges=1)
flip = MeshFlip(Mesh=wbloop)
preview = CustomPreview(
    Geometry=[wbloop, flip],
    Material=[ColourSwatch(SwatchColor=RGB(230, 230, 230)), ColourSwatch(SwatchColor=RGB(178, 71, 71))])
