# Grasshopper definition Preview_MeshGrowthSystem.gh (Grasshopper 1.0.7)
# plug-ins: MeshEdit Components, Weaverbird

pt = Point([Point(-8.401289166, -0.5368222646, -0.9912452102), Point(0.4224593273, -0.01398471743, 5.266420808), Point(8.837696802, -1.202102325, 6.000566423), Point(16.55690102, 0.9896826726, -0.9912452102)])
pt_2 = Point([Point(-8.401289166, 0.7892856249, -0.9912452102), Point(0.4224593273, -1.945229382, 6.755748283), Point(8.837696802, -0.9647090014, 3.410310186), Point(16.55690102, -0.1663592578, -0.9912452102)])
entwine = Entwine(Branch00=pt_2, Branch01=pt, FlattenInputs=True)
pt_3 = Point(Point(-0.9529820765, -1.251859291, 0))
pt_4 = Point(Point(0.9987959832, 1.077951599, 0))
intcrv = Interpolate(Vertices=entwine, Degree=3, Periodic=False, KnotStyle=1)  # -> flatten(Curve), Length, Domain
rec_2pt = Rectangle2Pt(Plane=PlaneXY(0, 0, 0), PointA=pt_3, PointB=pt_4, Radius=0)  # -> Rectangle, Length
custom_mesh_settings = SettingsCustom(
    StitchSeams=True,
    SimplePlanes=False,
    Refine=True,
    MinCount=16,
    MaxCount=400,
    AspectRatio=20,
    MaxDistance=0,
    MaxAngle=20,
    MinEdge=0,
    MaxEdge="1")
loft = Loft(Curves=intcrv.Curve, Options={Adjust=False, Closed=False, LoftEnds=0, LoftSimp=0, LoftType=0, Rebuild=10, Refit=0.01})
mplane = MeshPlane(Boundary=rec_2pt.Rectangle, WidthCount="3", HeightCount="3")  # -> Mesh, Area
mesh = MeshBrep(Brep=loft, Settings=custom_mesh_settings)
tri = Triangulate(Mesh=mplane.Mesh)  # -> Mesh, Count
tri_2 = Triangulate(Mesh=mesh)  # -> Mesh, Count
msphere = MeshSphere(Base=PlaneXY(0, 0, 0), Radius="2", UCount="3", VCount=6)
wbicosahedron = WeaverbirdsMeshMeshIcosahedron(Plane=PlaneXY(0, 0, 0), Radius="1.5")
c_script = CSharpScript(iMesh=tri.Mesh, iJitter="0.2")  # -> out, oMesh; inputs iMesh: Mesh, iJitter: Double
# ---------- c_script: C# ----------
    Random random = new Random();
    for (int i = 0; i < iMesh.Vertices.Count; i++)
    {
      Point3d v = new Point3d(iMesh.Vertices[i]);
      iMesh.Vertices.SetVertex(
        i,
        v.X + iJitter * (2.0 * random.NextDouble() - 1.0),
        v.Y + iJitter * (2.0 * random.NextDouble() - 1.0),
        v.Z + iJitter * (2.0 * random.NextDouble() - 1.0));
    }
    oMesh = iMesh;
# ---------- end c_script ----------
tri_3 = Triangulate(Mesh=msphere)  # -> Mesh, Count
bending_resistance_weight = Slider(0, range=0..20)
edgelength_weight = Slider(1, range=0..10)
collision_distance = Slider(1, range=0..10)
collision_weight = Slider(4, range=0..10)
sub_iteration = Slider(1, range=0..30)
weld = WeldMesh(Mesh=tri_3.Mesh, Angle=3.141592654)
max_vertex_count = Panel("5000")
r_tree = BooleanToggle(True)
timer = Timer(TimerInterval=1, Target=c_script_2)  # disabled
reset = Button()
grow = BooleanToggle(True)
starting_mesh = Mesh(c_script.oMesh)
c_script_2 = CSharpScript(
    iStartingMesh=starting_mesh,
    iReset=reset,
    iSubiterationCount=sub_iteration,
    iGrow=grow,
    iMaxVertexCount=max_vertex_count,
    iEdgeLengthWeight=edgelength_weight,
    iCollisionDistance=collision_distance,
    iCollisionWeight=collision_weight,
    iBendingResistanceWeight=bending_resistance_weight,
    iUseRTree=r_tree,
    Reference=["F:\USERS\ALESSIO\DOCUMENTS\CO-DE-IT\@ CODE\GH CODE\@ C# WS ICD\2018\FINAL HANDOUTS\DAY 2\Plankton\Rhino5\Plankton.dll", "F:\USERS\ALESSIO\DOCUMENTS\CO-DE-IT\@ CODE\GH CODE\@ C# WS ICD\2018\FINAL HANDOUTS\DAY 2\Plankton\Rhino5\PlanktonGh.dll"])  # -> out, oMesh; inputs iStartingMesh: Mesh, iReset: Boolean, iSubiterationCount: Int32, iGrow: Boolean, iMaxVertexCount: Int32, iMouseLine: Line, iAttractor: Point3d, iObstacles: Line, iEdgeLengthWeight: Double, iCollisionDistance: Double, iCollisionWeight: Double, iBendingResistanceWeight: Double, iUseRTree: Boolean
# ---------- c_script_2: C# usings ----------
using System.Drawing;
using Plankton;
using PlanktonGh;
# ---------- c_script_2: C# ----------
    if (iReset || system == null)
    {
      material = new Rhino.Display.DisplayMaterial();
      material.Diffuse = Color.FromArgb(200, 200, 200);
      material.BackDiffuse = Color.FromArgb(100, 180, 200);
      material.IsTwoSided = true;
      frameCount = 0;
      system = new MeshGrowthSystem(iStartingMesh);
      goto Conclusion;
    }

    system.Grow = iGrow;
    system.MaxVertexCount = iMaxVertexCount;
    system.Attractor = iAttractor;
    system.UseRTree = iUseRTree;
    system.EdgeLengthWeight = iEdgeLengthWeight;
    system.CollisionDistance = iCollisionDistance;
    system.CollisionWeight = iCollisionWeight;
    system.BendingResistanceWeight = iBendingResistanceWeight;

    int subCount = system.CurrentIteration == 0
      ? 1
      : (int) (Math.Ceiling(Math.Pow(frameCount / 1000.0, 0.8) * iSubiterationCount));
    subCount = 1;

    for (int i = 0; i < subCount; i++)
      system.Update();

    Print("SubIter: " + subCount);
    Conclusion:

      rhinoMesh = system.Mesh.ToRhinoMesh();
    oMesh = rhinoMesh;

    //SetCamera();

    Print("Iterations: " + system.CurrentIteration);
    Print("Vertices: " + rhinoMesh.Vertices.Count + ", Faces: " + rhinoMesh.Faces.Count);
    Print("Frame: " + frameCount);
# ---------- c_script_2: C# additional code ----------
  private MeshGrowthSystem system;
  private Mesh rhinoMesh;

  private Rhino.Display.DisplayMaterial material;

  private int frameCount = 0;

  private void SetCamera()
  {
    BoundingBox bb = rhinoMesh.GetBoundingBox(false);

    double degreePerSecond = 10.0;
    double pitch = 30.0 * (Math.PI / 180.0);

    Rhino.Display.RhinoViewport viewport = RhinoDocument.Views.ActiveView.ActiveViewport;
    viewport.SetConstructionPlane(new Plane(new Point3d(bb.Center.X, bb.Center.Y, bb.Min.Z), Vector3d.ZAxis));
    double alpha = (-90.0 + degreePerSecond * frameCount / 25.0) * (Math.PI / 180.0);
    double distance = 3.0 * bb.Center.DistanceTo(bb.Max);
    if (distance < 12) distance = 12;
    double height = distance * Math.Sin(pitch);
    double r = distance * Math.Cos(pitch);

    double blend = frameCount == 1 ? 1.0 : 0.1;

    Point3d camTarget = blend * (bb.Center - Vector3d.ZAxis * 0.5) + (1.0 - blend) * viewport.CameraTarget;
    Point3d camLocation = blend * new Point3d(
      bb.Center.X + r * Math.Cos(alpha),
      bb.Center.Y + r * Math.Sin(alpha),
      bb.Center.Z + height) +
      (1.0 - blend) * viewport.CameraLocation;

    viewport.SetCameraLocations(camTarget, camLocation);

    frameCount++;
  }

  public override void DrawViewportMeshes(IGH_PreviewArgs args)
  {
    if (!Component.Locked) args.Display.DrawMeshShaded(rhinoMesh, material);
  }

  public override void DrawViewportWires(IGH_PreviewArgs args)
  {
  }



  public class MeshGrowthSystem
  {
    public PlanktonMesh Mesh;
    public int CurrentIteration;

    public bool Grow = false;
    public int MaxVertexCount;

    public Point3d Attractor;
    public bool UseRTree;

    public double EdgeLengthWeight = 1.0;
    public double CollisionDistance = 20.0;
    public double CollisionWeight = 1.0;
    public double BendingResistanceWeight = 1;

    private List<Vector3d> totalWeightedMoves;
    private List<double> totalWeights;
    private List<Vector3d> velocities;


    public MeshGrowthSystem(Mesh startingMesh)
    {
      CurrentIteration = 0;
      Mesh = startingMesh.ToPlanktonMesh();
      velocities = new List<Vector3d>();
    }

    public void Update()
    {
      CurrentIteration++;
      SplitFace();
      PrepareForConstraintsSolving();
      //ProcessExternalForces();
      ProcessEdgeLength();
      ProcessCollisionRTree();
      ProcessBendingResistance();
      UpdateVertexPositionsAndVelicities();
    }

    private void ProcessExternalForces()
    {
      double gravityWeight = 0.5;
      double floorWeight = 1.0;
      for (int i = 0; i < Mesh.Vertices.Count; i++)
      {
        totalWeightedMoves[i] += gravityWeight * Vector3d.ZAxis * (-0.2);
        totalWeights[i] += gravityWeight;

        if (Mesh.Vertices[i].Z < 0.0)
        {
          totalWeightedMoves[i] += floorWeight * new Vector3d(0.0, 0.0, -Mesh.Vertices[i].Z);
          totalWeights[i] += floorWeight;
        }
      }
    }



    Random random = new Random(0);
    private void SplitFace()
    {
      if (!Grow) return;

      double splitTrigger = 0.99 * CollisionDistance;

      int halfedgeCount = Mesh.Halfedges.Count;
      int edgeCount = halfedgeCount / 2;

      int minNewVertex = 50;
      double roulette = 1.3;
      if (roulette * edgeCount < minNewVertex) roulette = minNewVertex / (double) edgeCount;

      for (int k = 0; k < halfedgeCount; k += 2)
      {
        if (random.NextDouble() > roulette) continue;

        if (Mesh.Vertices.Count >= MaxVertexCount) break;

        if (Mesh.Halfedges.GetLength(k) < splitTrigger) continue;

        int newHalfEdgeIndex = Mesh.Halfedges.SplitEdge(k);

        Mesh.Vertices.SetVertex(
          Mesh.Vertices.Count - 1,
          0.5 * (Mesh.Vertices[Mesh.Halfedges[k].StartVertex].ToPoint3d() + Mesh.Vertices[Mesh.Halfedges[k + 1].StartVertex].ToPoint3d()));

        if (Mesh.Halfedges[k].AdjacentFace >= 0) Mesh.Faces.SplitFace(newHalfEdgeIndex, Mesh.Halfedges[k].PrevHalfedge);
        if (Mesh.Halfedges[k + 1].AdjacentFace >= 0) Mesh.Faces.SplitFace(k + 1, Mesh.Halfedges[Mesh.Halfedges[k + 1].NextHalfedge].NextHalfedge);
      }
    }


    private void PrepareForConstraintsSolving()
    {
      totalWeightedMoves = new List<Vector3d>();
      totalWeights = new List<double>();

      for (int i = 0; i < Mesh.Vertices.Count; i++)
      {
        totalWeightedMoves.Add(Vector3d.Zero);
        totalWeights.Add(0.0);
      }

      for (int i = velocities.Count; i < Mesh.Vertices.Count; i++)
      {
        velocities.Add(Vector3d.Zero);
      }
    }


    private void ProcessEdgeLength()
    {
      if (EdgeLengthWeight == 0.0) return;

      int halfedgeCount = Mesh.Halfedges.Count;

      for (int k = 0; k < halfedgeCount; k += 2)
      {
        PlanktonHalfedge halfedge = Mesh.Halfedges[k];
        int i = halfedge.StartVertex;
        int j = Mesh.Halfedges[halfedge.NextHalfedge].StartVertex;

        Vector3d d = Mesh.Vertices[j].ToPoint3d() - Mesh.Vertices[i].ToPoint3d();
        if (d.Length < CollisionDistance) continue;

        Vector3d move = EdgeLengthWeight * 0.5 * (d);

        totalWeightedMoves[i] += move;
        totalWeightedMoves[j] -= move;
        totalWeights[i] += EdgeLengthWeight;
        totalWeights[j] += EdgeLengthWeight;
      }
    }


    private void ProcessCollisionRTree()
    {
      RTree rTree = new RTree();

      for (int i = 0; i < Mesh.Vertices.Count; i++)
        rTree.Insert(Mesh.Vertices[i].ToPoint3d(), i);

      List<int>[] collisionIndices = new List<int>[Mesh.Vertices.Count];

      for (int i = 0; i < Mesh.Vertices.Count; i++)
        collisionIndices[i] = new List<int>();

      for (int i = 0; i < Mesh.Vertices.Count; i++)
        rTree.Search(
          new Sphere(Mesh.Vertices[i].ToPoint3d(), CollisionDistance),
          (sender, args) => { if (i < args.Id) collisionIndices[i].Add(args.Id);});

      for (int i = 0; i < collisionIndices.Length; i++)
      {
        foreach (int j in collisionIndices[i])
        {
          Vector3d move = Mesh.Vertices[j].ToPoint3d() - Mesh.Vertices[i].ToPoint3d();
          double currentDistance = move.Length;
          if (currentDistance > CollisionDistance) continue;
          move *= CollisionWeight * 0.5 * (currentDistance - CollisionDistance) / currentDistance;
          totalWeightedMoves[i] += move;
          totalWeightedMoves[j] -= move;
          totalWeights[i] += CollisionWeight;
          totalWeights[j] += CollisionWeight;
        }
      }
    }


    private void ProcessBendingResistance()
    {
      int halfedgeCount = Mesh.Halfedges.Count;
      for (int k = 0; k < halfedgeCount; k += 2)
      {
        // Skip if this edge is naked
        if (Mesh.Halfedges[k].AdjacentFace == -1 || Mesh.Halfedges[k + 1].AdjacentFace == -1) continue;

        int i = Mesh.Halfedges[k].StartVertex;
        int j = Mesh.Halfedges[k + 1].StartVertex;
        int p = Mesh.Halfedges[Mesh.Halfedges[k].PrevHalfedge].StartVertex;
        int q = Mesh.Halfedges[Mesh.Halfedges[k + 1].PrevHalfedge].StartVertex;

        Point3d vI = Mesh.Vertices[i].ToPoint3d();
        Point3d vJ = Mesh.Vertices[j].ToPoint3d();
        Point3d vP = Mesh.Vertices[p].ToPoint3d();
        Point3d vQ = Mesh.Vertices[q].ToPoint3d();

        Vector3d ij = vJ - vI;
        Vector3d nP = Vector3d.CrossProduct(ij, vP - vI);
        Vector3d nQ = Vector3d.CrossProduct(vQ - vI, ij);

        Vector3d planeNormal = (nP + nQ) / (nP.Length + nQ.Length);

        Point3d planeOrigin = 0.25 * (vI + vJ + vP + vQ);
        Plane plane = new Plane(planeOrigin, planeNormal);
        totalWeightedMoves[i] += BendingResistanceWeight * (plane.ClosestPoint(vI) - vI);
        totalWeightedMoves[j] += BendingResistanceWeight * (plane.ClosestPoint(vJ) - vJ);
        totalWeightedMoves[p] += BendingResistanceWeight * (plane.ClosestPoint(vP) - vP);
        totalWeightedMoves[q] += BendingResistanceWeight * (plane.ClosestPoint(vQ) - vQ);
        totalWeights[i] += BendingResistanceWeight;
        totalWeights[j] += BendingResistanceWeight;
        totalWeights[p] += BendingResistanceWeight;
        totalWeights[q] += BendingResistanceWeight;
      }
    }


    private void UpdateVertexPositionsAndVelicities()
    {
      for (int i = 0; i < Mesh.Vertices.Count; i++)
      {
        if (totalWeights[i] == 0) continue;
        PlanktonVertex vertex = Mesh.Vertices[i];
        Vector3d move = totalWeightedMoves[i] / totalWeights[i];
        Mesh.Vertices.SetVertex(i, vertex.X + move.X, vertex.Y + move.Y, vertex.Z + move.Z);
        velocities[i] += move;
        if (velocities[i] * move < 0.0) velocities[i] *= 0.95;
      }
    }
  }
# ---------- end c_script_2 ----------
c_script_3 = CSharpScript()  # -> Out, OMesh
mesh_2 = Mesh(c_script_2.oMesh)
level = Slider(2, range=0..4)
panel = Panel(c_script_2.out)
wbloop = WeaverbirdsLoopSubdivision(MeshCurves=mesh_2, Level=level, SmoothNakedEdges=1)
flip = MeshFlip(Mesh=wbloop)
preview = CustomPreview(
    Geometry=[wbloop, flip],
    Material=[ColourSwatch(SwatchColor=RGB(230, 230, 230)), ColourSwatch(SwatchColor=RGB(178, 71, 71))])
