# Grasshopper definition XX_stigmergy - code.gh (Grasshopper 1.0.7)
# Copyright: Co-de-iT
# plug-ins: FileToScript, Weaverbird, Noise 4D

# references: . Jeff Jones papers
# 
# http://eprints.uwe.ac.uk/15260/1/artl.2010.16.2.pdf (p. 145)
# http://eprints.uwe.ac.uk/20845/1/2011%20Naco%20uc09%20paper%20author%20copy.pdf
# 
# . Sage Jenson interpretation
# https://sagejenson.com/physarum
# 
# . David Reeves
# https://vimeo.com/123547307
dir_type = ValueList({"desktop": 0, "documents": 1, "GH file path": 2, "C:": 3}, selected="GH file path")
# notes for further implementations: . introduce goals (aka "food sources")
# 
# . introduce obstacles: black areas or areas with predefined fixed values in the scalar field that resist pheromone deposition (i.e. value remains constant or it is a strong % of the original value)
# 
# . despite the fact that the mesh surface develops in space, this interaction happens in a 2D space, so using a 3D coordinate system is highly inefficient (adds one dimension to all computations)
# 
# . for future developments, there should be a way of UV-Unwrap the mesh and feed the boundaries of that map to the component, so that all stugmergic calculations can be done in a 2D plane
# 
# . another possibility is to implement the same thing in a volumetric voxel space (see David Reeves)
panel = Panel("stigmergy.cs")
f_pathg = PathGenerator(type=dir_type, subDir="Stigmergy")  # -> dir; inputs type: Int32, subDir: String
# ---------- f_pathg: C# ----------
                           /*
    froGH - a sparse collection of (in)utilities for Grasshopper

    Path Generator
    code by Alessio Erioli - value list generation based on code by James Ramsden

    froGH by Co-de-iT is licensed under a Creative Commons Attribution 4.0 International License.
    http://creativecommons.org/licenses/by/4.0/

    */
    initComp();


    String S = "";
    String root = "";
    String end = "\\";
    String eol = Environment.NewLine;

    // __________________ autoList part __________________

    // variable for the list
    Grasshopper.Kernel.Special.GH_ValueList vList;
    // tries to cast input as list
    try{

      // if the list is not the first parameter then change Input[0] to the corresponding value
      vList = (Grasshopper.Kernel.Special.GH_ValueList) Component.Params.Input[0].Sources[0];
      // Print("value list connected");
      // check if the list must be created
      //if (vList.NickName != "dir type"){
      if (!vList.NickName.Equals("dir type")){
        vList.ClearData();
        vList.ListItems.Clear();
        vList.NickName = "dir type";
        var item1 = new Grasshopper.Kernel.Special.GH_ValueListItem("desktop", "0");
        var item2 = new Grasshopper.Kernel.Special.GH_ValueListItem("documents", "1");
        var item3 = new Grasshopper.Kernel.Special.GH_ValueListItem("GH file path", "2");
        var item4 = new Grasshopper.Kernel.Special.GH_ValueListItem("C:", "3");
        vList.ListItems.Add(item1);
        vList.ListItems.Add(item2);
        vList.ListItems.Add(item3);
        vList.ListItems.Add(item4);

        vList.ListItems[0].Value.CastTo(out type);
      }
    }
    catch{
      // handles anything that is not a value list
    }


    switch(type){
      case 0:
        root = Environment.GetFolderPath(Environment.SpecialFolder.Desktop) + end;
        S = "Desktop";
        break;
      case 1:
        root = Environment.GetFolderPath(Environment.SpecialFolder.MyDocuments) + end;
        S = "Documents";
        break;
      case 2:
        GH_Document ghDoc = owner.OnPingDocument();

        if (ghDoc.IsFilePathDefined)
        {
          int nameLen = ghDoc.DisplayName.TrimEnd('*').Length + 3; // +3 accounts for the '.gh' extension
          int fileLen = ghDoc.FilePath.TrimEnd('*').Length;

          //F = ghDoc.DisplayName.TrimEnd('*');
          root = ghDoc.FilePath.Substring(0, fileLen - nameLen);
          //root = gh_d.FilePath;
          S = "GH File path";
        }
        else
        {
          Print("No path defined. Saving to Desktop until then");
          root = Environment.GetFolderPath(Environment.SpecialFolder.Desktop);
          S = "Desktop";
        }
        break;
      case 3:
        root = "C:" + end;
        S = root + end;
        break;
    }
    dir = root + (subDir != null ? (subDir + end) : "");
    Component.Message = S;
# ---------- f_pathg: C# additional code ----------
  void initComp(){
    Component.Name = "Path Generator";
    Component.NickName = "f_PathG";
    Component.Description = "generates a path based on local direcories such as Desktop, Documents, GH file path";
    Component.Params.Input[0].Name = "dir type";
    Component.Params.Input[0].Description = "directory type: 0 desktop, 1 documents, 2 GH file path, 3 C:\nconnect a value list for automatic list generation";
    Component.Params.Input[1].Name = "custom subdir";
    Component.Params.Input[1].Description = "(optional) custom subdirectory";
  }
# ---------- end f_pathg ----------
concat = Concatenate(FragmentA=f_pathg, FragmentB=panel)
path = FilePath(concat)
# when symmetric noise is selected, the amount of tentative particles is 2x
tentative_particles = Slider(500, range=0..3000)

# ---- group: TRI-MESH
mesh = Mesh(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)

# ---- group: QUAD-MESH
mesh_2 = Mesh(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)

# ----
noise_type = ValueList({"Symmetric": 0, "Non symmetric": 1}, selected="Symmetric")
mesh_type = ValueList({"TriMesh": 0, "QuadMesh": 1}, selected="QuadMesh")
mirror = Mirror(Geometry=mesh, Plane=PlaneYZ(0, 0, 0))  # -> Geometry, Transform
number_slider = Slider(1, range=0..2)
wbjoin = WeaverbirdsJoinMeshesAndWeld(Mesh=[mirror.Geometry, mesh], Weld=False)
wbcatmullclark = WeaverbirdsCatmullClarkSubdivision(MeshCurves=wbjoin, Level=Slider(3, range=1..3), SmoothNakedEdges=Slider(2, range=0..2))
wbcatmullclark_2 = WeaverbirdsCatmullClarkSubdivision(MeshCurves=mesh_2, Level=Slider(3, range=1..3), SmoothNakedEdges=number_slider)
button = Button()  # "> - ||"
# Stigmergy on mesh
# 
# Stigmergic system with diffusion and evaporation implemented on mesh
# 
# © a3 _/TH.esis 2019 _ Creative Commons Attribution-NonCommercial-ShareAlike3.0 UnportedLicense.
reset = Button()
debug = BooleanToggle(False)
method = ValueList({"RTree": 0, "Jones": 1}, selected="Jones")
seek_radius = Slider(2.508, range=1..5)
seek_intensity = Slider(1, range=0..1)
evaporation_rate = Slider(0.99, range=0..1)
diffusion_rate = Slider(0.1, range=0.001..0.5)
sensang = Slider(0.194, range=0..1)
wbloop = WeaverbirdsLoopSubdivision(MeshCurves=wbcatmullclark, Level=Slider(3, range=1..3), SmoothNakedEdges=Slider(2, range=0..2))
wbcatmullclark_3 = WeaverbirdsCatmullClarkSubdivision(MeshCurves=wbcatmullclark_2, Level=Slider(2, range=1..3), SmoothNakedEdges=number_slider)
trt = TheRealToggle(t=button)  # -> T; inputs t: Boolean
# ---------- trt: C# ----------
    InitComp();

    if(t) r = !r;

    Component.Message = r ? "play":"pause";

    T = r;
# ---------- trt: C# additional code ----------
  bool r = false;
  public void InitComp()
  {
    Component.Name = "The Real Toggle";
    Component.NickName = "TRT";
    Component.Description = "Permanent toggle - use a button to change boolean value.\nJust because I hate double clicks.";
  }
# ---------- end trt ----------
pi = Pi(Factor=sensang)
deg = Degrees(Radians=pi)
panel_2 = Panel(deg)
filter = StreamFilter(Gate=mesh_type, Stream0=wbloop, Stream1=wbcatmullclark_3)
ftsv2 = FileToScriptV2(File=path)
demesh = DeconstructMesh(Mesh=filter)  # -> Vertices, Faces, Colours, Normals

# ---- group: scalar (noise) field
bbox = BoundingBox(Content=filter, Plane=PlaneXY(0, 0, 0), UnionBox=True)  # -> Box, Box_2
boxprop = BoxProperties(Box=bbox.Box)  # -> Center, Diagonal, Area, Volume, Degeneracy
xz = XZPlane(Origin=boxprop.Center)
yz = YZPlane(Origin=boxprop.Center)
filter_2 = StreamFilter(Gate=mesh_type, Stream0=yz, Stream1=xz)
plcoord = PlaneCoordinates(Point=demesh.Vertices, System=filter_2)  # -> XCoordinate, YCoordinate, ZCoordinate
abs = Absolute(Value=plcoord.ZCoordinate)
pt = PointOriented(BasePlane=filter_2, UComponent=plcoord.XCoordinate, VComponent=plcoord.YCoordinate, WComponent=abs)
filter_3 = StreamFilter(Gate=noise_type, Stream0=pt, Stream1=demesh.Vertices)
simplex = SimplexNoise(Values=filter_3, Time=Slider(1.395, range=0..10), Scale=Slider(0.02, range=0..1))

# ---- group: sampling points
lng = ListLength(List=demesh.Vertices)
random = Random(Range=lng, Number=tentative_particles, Seed=2, Integers=True)
item = ListItem(List=demesh.Vertices, Index=random, Wrap=True)
cullpt = CullDuplicates(Points=item, Tolerance=0.1, CullMode=1)  # -> Points, Indices, Valence
mirror_2 = Mirror(Geometry=cullpt.Points, Plane=filter_2)  # -> Geometry, Transform
merge = Merge(Data1=cullpt.Points, Data2=mirror_2.Geometry)  # -> flatten(Result)
filter_4 = StreamFilter(Gate=noise_type, Stream0=merge, Stream1=cullpt.Points)

# ---- group: initial particles positions
pt_2 = Point(filter_4)

# ----
lng_2 = ListLength(List=pt_2)
n_of_particles = Panel(lng_2)
gradient = Gradient(LowerLimit="-1", UpperLimit=1, Parameter=simplex, stops=[0: RGB(0, 0, 0), 1: RGB(255, 255, 255)])

# ---- group: vector field / sign
c_script = CSharpScript(N=plcoord.ZCoordinate)  # -> S; inputs N: Double
# ---------- c_script: C# ----------
    S = (N == 0) ? 0 : (N / Math.Abs(N));
# ---------- end c_script ----------

# ---- group: vector field
num = Number(simplex)
bnd = Bounds(Numbers=flatten(num))
dom = ConstructDomain(DomainStart=0, DomainEnd=1)
remap = RemapNumbers(Value=num, Source=bnd, Target=dom)  # -> Mapped, Clipped
pi_2 = Pi(Factor=Slider(9, range=0..30))
multiplication = Multiplication(A=remap.Mapped, B=pi_2)
deplane = DeconstructPlane(Plane=filter_2)  # -> Origin, XAxis, YAxis, ZAxis
multiplication_2 = Multiplication(A=multiplication, B=c_script)
xprod = CrossProduct(VectorA=demesh.Normals, VectorB=deplane.ZAxis, Unitize=False)  # -> Vector, Length
filter_5 = StreamFilter(Gate=noise_type, Stream0=multiplication_2, Stream1=multiplication)
vrot = Rotate(Vector=xprod.Vector, Axis=demesh.Normals, Angle=filter_5)
vdisex = VectorDisplayEx(Point=demesh.Vertices, Vector=vrot, Colour=RGB(0, 0, 0), Width=2)

# ----
conmesh = ConstructMesh(Vertices=demesh.Vertices, Faces=demesh.Faces, Colours=gradient)

# ---- group: b/w mesh
mesh_3 = Mesh(conmesh)

# ----
# sensor angle
c_script_2 = CSharpScript(
    reset=reset,
    go=trt,
    debug=debug,
    method=method,
    M=mesh_3,
    P=pt_2,
    sR=seek_radius,
    sI=seek_intensity,
    dR=diffusion_rate,
    eR=evaporation_rate,
    sensDist=Slider(2.468, range=1..5),
    sensAng=pi)  # -> out, points, vectors, outMCol, neigh, neighCol, sensors; inputs reset: Boolean, go: Boolean, debug: Boolean, method: Int32, M: Mesh, P: list of Point3d, sR: Double, sI: Double, dR: Double, eR: Double, sensDist: Double, sensAng: Double
# ---------- c_script_2: C# usings ----------
using System.Drawing;
using System.Threading;
using System.Threading.Tasks;
using System.Collections.Concurrent;
# ---------- c_script_2: C# ----------
 
        // ............................................................................
        // Stigmergy system
        /*
         notes on code refactoring

        2 main classes:
        . Particle System (and a class Particle)
        . Environment (Mesh with scalar and optional vector field)

        RunScript function structure:

        . check inputs & eventually bypass execution
        . initialise Environment
        . initialise Particle System
        . Update live variables
        . Update Particle System
        . Update Environment
        . Extract Output Geometries and Data

         */

        // return on null input
        if (M == null || P == null) return;


        // initialize on first execution or mesh change
        if (PS == null || M.Vertices.Count != ME.scalarField.Length)
        {
            // initialize particle system
            ME = new MeshEnvironment(M, dR, eR);
            PS = new ParticleSystem(P, ME);
        }

        // restore initial values on reset
        if (reset)
        {
            // initialize particle system
            ME.RestoreScalarField();
            PS = new ParticleSystem(P, ME);

        }

        if (go)
        {
            // update runtime variables
            PS.seekRadius = sR;
            PS.seekIntensity = sI;
            PS.sensDist = sensDist; // old value 3.0
            PS.sensAng = sensAng;
            ME.diffusionRate = (float)dR;
            ME.evaporationRate = (float)eR;

            // update simulation
            switch (method)
            {
                case 0:
                    PS.UpdateRTree();
                    break;
                case 1:
                    PS.UpdateJones();
                    break;
            }

            // update environment (diffusion + evaporation)
            ME.Update();

            // update component
            Component.ExpireSolution(true);
        }

        // . . . . . . .  extract geometries

        // particles positions and velocites
        PS.GetPointsVectors(out pts, out vecs);
        points = pts;
        vectors = vecs;

        // colored mesh
        outMCol = ME.GetColoredMesh();

        // debug mode
        if (debug)
        {
            switch (method)
            {
                case 0:
                    neigh = PS.GetNeighPts();
                    neighCol = PS.GetNeighBrightness();
                    break;
                case 1:
                    sensors = PS.SensorsOut();
                    break;
            }
        }

        // ............................................................................
# ---------- c_script_2: C# additional code ----------
 
    // ............................................................................Global Variables
    public ParticleSystem PS;
    public MeshEnvironment ME;
    public GH_Point[] pts;
    public GH_Vector[] vecs;

    // ............................................................................Classes

    // .......................................................... Particle System ........

    public class ParticleSystem
    {
        // . . . . . . . . . . . . . . . . . . . . . . fields
        public List<Particle> Particles;
        public RTree MeshRTree;
        public double seekRadius;
        public double seekIntensity;
        public double sensDist;
        public double sensAng;
        public MeshEnvironment ME;

        // . . . . . . . . . . . . . . . . . . . . . . constructor
        public ParticleSystem(List<Point3d> positions, MeshEnvironment ME)
        {
            this.ME = ME;
            Particles = new List<Particle>();
            for (int i = 0; i < positions.Count; i++)
                Particles.Add(new Particle(this, positions[i], RandomVectorOnMesh(ME.M, positions[i], i) * 1.5));

        }

        // . . . . . . . . . . . . . . . . . . . . . . methods
        /// <summary>
        /// Update with Jeff Jones 3-sensors method
        /// </summary>
        public void UpdateJones()
        {
            /*
             How was it parallelized?
             Several particles might write their pheromone contribution to the same mesh point,
             to avoid simultaneous write to te same location (surest way to get an error,
             even using so called "thread-safe" collections - especially if they are made
             of structures and not classes):
             . each particle saves its own closest point index as an internal field
             . the resulting contribution is written in a separate non-parallel loop
               that updates the scalar field.
             */
            Parallel.ForEach(Particles, p =>

            {
                // find mesh closest point index
                p.currentCPindex = ME.MeshPoints.ClosestPoint(p.pos);
                // Seek brightest point direction
                p.SeekAngVis();

            });

            // write to scalar field
            foreach (Particle p in Particles)
                ME.scalarField[p.currentCPindex] = (float)Math.Min(1.0, ME.scalarField[p.currentCPindex] + p.PheroStrength);

            // update particles
            if (Particles.Count > 50)
            {
                Parallel.ForEach(Particles, p =>
                {
                    p.Update();
                });
            }
            else
                foreach (Particle p in Particles)
                    p.Update();

        }

        /// <summary>
        /// Update with RTree method (samples points within a sphere)
        /// </summary>
        /// <param name="M"></param>
        public void UpdateRTree()
        {
            foreach (Particle p in Particles)
            {
                // clear particle neighbours list
                //p.neighbours.Clear();
                //p.neighFieldPts.Clear();
                p.neighbours.Clear();

                // Eventhandler function for RTree search
                EventHandler<RTreeEventArgs> rTreeCallback = (object sender, RTreeEventArgs args) =>
                {
                    p.neighbours.Add(args.Id);
                    //p.neighbours.Add(ME.M.Vertices[args.Id]);
                    //p.neighFieldPts.Add(new FieldPt(args.Id, ME.scalarField[args.Id]));
                };

                ME.MeshRTree.Search(new Sphere(ME.M.ClosestPoint(p.pos + p.vel * sensDist), seekRadius), rTreeCallback);

                // Seek brightest point direction
                p.SeekColor();

                //// update scalar field
                int cpInd = ME.MeshPoints.ClosestPoint(p.pos);
                ME.scalarField[cpInd] = (float)Math.Min(1.0, ME.scalarField[cpInd] + p.PheroStrength);

            }

            if (Particles.Count > 50)
            {
                Parallel.ForEach(Particles, p =>
               {
                   p.Update();
               });
            }
            else
                foreach (Particle p in Particles)
                    p.Update();

        }

        public void GetPointsVectors(out GH_Point[] pts, out GH_Vector[] vecs)
        {
            pts = new GH_Point[Particles.Count];
            vecs = new GH_Vector[Particles.Count];

            for (int i = 0; i < Particles.Count; i++)
            {
                pts[i] = new GH_Point(Particles[i].pos);
                vecs[i] = new GH_Vector(Particles[i].vel);
            }
        }

        public DataTree<GH_Point> GetNeighPts()
        {
            DataTree<GH_Point> ptsOut = new DataTree<GH_Point>();

            for (int i = 0; i < Particles.Count; i++)
                ptsOut.EnsurePath(new GH_Path(i));

            // parallelize for more than 50 particles
            if (Particles.Count > 50)
            {

                var x = Partitioner.Create(0, Particles.Count);

                Parallel.ForEach(x, (range, loopstate) =>
                {
                    for (int i = range.Item1; i < range.Item2; i++)
                    {
                        for (int j = 0; j < Particles[i].neighbours.Count; j++)
                            //ptsOut.Add(new GH_Point(Particles[i].neighbours[j]), new GH_Path(i));
                            ptsOut.Add(new GH_Point(ME.MeshPoints[Particles[i].neighbours[j]].Location), new GH_Path(i));
                    }
                });
            }
            else
            {
                for (int i = 0; i < Particles.Count; i++)
                {
                    for (int j = 0; j < Particles[i].neighbours.Count; j++)
                        //ptsOut.Add(new GH_Point(Particles[i].neighbours[j]), new GH_Path(i));
                        ptsOut.Add(new GH_Point(ME.MeshPoints[Particles[i].neighbours[j]].Location), new GH_Path(i));
                }
            }

            return ptsOut;
        }

        public DataTree<GH_Number> GetNeighBrightness()
        {

            DataTree<GH_Number> briOut = new DataTree<GH_Number>();

            for (int i = 0; i < Particles.Count; i++)
                briOut.EnsurePath(new GH_Path(i));

            for (int i = 0; i < Particles.Count; i++)
            {
                for (int j = 0; j < Particles[i].neighbours.Count; j++)
                    briOut.Add(new GH_Number(ME.scalarField[Particles[i].neighbours[j]]), new GH_Path(i));
            }

            return briOut;
        }

        public DataTree<GH_Vector> SensorsOut()
        {
            DataTree<GH_Vector> sensOut = new DataTree<GH_Vector>();

            for (int i = 0; i < Particles.Count; i++)
            {
                GH_Path path = new GH_Path(i);
                sensOut.Add(new GH_Vector(Particles[i].sensorL), path);
                sensOut.Add(new GH_Vector(Particles[i].sensorC), path);
                sensOut.Add(new GH_Vector(Particles[i].sensorR), path);
            }
            return sensOut;
        }

    }

    // .......................................................... Particle ...............
    public class Particle
    {
        public Point3d pos;
        public Vector3d vel;
        public Vector3d acc;
        public Vector3d sensorC, sensorL, sensorR;
        public double visAng;
        public double MaxSpeed;
        public float PheroStrength;
        public int currentCPindex;
        public List<int> neighbours;
        public ParticleSystem pSystem;

        public Particle(ParticleSystem pSystem, Point3d pos, Vector3d vel)
        {
            this.pSystem = pSystem;
            this.pos = pos;
            this.vel = vel;
            acc = Vector3d.Zero;
            MaxSpeed = 1.5f;
            PheroStrength = 0.1f;
            visAng = pSystem.sensAng; //0.3 * Math.PI;
            neighbours = new List<int>();
        }

        public void Update()
        {
            Move();
        }

        public void SeekAngVis()
        {
            acc = Vector3d.Zero;
            visAng = pSystem.sensAng;
            Vector3d rotAxis = pSystem.ME.MeshPoints[currentCPindex].Normal;
            sensorC = VectorAmp(vel, pSystem.sensDist);

            sensorL = new Vector3d(sensorC);
            sensorR = new Vector3d(sensorC);
            sensorL.Rotate(visAng, rotAxis);
            sensorR.Rotate(-visAng, rotAxis);

            int pL, pR, pC;
            double briL, briR, briC;
            pC = pSystem.ME.MeshPoints.ClosestPoint(pos + sensorC);
            pL = pSystem.ME.MeshPoints.ClosestPoint(pos + sensorL);
            pR = pSystem.ME.MeshPoints.ClosestPoint(pos + sensorR);
            briC = pSystem.ME.scalarField[pC];
            briL = pSystem.ME.scalarField[pL];
            briR = pSystem.ME.scalarField[pR];
            Vector3d desired = Vector3d.Zero;

            //if (briL - briR < 0.01)
            //{
            //    Random rnd = new Random();
            //    futPos.Rotate(visAng * (rnd.NextDouble() - 0.5), rotAxis);
            //}
            //else
            //    futPos = briL > briR ? futPosL : futPosR;

            // find brightest sensor
            Vector3d direction = sensorC;
            if (briL > briC && briL > briR) direction = sensorL;
            else if (briR > briC) direction = sensorR;

            // find mesh closest point to futpos
            desired = pSystem.ME.MeshPoints[pSystem.ME.MeshPoints.ClosestPoint(pos + direction)].Location - pos;
            desired.Unitize();
            desired *= MaxSpeed;
            
            acc = (desired - vel) * pSystem.seekIntensity;
        }

        public void SeekColor()
        {
            acc = vel;

            if (neighbours.Count > 0)
            {
                acc = Vector3d.Zero;
                Vector3d desired = Vector3d.Zero;
                double bri;
                double MaxBri = -1.0;
                int MaxInd = -1;

                for (int i = 0; i < neighbours.Count; i++)
                {
                    bri = pSystem.ME.scalarField[neighbours[i]]; // brightness is 0-1 and RGB 0-255
                    if (bri > MaxBri)
                    {
                        MaxBri = bri;
                        MaxInd = i;
                    }

                }

                desired += pSystem.ME.MeshPoints[neighbours[MaxInd]].Location - pos;

                desired.Unitize();
                desired *= MaxSpeed;

                acc = (desired - vel) * pSystem.seekIntensity;
            }
        }

        //public void SeekMeshClosestPt(Mesh M, double seekIntensity)
        //{
        //    acc = Vector3d.Zero;
        //    MeshPoint mP = M.ClosestMeshPoint(pos + vel * pSystem.futPosMult, 100); // old value 1.5
        //    if (mP != null)
        //    {
        //        Point3d mCP = mP.Point;

        //        Vector3d desired = mCP - pos;
        //        desired.Unitize();
        //        desired *= MaxSpeed;

        //        acc = (desired - vel) * seekIntensity;
        //    }

        //}

        public void Move()
        {
            //vel = vel * 0.9 + acc * 0.1;
            vel = vel + acc;
            if (vel.Length > MaxSpeed)
            {
                vel.Unitize();
                vel *= MaxSpeed;
            }
            if (vel.Length < 1)
            {
                vel.Unitize();
            }
            pos += vel;
        }


    }

    // .......................................................... Mesh Environment .......

    public class MeshEnvironment
    {
        public Mesh M;
        public float diffusionRate;
        public float evaporationRate;
        public float[] scalarField;
        float[] initVal;
        public PointCloud MeshPoints;
        public RTree MeshRTree;
        int[][] NeighbourMap;
        readonly float[] DiffusionWeights;
        

        // M must be a colored Mesh
        public MeshEnvironment(Mesh M, double diffusionRate, double evaporationRate)
        {
            // assign external variables
            this.M = M;
            this.diffusionRate = (float)diffusionRate;
            this.evaporationRate = (float)evaporationRate;
            // scalar field structures
            scalarField = PopulateScalarField(M);
            initVal = PopulateScalarField(M);
            NeighbourMap = BuildNeighboursMap(M);
            DiffusionWeights = CalculateDiffusionWeights();
            // point data structures
            MeshPoints = PopulatePointCloud(M);
            MeshRTree = PopulateMeshRTree(M);
        }

        public void Update()
        {
            Diffusion();
            EvaporateField();
        }

        public float[] PopulateScalarField(Mesh M)
        {
            float[] scalarField = new float[M.Vertices.Count];

            if (M.VertexColors.Count != 0)
            {

                var x = Partitioner.Create(0, M.VertexColors.Count);

                Parallel.ForEach(x, (range, loopstate) =>
                {
                    for (int i = range.Item1; i < range.Item2; i++)
                    {
                        scalarField[i] = M.VertexColors[i].GetBrightness();

                    }
                });
            }
            return scalarField;
        }

        public void EvaporateField()
        {

            Parallel.For(0, scalarField.Length, i =>
            {
                scalarField[i] *= evaporationRate;
            });
        }

        public void RestoreScalarField()
        {
            Parallel.For(0, initVal.Length, i =>
            {
                scalarField[i] = initVal[i];
            });
        }

        public int[][] BuildNeighboursMap(Mesh M)
        {
            int[][] NeighbourMap = new int[M.Vertices.Count][];

            Parallel.For(0, M.Vertices.Count, i =>
            {
                NeighbourMap[i] = M.Vertices.GetConnectedVertices(i);
            });

            return NeighbourMap;

        }

        public float[] CalculateDiffusionWeights()
        {
            float[] Weights = new float[NeighbourMap.Length];

            Parallel.For(0, NeighbourMap.Length, i =>
            {
                Weights[i] = 1 / (float)NeighbourMap[i].Length;
            });

            return Weights;
        }

        public float[] Diffusion()
        {
            float[] newVal = new float[scalarField.Length];

            // calculate new scalar values
            Parallel.For(0, scalarField.Length, i =>
            {
                float neighVal = 0;

                for (int j = 0; j < NeighbourMap[i].Length; j++)
                    neighVal += scalarField[NeighbourMap[i][j]] * DiffusionWeights[i];
                newVal[i] = scalarField[i] * (1 - diffusionRate) + neighVal * diffusionRate;
            });

            // assign new scalar values
            Parallel.For(0, scalarField.Length, i =>
            {
                scalarField[i] = newVal[i];
            });

            return scalarField;
        }

        public RTree PopulateMeshRTree(Mesh M)
        {
            RTree rt = new RTree();

            for (int i = 0; i < M.Vertices.Count; i++)
            {
                rt.Insert((Point3d)M.Vertices[i], i);
            }

            return rt;
        }

        public PointCloud PopulatePointCloud(Mesh M)
        {
            PointCloud mP = new PointCloud();

            for (int i = 0; i < M.Vertices.Count; i++)
            {
                mP.Add(M.Vertices[i], M.Normals[i]);
            }

            return mP;
        }

        // output data

        public GH_Mesh GetColoredMesh()
        {

            Parallel.For(0, scalarField.Length, i =>
            {
                int c = (int)(scalarField[i] * 255);
                M.VertexColors[i] = Color.FromArgb(c, c, c);
            });

            return new GH_Mesh(M);
        }

        public GH_Number[] GetScalarField()
        {
            GH_Number[] outField = new GH_Number[scalarField.Length];

            Parallel.For(0, scalarField.Length, i =>
            {
                outField[i] = new GH_Number(scalarField[i]);
            });

            return outField;
        }
    }


    // ............................................................................Utilities

    #region Utilities

    public static Vector3d VectorAmp(Vector3d v, double Amplitude)
    {
        v.Unitize();
        return (v * Amplitude);
    }

    public static Vector3d RandomVector(int seed)
    {
        Vector3d r = Vector3d.Zero;
        Random rnd = new Random(seed);
        r = new Vector3d((rnd.NextDouble() * 2) - 1, (rnd.NextDouble() * 2) - 1, (rnd.NextDouble() * 2) - 1);
        return r;
    }

    public static Vector3d RandomVectorOnMesh(Mesh M, Point3d p, int seed)
    {
        Vector3d r = Vector3d.Zero;
        Vector3d MeshNormal = M.NormalAt(M.ClosestMeshPoint(p, 50));
        Plane VPlane = new Plane(p, MeshNormal);
        Random rnd = new Random(seed);
        double ang = rnd.NextDouble() * Math.PI * 2;
        r = VPlane.XAxis;
        r.Rotate(ang, VPlane.ZAxis);
        return r;
    }

    #endregion
# ---------- end c_script_2 ----------

# ---- group: debug
vlen = VectorLength(Vector=c_script_2.sensors)  # disabled
panel_3 = Panel("0")  # disabled
hsv = ColourHSV(Alpha=1, Hue=0, Saturation=panel_3, Value=c_script_2.neighCol)  # disabled
line = LineSDL(Start=graft(c_script_2.points), Direction=c_script_2.sensors, Length=vlen)  # disabled
preview = CustomPreview(Geometry=c_script_2.neigh, Material=hsv)  # disabled

# ----
mesh_4 = Mesh(c_script_2.outMCol)
vdisex_2 = VectorDisplayEx(Point=c_script_2.points, Vector=c_script_2.vectors, Colour=ColourSwatch(SwatchColor=RGB(0, 242, 255)), Width=2)

# ---- group: display mesh vertices
panel_4 = Panel("0.2")  # disabled
cloud = CloudDisplay(Points=demesh.Vertices, Colours=RGB(255, 20, 147), Size=panel_4, SpriteType=0)  # disabled
