# Grasshopper definition XX_stigmergy basics - code.gh (Grasshopper 1.0.7)
# Copyright: Co-de-iT
# plug-ins: FileToScript, Weaverbird, Noise 4D

dir_type = ValueList({"desktop": 0, "documents": 1, "GH file path": 2, "C:": 3}, selected="GH file path")
f_pathg = PathGenerator(type=dir_type, subDir="Stigmergy")  # -> dir; inputs type: Int32, subDir: String
# ---------- f_pathg: C# ----------
                           /*
    froGH - a sparse collection of (in)utilities for Grasshopper

    Path Generator
    code by Alessio Erioli - value list generation based on code by James Ramsden

    froGH by Co-de-iT is licensed under a Creative Commons Attribution 4.0 International License.
    http://creativecommons.org/licenses/by/4.0/

    */
    initComp();


    String S = "";
    String root = "";
    String end = "\\";
    String eol = Environment.NewLine;

    // __________________ autoList part __________________

    // variable for the list
    Grasshopper.Kernel.Special.GH_ValueList vList;
    // tries to cast input as list
    try{

      // if the list is not the first parameter then change Input[0] to the corresponding value
      vList = (Grasshopper.Kernel.Special.GH_ValueList) Component.Params.Input[0].Sources[0];
      // Print("value list connected");
      // check if the list must be created
      //if (vList.NickName != "dir type"){
      if (!vList.NickName.Equals("dir type")){
        vList.ClearData();
        vList.ListItems.Clear();
        vList.NickName = "dir type";
        var item1 = new Grasshopper.Kernel.Special.GH_ValueListItem("desktop", "0");
        var item2 = new Grasshopper.Kernel.Special.GH_ValueListItem("documents", "1");
        var item3 = new Grasshopper.Kernel.Special.GH_ValueListItem("GH file path", "2");
        var item4 = new Grasshopper.Kernel.Special.GH_ValueListItem("C:", "3");
        vList.ListItems.Add(item1);
        vList.ListItems.Add(item2);
        vList.ListItems.Add(item3);
        vList.ListItems.Add(item4);

        vList.ListItems[0].Value.CastTo(out type);
      }
    }
    catch{
      // handles anything that is not a value list
    }


    switch(type){
      case 0:
        root = Environment.GetFolderPath(Environment.SpecialFolder.Desktop) + end;
        S = "Desktop";
        break;
      case 1:
        root = Environment.GetFolderPath(Environment.SpecialFolder.MyDocuments) + end;
        S = "Documents";
        break;
      case 2:
        GH_Document ghDoc = owner.OnPingDocument();

        if (ghDoc.IsFilePathDefined)
        {
          int nameLen = ghDoc.DisplayName.TrimEnd('*').Length + 3; // +3 accounts for the '.gh' extension
          int fileLen = ghDoc.FilePath.TrimEnd('*').Length;

          //F = ghDoc.DisplayName.TrimEnd('*');
          root = ghDoc.FilePath.Substring(0, fileLen - nameLen);
          //root = gh_d.FilePath;
          S = "GH File path";
        }
        else
        {
          Print("No path defined. Saving to Desktop until then");
          root = Environment.GetFolderPath(Environment.SpecialFolder.Desktop);
          S = "Desktop";
        }
        break;
      case 3:
        root = "C:" + end;
        S = root + end;
        break;
    }
    dir = root + (subDir != null ? (subDir + end) : "");
    Component.Message = S;
# ---------- f_pathg: C# additional code ----------
  void initComp(){
    Component.Name = "Path Generator";
    Component.NickName = "f_PathG";
    Component.Description = "generates a path based on local direcories such as Desktop, Documents, GH file path";
    Component.Params.Input[0].Name = "dir type";
    Component.Params.Input[0].Description = "directory type: 0 desktop, 1 documents, 2 GH file path, 3 C:\nconnect a value list for automatic list generation";
    Component.Params.Input[1].Name = "custom subdir";
    Component.Params.Input[1].Description = "(optional) custom subdirectory";
  }
# ---------- end f_pathg ----------
concat = Concatenate(FragmentA=f_pathg, FragmentB="stigmergy_basic.cs")
path = FilePath(concat)

# ---- group: TRI-MESH
mesh = Mesh(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)

# ---- group: QUAD-MESH
mesh_2 = Mesh(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)

# ----
mirror = Mirror(Geometry=mesh, Plane=PlaneYZ(0, 0, 0))  # -> Geometry, Transform
number_slider = Slider(1, range=0..2)
# Stigmergy - basics
# 
# © a3 _/TH.esis 2019 _ Creative Commons Attribution-NonCommercial-ShareAlike3.0 UnportedLicense.
wbjoin = WeaverbirdsJoinMeshesAndWeld(Mesh=[mirror.Geometry, mesh], Weld=False)
wbcatmullclark = WeaverbirdsCatmullClarkSubdivision(MeshCurves=wbjoin, Level=Slider(3, range=1..3), SmoothNakedEdges=Slider(2, range=0..2))
wbcatmullclark_2 = WeaverbirdsCatmullClarkSubdivision(MeshCurves=mesh_2, Level=Slider(3, range=1..3), SmoothNakedEdges=number_slider)
noise_type = ValueList({"Symmetric": 0, "Non symmetric": 1}, selected="Non symmetric")
wbloop = WeaverbirdsLoopSubdivision(MeshCurves=wbcatmullclark, Level=Slider(3, range=1..3), SmoothNakedEdges=Slider(2, range=0..2))
wbcatmullclark_3 = WeaverbirdsCatmullClarkSubdivision(MeshCurves=wbcatmullclark_2, Level=Slider(2, range=1..3), SmoothNakedEdges=number_slider)
list = ValueList({"TriMesh": 0, "QuadMesh": 1}, selected="QuadMesh")
filter = StreamFilter(Gate=list, Stream0=wbloop, Stream1=wbcatmullclark_3)
demesh = DeconstructMesh(Mesh=filter)  # -> Vertices, Faces, Colours, Normals

# ---- group: scalar (noise) field
bbox = BoundingBox(Content=filter, Plane=PlaneXY(0, 0, 0), UnionBox=True)  # -> Box, Box_2
boxprop = BoxProperties(Box=bbox.Box)  # -> Center, Diagonal, Area, Volume, Degeneracy
xz = XZPlane(Origin=boxprop.Center)
yz = YZPlane(Origin=boxprop.Center)
filter_2 = StreamFilter(Gate=list, Stream0=yz, Stream1=xz)
plcoord = PlaneCoordinates(Point=demesh.Vertices, System=filter_2)  # -> XCoordinate, YCoordinate, ZCoordinate
abs = Absolute(Value=plcoord.ZCoordinate)
pt = PointOriented(BasePlane=filter_2, UComponent=plcoord.XCoordinate, VComponent=plcoord.YCoordinate, WComponent=abs)
filter_3 = StreamFilter(Gate=noise_type, Stream0=pt, Stream1=demesh.Vertices)
perlin = PerlinNoise(Values=filter_3, Time=Slider(2.3, range=0..10), Scale=Slider(0.03, range=0..1))

# ---- group: vector field / sign
c_script = CSharpScript(N=plcoord.ZCoordinate)  # -> out, S; inputs N: Double
# ---------- c_script: C# ----------
    S = (N == 0) ? 0 : (N / Math.Abs(N));
# ---------- end c_script ----------

# ---- group: vector field
num = Number(perlin)
bnd = Bounds(Numbers=flatten(num))
dom = ConstructDomain(DomainStart=0, DomainEnd=1)
remap = RemapNumbers(Value=num, Source=bnd, Target=dom)  # -> Mapped, Clipped
pi = Pi(Factor=Slider(9, range=0..30))
multiplication = Multiplication(A=remap.Mapped, B=pi)
deplane = DeconstructPlane(Plane=filter_2)  # -> Origin, XAxis, YAxis, ZAxis
multiplication_2 = Multiplication(A=multiplication, B=c_script.S)
xprod = CrossProduct(VectorA=demesh.Normals, VectorB=deplane.ZAxis, Unitize=False)  # -> Vector, Length
filter_4 = StreamFilter(Gate=noise_type, Stream0=multiplication_2, Stream1=multiplication)
vrot = Rotate(Vector=xprod.Vector, Axis=demesh.Normals, Angle=filter_4)
vdisex = VectorDisplayEx(Point=demesh.Vertices, Vector=vrot, Colour=RGB(0, 0, 0), Width=2)

# ---- group: sampling points
lng = ListLength(List=demesh.Vertices)
random = Random(Range=lng, Number=Slider(50, range=0..3000), Seed=2, Integers=True)
item = ListItem(List=demesh.Vertices, Index=random, Wrap=True)
cullpt = CullDuplicates(Points=item, Tolerance=0.1, CullMode=1)  # -> Points, Indices, Valence
mirror_2 = Mirror(Geometry=cullpt.Points, Plane=PlaneYZ(0, 0, 0))  # -> Geometry, Transform
merge = Merge(Data1=cullpt.Points, Data2=mirror_2.Geometry)  # -> flatten(Result)
filter_5 = StreamFilter(Gate=list, Stream0=merge, Stream1=cullpt.Points)

# ----
gradient = Gradient(LowerLimit="-1", UpperLimit=1, Parameter=perlin, stops=[0: RGB(0, 0, 0), 1: RGB(255, 255, 255)])
conmesh = ConstructMesh(Vertices=demesh.Vertices, Faces=demesh.Faces, Colours=gradient)

# ---- group: standalone evaporate mesh
number_slider_2 = Slider(0.915, range=0..1)  # disabled
c_script_2 = CSharpScript(M=conmesh, evap=number_slider_2)  # -> out, outCol; inputs M: Mesh, evap: Double; disabled
# ---------- c_script_2: C# usings ----------
using System.Drawing;
using System.Threading;
using System.Threading.Tasks;
using System.Collections.Concurrent;
# ---------- c_script_2: C# ----------
    M1 = M;
    cols = populateCols(M1);
    EvaporateMesh(cols, evap);
    outCol = cols;
# ---------- c_script_2: C# additional code ----------
  public Mesh M1;
  public Color[] cols;

  public Color[] populateCols(Mesh M1)
  {
    Color[] cols = new Color[M1.VertexColors.Count];

    var x = Partitioner.Create(0, M1.VertexColors.Count);

    Parallel.ForEach(x, (range, loopstate) =>
      {
      for (int i = range.Item1; i < range.Item2; i++)
      {
        cols[i] = M1.VertexColors[i];
      }
      });
    return cols;
  }


  public void EvaporateMesh(Color[] cols, double evapoRatio)
  {


    var x = Partitioner.Create(0, cols.Length);

    Parallel.ForEach(x, (range, loopstate) =>
      {
      double b;
      int c;
      for (int i = range.Item1; i < range.Item2; i++)
      {
        b = cols[i].R;
        b *= evapoRatio;
        c = (int) b;
        cols[i] = Color.FromArgb(c, c, c);
      }
      });

  }
# ---------- end c_script_2 ----------
conmesh_2 = ConstructMesh(Vertices=demesh.Vertices, Faces=demesh.Faces, Colours=c_script_2.outCol)  # disabled

# ----
evaporation_rate = Slider(0.98, range=0..1)
seek_intensity = Slider(1, range=0..1)
seek_radius = Slider(1.756, range=1..5)
debug = BooleanToggle(False)
reset = Button()
go = BooleanToggle(False)
c_script_3 = CSharpScript(reset=reset, go=go, debug=debug, M=conmesh, P=filter_5, sR=seek_radius, sI=seek_intensity, eR=evaporation_rate)  # -> out, points, vectors, tr, cols, neigh, neighCol, outMCol; inputs reset: Boolean, go: Boolean, debug: Boolean, M: Mesh, P: list of Point3d, sR: Double, sI: Double, eR: Double
# ---------- c_script_3: C# ----------
 
        // ............................................................................
        // Stigmergy - basics

        // return on null input
        if (M == null || P == null) return;

        // initialize on reset
        if (reset || PS == null)
        {
            // initialize particle system
            PS = new ParticleSystem(P, M);

            // populate scalar field from mesh
            scalarField = PopulateScalarField(M);

            // populate point cloud from mesh (speeds up neighbour search)
            MeshPoints = PopulatePointCloud(M);
        }

        if (go)
        {
            // update runtime variables
            PS.seekRadius = sR;
            PS.seekIntensity = sI;
            PS.futPosMult = 3.0f;

            // update simulation
            PS.Update(M);
            //PS.UpdateAngVis();
            // evaporate scalar field
            EvaporateField(scalarField, eR);
            // update component
            Component.ExpireSolution(true);
        }

        // . . . . . . .  extract geometries
        // particles positions and velocites
        PS.GetPointsVectors(out pts, out vecs);
        points = pts;
        vectors = vecs;
        //neighbour points and colors (debug mode)
        if (debug)
        {
            neigh = PS.GetNeighPts();
            neighCol = PS.GetNeighBrightness();
        }
        outMCol = GetScalarField(scalarField);
        // ............................................................................
# ---------- c_script_3: C# additional code ----------
 
    // ............................................................................Global Variables
    public ParticleSystem PS;
    public GH_Point[] pts;
    public GH_Vector[] vecs;
    public static float[] scalarField;
    public static PointCloud MeshPoints;

    // ............................................................................Classes

    // .......................................................... Particle System ........

    public class ParticleSystem
    {
        // . . . . . . . . . . . . . . . . . . . . . . fields
        public List<Particle> Particles;
        public RTree MeshRTree;
        public double seekRadius;
        public double seekIntensity;
        public double futPosMult;

        // . . . . . . . . . . . . . . . . . . . . . . constructor
        public ParticleSystem(List<Point3d> positions, Mesh M)
        {
            Particles = new List<Particle>();

            for (int i = 0; i < positions.Count; i++)
                Particles.Add(new Particle(this, positions[i], RandomVector(i) * 1.5));

            MeshRTree = PopulateMeshRTree(M);
        }

        // . . . . . . . . . . . . . . . . . . . . . . methods

        public void UpdateAngVis()
        {
            foreach (Particle p in Particles)
            {
                // Seek brightest point direction
                p.SeekVisAng(seekIntensity);

                //// update scalar field
                scalarField[MeshPoints.ClosestPoint(p.pos)] += p.PheroStrength;
            }

            if (Particles.Count > 500)
            {
                Parallel.ForEach(Particles, p =>
                {
                    p.Update();
                });
            }
            else
                foreach (Particle p in Particles)
                    p.Update();

        }

        public void Update(Mesh M)
        {
            foreach (Particle p in Particles)
            {
                // clear particle neighbours list
                p.neighbours.Clear();
                p.neighFieldPts.Clear();

                // Eventhandler function for RTree search
                EventHandler<RTreeEventArgs> rTreeCallback = (object sender, RTreeEventArgs args) =>
                {
                    p.neighbours.Add(M.Vertices[args.Id]);
                    p.neighFieldPts.Add(new FieldPt(args.Id, scalarField[args.Id]));
                };

                MeshRTree.Search(new Sphere(M.ClosestPoint(p.pos + p.vel * futPosMult), seekRadius), rTreeCallback);

                // Seek brightest point direction
                p.SeekColor(seekIntensity);

                //// update scalar field
                scalarField[MeshPoints.ClosestPoint(p.pos)] += p.PheroStrength;

            }

            if (Particles.Count > 500)
            {
                Parallel.ForEach(Particles, p =>
               {
                   p.Update();
               });
            }
            else
                foreach (Particle p in Particles)
                    p.Update();

        }

        public void GetPointsVectors(out GH_Point[] pts, out GH_Vector[] vecs)
        {
            pts = new GH_Point[Particles.Count];
            vecs = new GH_Vector[Particles.Count];

            for (int i = 0; i < Particles.Count; i++)
            {
                pts[i] = new GH_Point(Particles[i].pos);
                vecs[i] = new GH_Vector(Particles[i].vel);
            }
        }

        public DataTree<GH_Point> GetNeighPts()
        {
            DataTree<GH_Point> ptsOut = new DataTree<GH_Point>();

            for (int i = 0; i < Particles.Count; i++)
                ptsOut.EnsurePath(new GH_Path(i));

            // parallelize for more than 500 particles
            if (Particles.Count > 500)
            {

                var x = Partitioner.Create(0, Particles.Count);

                Parallel.ForEach(x, (range, loopstate) =>
                {
                    for (int i = range.Item1; i < range.Item2; i++)
                    {
                        for (int j = 0; j < Particles[i].neighbours.Count; j++)
                            ptsOut.Add(new GH_Point(Particles[i].neighbours[j]), new GH_Path(i));
                    }
                });
            }
            else
            {
                for (int i = 0; i < Particles.Count; i++)
                {
                    for (int j = 0; j < Particles[i].neighbours.Count; j++)
                        ptsOut.Add(new GH_Point(Particles[i].neighbours[j]), new GH_Path(i));
                }
            }

            return ptsOut;
        }

        public DataTree<GH_Number> GetNeighBrightness()
        {

            DataTree<GH_Number> briOut = new DataTree<GH_Number>();

            for (int i = 0; i < Particles.Count; i++)
                briOut.EnsurePath(new GH_Path(i));

            for (int i = 0; i < Particles.Count; i++)
            {
                for (int j = 0; j < Particles[i].neighFieldPts.Count; j++)
                    briOut.Add(new GH_Number(Particles[i].neighFieldPts[j].scalar), new GH_Path(i));
            }

            return briOut;
        }
    }

    // .......................................................... Particle ...............
    public class Particle
    {
        public Point3d pos;
        public Vector3d vel;
        public Vector3d acc;
        public double visAng;
        public double MaxSpeed;
        public float PheroStrength;
        public List<Point3d> neighbours;
        public List<FieldPt> neighFieldPts;
        public ParticleSystem pSystem;

        public Particle(ParticleSystem pSystem, Point3d pos, Vector3d vel)
        {
            this.pSystem = pSystem;
            this.pos = pos;
            this.vel = vel;
            acc = Vector3d.Zero;
            MaxSpeed = 1.5f;
            PheroStrength = 0.1f;
            visAng = 0.3 * Math.PI;
            neighbours = new List<Point3d>();
            neighFieldPts = new List<FieldPt>();
        }

        public void Update()
        {
            Move();
        }

        public void SeekVisAng(double seekIntensity)
        {
            acc = Vector3d.Zero;
            Vector3d rotAxis = MeshPoints[MeshPoints.ClosestPoint(pos)].Normal;
            Vector3d futPos = vel * pSystem.futPosMult;

            Vector3d futPosL = new Vector3d(futPos);
            Vector3d futPosR = new Vector3d(futPos);
            futPosL.Rotate(visAng * 0.5, rotAxis);
            futPosR.Rotate(visAng * -0.5, rotAxis);
            // find Left value
            int pL, pR;
            double briL, briR;
            pL = MeshPoints.ClosestPoint(pos + futPosL);
            pR = MeshPoints.ClosestPoint(pos + futPosR);
            briL = scalarField[pL];
            briR = scalarField[pR];
            Vector3d desired = Vector3d.Zero;
            if (briL - briR < 0.01)
            {
                Random rnd = new Random();
                futPos.Rotate(visAng * (rnd.NextDouble() - 0.5), rotAxis);
            }
            else
                desired = briL > briR ? futPosL : futPosR;

            desired.Unitize();
            desired *= MaxSpeed;

            acc = (desired - vel) * seekIntensity;
        }

        public void SeekColor(double seekIntensity)
        {
            acc = vel;

            if (neighFieldPts.Count > 0)
            {
                acc = Vector3d.Zero;
                Vector3d desired = Vector3d.Zero;
                double bri;
                double MaxBri = -1.0;
                int MaxInd = -1;

                for (int i = 0; i < neighFieldPts.Count; i++)
                {
                    bri = neighFieldPts[i].scalar; // brightness is 0-1 and RGB 0-255
                    if (bri > MaxBri)
                    {
                        MaxBri = bri;
                        MaxInd = i;
                    }

                }
                desired += neighbours[MaxInd] - pos;

                desired.Unitize();
                desired *= MaxSpeed;

                acc = (desired - vel) * seekIntensity;
            }
        }

        public void SeekMeshClosestPt(Mesh M, double seekIntensity)
        {
            acc = Vector3d.Zero;
            MeshPoint mP = M.ClosestMeshPoint(pos + vel * pSystem.futPosMult, 100); // old value 1.5
            if (mP != null)
            {
                Point3d mCP = mP.Point;

                Vector3d desired = mCP - pos;
                desired.Unitize();
                desired *= MaxSpeed;

                acc = (desired - vel) * seekIntensity;
            }

        }

        public void Move()
        {
            //vel = vel * 0.9 + acc * 0.1;
            vel = vel + acc;
            if (vel.Length > MaxSpeed)
            {
                vel.Unitize();
                vel *= MaxSpeed;
            }
            if (vel.Length < 1)
            {
                vel.Unitize();
            }
            pos += vel;
        }


    }

    public class FieldPt
    {
        public int id;
        public float scalar;
        public Vector3d vector;

        public FieldPt(int id, float scalar, Vector3d vector)
        {
            this.id = id;
            this.scalar = scalar;
            this.vector = vector;
        }

        public FieldPt(int id, float scalar) : this(id, scalar, Vector3d.Zero) { }

    }

    // ............................................................................Utilities

    public GH_Number[] GetScalarField(float[] scalarField)
    {
        GH_Number[] outField = new GH_Number[scalarField.Length];

        Parallel.For(0, scalarField.Length, i =>
        {
            outField[i] = new GH_Number(scalarField[i]);
        });

        return outField;
    }

    public static void EvaporateField(float[] scalarField, double evapoRatio)
    {
        float evap = (float)evapoRatio;
        var x = Partitioner.Create(0, scalarField.Length);

        Parallel.For(0, scalarField.Length, i =>
        {
            scalarField[i] *= evap;
        });
    }

    public float[] PopulateScalarField(Mesh M)
    {
        float[] scalarField = new float[M.Vertices.Count];

        if (M.VertexColors.Count != 0)
        {

            var x = Partitioner.Create(0, M.VertexColors.Count);

            Parallel.ForEach(x, (range, loopstate) =>
            {
                for (int i = range.Item1; i < range.Item2; i++)
                {
                    scalarField[i] = M.VertexColors[i].GetBrightness();

                }
            });
        }
        return scalarField;
    }

    public static RTree PopulateMeshRTree(Mesh M)
    {
        RTree rt = new RTree();

        for (int i = 0; i < M.Vertices.Count; i++)
        {
            rt.Insert((Point3d)M.Vertices[i], i);
        }

        return rt;
    }

    public PointCloud PopulatePointCloud(Mesh M)
    {
        PointCloud mP = new PointCloud();

        for (int i = 0; i < M.Vertices.Count; i++)
        {
            mP.Add(M.Vertices[i], M.Normals[i]);
        }

        return mP;
    }

    public static Vector3d RandomVector(int seed)
    {
        Vector3d r = Vector3d.Zero;
        Random rnd = new Random(seed);
        r = new Vector3d((rnd.NextDouble() * 2) - 1, (rnd.NextDouble() * 2) - 1, (rnd.NextDouble() * 2) - 1);
        return r;
    }
# ---------- end c_script_3 ----------
ftsv2 = FileToScriptV2(File=path)

# ---- group: debug - neighbours
hsv = ColourHSV(Alpha=1, Hue=0, Saturation="0", Value=c_script_3.neighCol)
preview = CustomPreview(Geometry=c_script_3.neigh, Material=hsv)

# ----
frgb = ColourRGBF(Alpha=1, Red=c_script_3.outMCol, Green=c_script_3.outMCol, Blue=c_script_3.outMCol)
conmesh_3 = ConstructMesh(Vertices=demesh.Vertices, Faces=demesh.Faces, Colours=frgb)
vdisex_2 = VectorDisplayEx(Point=c_script_3.points, Vector=c_script_3.vectors, Colour=ColourSwatch(SwatchColor=RGB(0, 242, 255)), Width=2)
