# Grasshopper definition a3TH_sample project.gh (Grasshopper 1.0.7)
# Copyright: Co-de-iT
# plug-ins: FileToScript

sub_folder = Panel("a3TH_sample project")
file_name_extension = Panel("a3TH_sample project.cs")
dir_type = ValueList({"desktop": 0, "documents": 1, "GH file path": 2, "C:": 3}, selected="GH file path")
f_pathg = PathGenerator(type=dir_type, subDir=sub_folder)  # -> dir; inputs type: Int32, subDir: String
# ---------- f_pathg: C# ----------
                           /*
    froGH - a sparse collection of (in)utilities for Grasshopper

    Path Generator
    code by Alessio Erioli - value list generation based on code by James Ramsden

    froGH by Co-de-iT is licensed under a Creative Commons Attribution 4.0 International License.
    http://creativecommons.org/licenses/by/4.0/

    */
    initComp();


    String S = "";
    String root = "";
    String end = "\\";
    String eol = Environment.NewLine;

    // __________________ autoList part __________________

    // variable for the list
    Grasshopper.Kernel.Special.GH_ValueList vList;
    // tries to cast input as list
    try{

      // if the list is not the first parameter then change Input[0] to the corresponding value
      vList = (Grasshopper.Kernel.Special.GH_ValueList) Component.Params.Input[0].Sources[0];
      // Print("value list connected");
      // check if the list must be created
      //if (vList.NickName != "dir type"){
      if (!vList.NickName.Equals("dir type")){
        vList.ClearData();
        vList.ListItems.Clear();
        vList.NickName = "dir type";
        var item1 = new Grasshopper.Kernel.Special.GH_ValueListItem("desktop", "0");
        var item2 = new Grasshopper.Kernel.Special.GH_ValueListItem("documents", "1");
        var item3 = new Grasshopper.Kernel.Special.GH_ValueListItem("GH file path", "2");
        var item4 = new Grasshopper.Kernel.Special.GH_ValueListItem("C:", "3");
        vList.ListItems.Add(item1);
        vList.ListItems.Add(item2);
        vList.ListItems.Add(item3);
        vList.ListItems.Add(item4);

        vList.ListItems[0].Value.CastTo(out type);
      }
    }
    catch{
      // handles anything that is not a value list
    }


    switch(type){
      case 0:
        root = Environment.GetFolderPath(Environment.SpecialFolder.Desktop) + end;
        S = "Desktop";
        break;
      case 1:
        root = Environment.GetFolderPath(Environment.SpecialFolder.MyDocuments) + end;
        S = "Documents";
        break;
      case 2:
        GH_Document ghDoc = owner.OnPingDocument();

        if (ghDoc.IsFilePathDefined)
        {
          int nameLen = ghDoc.DisplayName.TrimEnd('*').Length + 3; // +3 accounts for the '.gh' extension
          int fileLen = ghDoc.FilePath.TrimEnd('*').Length;

          //F = ghDoc.DisplayName.TrimEnd('*');
          root = ghDoc.FilePath.Substring(0, fileLen - nameLen);
          //root = gh_d.FilePath;
          S = "GH File path";
        }
        else
        {
          Print("No path defined. Saving to Desktop until then");
          root = Environment.GetFolderPath(Environment.SpecialFolder.Desktop);
          S = "Desktop";
        }
        break;
      case 3:
        root = "C:" + end;
        S = root + end;
        break;
    }
    dir = root + (subDir != null ? (subDir + end) : "");
    Component.Message = S;
# ---------- f_pathg: C# additional code ----------
  void initComp(){
    Component.Name = "Path Generator";
    Component.NickName = "f_PathG";
    Component.Description = "generates a path based on local direcories such as Desktop, Documents, GH file path";
    Component.Params.Input[0].Name = "dir type";
    Component.Params.Input[0].Description = "directory type: 0 desktop, 1 documents, 2 GH file path, 3 C:\nconnect a value list for automatic list generation";
    Component.Params.Input[1].Name = "custom subdir";
    Component.Params.Input[1].Description = "(optional) custom subdirectory";
  }
# ---------- end f_pathg ----------
# Simple Template for GH to Visual Studio connection
# 
# © a3 _/TH.esis 2019 _ Creative Commons Attribution-NonCommercial-ShareAlike3.0 UnportedLicense.
number_slider = Slider(50, range=2..100)
concat = Concatenate(FragmentA=f_pathg, FragmentB=file_name_extension)
pop2d = Populate2D(Region={Plane=PlaneXY(0, 0, 0), Size=Domain2(u=0..20, v=0..10)}, Count=number_slider, Seed=1)
path = FilePath(concat)
c_script = CSharpScript(reset=Button(), go=Toggle(False), P=pop2d)  # -> out, POut; inputs reset: Boolean, go: Boolean, P: list of Point3d
# ---------- c_script: C# ----------
 

        Point3d[] ptsOut = new Point3d[P.Count];

        // reset conditions
        if (reset || agSys == null)
        {
            agSys = new AgentSystem(P);
        }

        // component run and update
        if (go)
        {
            agSys.Update();
            Component.ExpireSolution(true);
        }

        // output values

        for (int i = 0; i < ptsOut.Length; i++) ptsOut[i] = agSys.Agents[i].position;

        POut = ptsOut;
# ---------- c_script: C# additional code ----------
 

    // global variables
    public AgentSystem agSys;
    public static Random rnd;

    // simulation system class
    public class AgentSystem
    {
        // fields
        public List<Agent> Agents;

        // constructor(s)
        public AgentSystem(List<Point3d> pts)
        {
            Agents = new List<Agent>();
            rnd = new Random();

            foreach (Point3d p in pts)
            {
                Agent ag = new Agent(p, new Vector3d(rnd.NextDouble() - 0.5, rnd.NextDouble() - 0.5, 0));
                Agents.Add(ag);
            }
        }

        // methods
        public void Update()
        {
            foreach (Agent ag in Agents) ag.Move();
        }
    }

    // individual object class(es)
    public class Agent
    {
        // fields
        public Point3d position;
        public Vector3d velocity;

        // constructor(s)
        public Agent(Point3d position, Vector3d velocity)
        {
            this.position = position;
            this.velocity = velocity;
        }

        // methods
        public void Move()
        {
            position += velocity;

        }
    }

    // utility classs(es)
# ---------- end c_script ----------
ftsv2 = FileToScriptV2(File=path)
