# Grasshopper definition 01-03_environment and field - wrap - intuition.gh (Grasshopper 1.0.7)
# Copyright: Co-de-iT
# plug-ins: Anemone, Noise 4D

number_slider = Slider(200, range=2..1000)
seed = Slider(10, range=1..100)

# ---- group: field parameters
number_slider_2 = Slider(0, range=0..1)
number_slider_3 = Slider(0.05, range=0..0.2)
max_angle = Slider(1, range=0..5)
field_strength = Slider(0.1, range=0..10)

# ----
# preview noise field
number_slider_4 = Slider(50, range=0..100)
cell_size = Slider(0.5, range=0..2)
number_slider_5 = Slider(25, range=0..100)
c_script = CSharpScript(n=number_slider_4)  # -> D; inputs n: Double
# ---------- c_script: C# ----------
    D = new Interval(-n, n);
# ---------- end c_script ----------
c_script_2 = CSharpScript(n=number_slider_5)  # -> D; inputs n: Double; same code as c_script
division = Division(A=number_slider_4, B=cell_size)
division_2 = Division(A=number_slider_5, B=cell_size)
rectangle = Rectangle(Plane=PlaneXY(0, 0, 0), XSize=c_script, YSize=c_script_2, Radius=0)  # -> Rectangle, Length
int = Integer(division)
int_2 = Integer(division_2)
sdivide = DivideSurface(Surface=rectangle.Rectangle, UCount=int, VCount=int_2)  # -> Points, Normals, Parameters
perlin = PerlinNoise(Values=sdivide.Points, Time=number_slider_2, Scale=number_slider_3)
expression = Expression(x=perlin, y=max_angle, Expression="x*y*π")
X = UnitX(Factor=1)
Z = UnitZ(Factor=1)
vrot = Rotate(Vector=X, Axis=Z, Angle=expression)
swatch = ColourSwatch(SwatchColor=RGB(20, 20, 20))
amp = Amplitude(Vector=vrot, Amplitude=Slider(1.5, range=0..5))
crv = Curve(rectangle.Rectangle)
vdisex = VectorDisplayEx(Point=sdivide.Points, Vector=amp, Colour=vrot, Width=1)

start = Button()
# moving in a field (noise)
number_slider_6 = Slider(153, range=0..300)
rectangle_2 = Rectangle(Plane=PlaneXY(0, 0, 0), XSize="-5 to 5", YSize="-5 to 5", Radius=0)  # -> Rectangle, Length
pop2d = Populate2D(Region=rectangle_2.Rectangle, Count=number_slider, Seed=1)  # -> simplify(graft(Population))
random_vectors = CSharpScript(n=number_slider, S=seed)  # -> out, simplify(graft(V)); inputs n: Int32, S: Int32
# ---------- random_vectors: C# ----------
    if (n <= 0 || S < 0) return;

    List <Vector3d> vecs = new List<Vector3d>();
    Vector3d v;
    rnd = new Random(S);

    for (int i = 0; i < n; i++)
    {
      v = new Vector3d(1, 0, 0);
      v.Rotate(rnd.NextDouble() * Math.PI * 2, Vector3d.ZAxis);
      vecs.Add(v);
    }

    V = vecs;
# ---------- random_vectors: C# additional code ----------
  Random rnd;
# ---------- end random_vectors ----------
loop_start = LoopStart(N=number_slider_6, T=start, D0=pop2d, D1=random_vectors.V)  # -> port, Counter, Data, Data_2; disabled
vdisex_2 = VectorDisplayEx(Point=pop2d, Vector=random_vectors.V, Colour=RGB(0, 0, 0), Width=2)
# 01-03_environment and field - wrap - intuition
# 
# move in a field with wrap boundary behavior - intuition approach
# 
# © a3 _/TH.esis 2019 _ Creative Commons Attribution-NonCommercial-ShareAlike3.0 UnportedLicense.
panel = Panel(loop_start.Counter)
item = ListItem(List=loop_start.Data, Index="-1", Wrap=True)
item_2 = ListItem(List=loop_start.Data_2, Index="-1", Wrap=True)

# ---- group: calculate field acceleration vector
perlin_2 = PerlinNoise(Values=item, Time=number_slider_2, Scale=number_slider_3)
expression_2 = Expression(x=perlin_2, y=max_angle, Expression="x*y*π")
X_2 = UnitX(Factor=1)
Z_2 = UnitZ(Factor=1)
vrot_2 = Rotate(Vector=X_2, Axis=Z_2, Angle=expression_2)
amp_2 = Amplitude(Vector=vrot_2, Amplitude=field_strength)

# ----
max_speed = Slider(1, range=0..2)

# ---- group: add to speed
addition = Addition(A=item_2, B=amp_2)

# ----
vlen = VectorLength(Vector=addition)
min = Minimum(A=vlen, B=max_speed)

# ---- group: limit speed
amp_3 = Amplitude(Vector=addition, Amplitude=min)

# ---- group: continuous wrap boundary formula
expression_3 = Expression(Expression="{(P.x/abs(P.x))*(-x+(x+abs(P.x))%(2*x)),(P.y/abs(P.y))*(-y+(y+abs(P.y))%(2*y)), 0}")  # disabled

# ---- group: move point
move = Move(Geometry=item, Motion=amp_3)  # -> Geometry, Transform

# ---- group: wrap boundary
# wrap boundary logic: the environment is a rectangle which size is (-x to x) and (-y to y).
# 
# For each point:
# if (P.x < -x) then P.x = x
# else if (P.x > x) then P.x = -x
# else do nothing (passes P.x)
# 
# same logic for P.y, tested on (-y to y)
# 
# since it is 2D, P.z is always 0
# 
# NOTE: wrap logic makes sense only with square or box environments - the underlying hypothesis is that the world is "flat" (if you go along one direction sooner or later you come back to your original position)
expression_4 = Expression(
    x=number_slider_4,
    y=number_slider_5,
    P=move.Geometry,
    Expression="{If(P.x<-x, x,If(P.x>x,-x,P.x)),If(P.y<-y, y,If(P.y>y,-y,P.y)),0}")

# ----
use_boundary = BooleanToggle(True)
filter = StreamFilter(Gate=use_boundary, Stream0=move.Geometry, Stream1=expression_4)
merge = Merge(Data1=loop_start.Data, Data2=simplify(filter))
merge_2 = Merge(Data1=loop_start.Data_2, Data2=simplify(amp_3))

# ---- group: display current velocity
vdisex_3 = VectorDisplayEx(Point=filter, Vector=amp_3, Colour=ColourSwatch(SwatchColor=RGB(255, 255, 255)), Width=2)

# ---- group: limit trail length
trail_length = Slider(20, range=1..50)
larger = LargerThan(FirstNumber=loop_start.Counter, SecondNumber=expr("x-1", trail_length))  # -> LargerThan, OrEqualTo
range = Range(Domain=Domain(0, 1), Steps=expr("x-1", trail_length))

# ----
and = GateAnd(A=use_boundary, B=larger.OrEqualTo)

# ---- group: limit trail length (continued)
shift = ShiftList(List=merge, Shift=and, Wrap="false")
shift_2 = ShiftList(List=merge_2, Shift=and, Wrap="false")

# ----
loop_end = LoopEnd(
    port=loop_start.port,
    Exit=False,
    Data=simplify(shift),
    Data_2=simplify(shift_2),
    TimeOutVal=0,
    pausedState=False,
    state="Constant output")  # -> D0, D1
gradient = Gradient(LowerLimit=0, UpperLimit=1, Parameter=range, stops=[0: RGBA(0, 0, 0, 0), 1: RGB(255, 255, 255)])
pt = Point(loop_end.D0)
vec = Vector(loop_end.D1)
vdisex_4 = VectorDisplayEx(Point=pt, Vector=vec, Colour=gradient, Width=1)
