# Grasshopper definition CS_04_gradient descent.gh (Grasshopper 1.0.7)
# Copyright: Co-de-iT
# plug-ins: Anemone

number_slider = Slider(30, range=2..100)
srf = Surface(reparameterize(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))
mesh_uv = MeshSurface(Surface=srf, UCount=number_slider, VCount=number_slider, Overhang=True, Equalize=False)
mesh = Mesh(mesh_uv)
# CS_04_gradient descent
# 
# gradient desccent algorithm
# 
# © a3 _/TH.esis 2019 _ Creative Commons Attribution-NonCommercial-ShareAlike3.0 UnportedLicense.
number_slider_2 = Slider(95, range=1..100)

demesh = DeconstructMesh(Mesh=mesh)  # -> Vertices, Faces, Colours, Normals
Z = UnitZ(Factor=1)
xprod = CrossProduct(VectorA=demesh.Normals, VectorB=Z, Unitize=False)  # -> Vector, Length
vrot = Rotate(Vector=xprod.Vector, Axis=demesh.Normals, Angle="Pi*0.5")
cluster = Cluster(V=vrot)
vdisex = VectorDisplayEx(Point=demesh.Vertices, Vector=vrot, Colour=cluster, Width=2)

popgeo = PopulateGeometry(Geometry=mesh, Count=Slider(100, range=2..100), Seed=1)  # -> graft(Population)
mesh_2 = Mesh(mesh_uv)
mesh_3 = Mesh(mesh_uv)
# gradient descent (intuition)
loop_start = LoopStart(Repeat=number_slider_2, Data=popgeo)  # -> port, Counter, Data; disabled
reset = Button()
go = BooleanToggle(False)
reset_2 = Button()
go_2 = BooleanToggle(False)
# gradient descent - final code
popgeo_2 = PopulateGeometry(Geometry=mesh_2, Count=Slider(80, range=2..100), Seed=1)
# gradient descent - code begin
popgeo_3 = PopulateGeometry(Geometry=mesh_3, Count=Slider(80, range=2..100), Seed=1)
item = ListItem(List=loop_start.Data, Index="-1", Wrap=True)

# ---- group: gradient descent
c_script = CSharpScript(P=popgeo_2, M=mesh_2, step=Slider(0.153, range=0..3), reset=reset, go=go)  # -> out, Pos, Trails; inputs P: list of Point3d, M: Mesh, step: Double, reset: Boolean, go: Boolean
# ---------- c_script: C# ----------
    if (reset || parts.Count == 0 || P.Count != parts.Count) initParts(P);

    // updates our Particles (only if they are alive)
    foreach(Particle a in parts) if (a.alive) a.update(M, step);

    // extracts positions and trails
    for(int i = 0; i < parts.Count; i++)
    {
      pts[i] = parts[i].pos;
      trs[i] = parts[i].trail;
    }

    // expiring solution forces the component to update
    if (go) Component.ExpireSolution(true);

    Pos = pts;
    Trails = trs;
# ---------- c_script: C# additional code ----------
  // persistent variables
  List<Particle> parts = new List<Particle>();
  List<Point3d> pts = new List<Point3d>();
  List<Polyline> trs = new List<Polyline>();

  // initialization function
  public void initParts(List<Point3d> P)
  {
    // clears lists
    parts.Clear();
    pts.Clear();
    trs.Clear();

    // initializes lists
    foreach(Point3d p in P)
    {
      parts.Add(new Particle(p));
      pts.Add(p);
      trs.Add(new Polyline());
    }
  }


  // Particle class

  public class Particle // in this case public is unnecessary but in the general case it is
  {

    // fields
    public Point3d pos;
    public Vector3d vel;
    public Polyline trail;
    public bool alive;


    // constructor (public if we use it from RunScript)
    public Particle(Point3d pos){
      this.pos = pos;
      vel = Vector3d.Zero;
      trail = new Polyline();
      trail.Add(pos);
      alive = true;
    }

    // methods

    public void update(Mesh M, double maxSpeed)
    {
      calcVel(M, maxSpeed);
      move(M);
    }

    void calcVel(Mesh M, double maxSpeed)
    {
      // get closest point to the Mesh
      MeshPoint mP = M.ClosestMeshPoint(pos, 0.0);
      // evaluate Mesh normal at that point
      Vector3d mN = M.NormalAt(mP);
      // find tangent to mesh (perpendicular vector to normal)
      vel = Vector3d.CrossProduct(mN, Vector3d.ZAxis);
      // rotate 90 degrees
      vel.Rotate(Math.PI * 0.5, mN);
      // unitize
      vel.Unitize();
      // set to max speed (step)
      vel *= maxSpeed;
    }


    void move(Mesh M)
    {
      // calculates new position
      Point3d newPos = pos + vel;
      newPos = M.ClosestPoint(newPos);

      // kills particle if it has reached a pit - update if not
      if (Math.Abs(newPos.Z - pos.Z) < 0.01) alive = false;
      else
      {
        pos = newPos;
        trail.Add(pos);
      }
    }

  }
# ---------- end c_script ----------

# ----
meshcp = MeshClosestPoint(Point=item, Mesh=mesh)  # -> Point, Index, Parameter

# ---- group: gradient descent code begin
c_script_2 = CSharpScript(P=popgeo_3, M=mesh_3, step=Slider(0.153, range=0..3), reset=reset_2, go=go_2)  # -> out, Pos, Trails; inputs P: list of Point3d, M: Mesh, step: Double, reset: Boolean, go: Boolean
# ---------- c_script_2: C# ----------
    if (reset || parts.Count == 0 || P.Count != parts.Count) initParts(P);

    // updates our Particles (only if they are alive)


    // extracts positions and trails

    // expiring solution forces the component to update
    if (go) Component.ExpireSolution(true);

    Pos = pts;
    Trails = trs;
# ---------- c_script_2: C# additional code ----------
  // persistent variables
  List<Particle> parts = new List<Particle>();
  List<Point3d> pts = new List<Point3d>();
  List<Polyline> trs = new List<Polyline>();

  // initialization function
  public void initParts(List<Point3d> P)
  {

  }


  // Particle class

  public class Particle // in this case public is unnecessary but in the general case it is
  {

    // fields



    // constructor (public if we use it from RunScript)
    public Particle(Point3d pos){

    }

    // methods

    public void update(Mesh M, double maxSpeed)
    {

    }

    void calcVel(Mesh M, double maxSpeed)
    {

    }


    void move(Mesh M)
    {

    }

  }
# ---------- end c_script_2 ----------

# ----
meval = MeshEval(Mesh=mesh, Parameter=meshcp.Parameter)  # -> Point, Normal, Colour
Z_2 = UnitZ(Factor=1)
cir = Circle(Plane=c_script.Pos, Radius=0.25)
crv = Curve(c_script.Trails)
cir_2 = Circle(Plane=c_script_2.Pos, Radius=0.25)
crv_2 = Curve(c_script_2.Trails)
xprod_2 = CrossProduct(VectorA=meval.Normal, VectorB=Z_2, Unitize=True)  # -> Vector, Length
preview = CustomPreview(
    Geometry=cir,
    Material={diffuse=RGB(221, 160, 221), emission=RGB(66, 48, 66), shine=0.5, specular=RGB(255, 255, 255), transparency=0})
preview_2 = CustomPreview(Geometry=crv, Material=ColourSwatch(SwatchColor=RGB(209, 209, 209)))
vrot_2 = Rotate(Vector=xprod_2.Vector, Axis=Z_2, Angle="Pi*0.5")
preview_3 = CustomPreview(
    Geometry=cir_2,
    Material={diffuse=RGB(221, 160, 221), emission=RGB(66, 48, 66), shine=0.5, specular=RGB(255, 255, 255), transparency=0})
preview_4 = CustomPreview(Geometry=crv_2, Material=ColourSwatch(SwatchColor=RGB(209, 209, 209)))
amp = Amplitude(Vector=vrot_2, Amplitude=Slider(0.25, range=0..1))
move = Move(Geometry=item, Motion=amp)  # -> Geometry, Transform
meshcp_2 = MeshClosestPoint(Point=move.Geometry, Mesh=mesh)  # -> Point, Index, Parameter
merge = Merge(Data1=simplify(loop_start.Data), Data2=simplify(meshcp_2.Point))
loop_end = LoopEnd(port=loop_start.port, Exit=False, Data=merge, TimeOutVal=0, pausedState=False, state="Constant output")
pline = PolyLine(Vertices=loop_end, Closed=False)
preview_5 = CustomPreview(
    Geometry=pline,
    Material={diffuse=RGB(221, 160, 221), emission=RGB(66, 48, 66), shine=0.5, specular=RGB(255, 255, 255), transparency=0})

# ==== cluster Cluster
V = ClusterInput()
vlen = VectorLength(Vector=V)
num = Number(vlen)
bnd = Bounds(Numbers=flatten(num))
dom = ConstructDomain(DomainStart=0, DomainEnd=1)
remap = RemapNumbers(Value=num, Source=bnd, Target=dom)  # -> Mapped, Clipped
gradient = Gradient(LowerLimit=0, UpperLimit=1, Parameter=remap.Mapped, stops=[0.206: RGB(143, 143, 143), 1: RGB(0, 0, 0)])
C = ClusterOutput(gradient)
