# Grasshopper definition CS_05_delegates example.gh (Grasshopper 1.0.7)
# Copyright: Co-de-iT

# What are delegates and what do they do?
# 
# Double click on the C# component and find out!
c_script = CSharpScript(x=Slider(1, range=0..2), y=Slider(2, range=0..2))  # -> out, A; inputs x: Double, y: Double
# ---------- c_script: C# ----------
    // dealing with delegates
    // start from the additional code below

    Foo(ComputeAverage, x, y); // this will pass the ComputeAverage function as parameter
    Foo(ComputeSquaredSum, x, y); // this will pass the ComputeSquaredSum function as parameter

    // a delegate is a data type, so I can use it to define variables, just as I do with classes
    // (i.e. if I define a class Ball the I can instantiate a Ball b = new Ball(<params>))
    // in the case of delegates, variables should be existing functions with matching signatures
    BinaryOperator myFavoriteBinaryOperator = ComputeAverage;
    BinaryOperator yourFavoriteBinaryOperator = ComputeSquaredSum;

    Foo(myFavoriteBinaryOperator, x, y);
    Foo(yourFavoriteBinaryOperator, x, y);

    // I can also use an anonymous function as a parameter for the delegate
    // provided that it has the same signature
    // C# automatically assumes that a,b are doubles but I have to return a double as well
    Foo((a, b) => {return a + b;}, x, y);
# ---------- c_script: C# additional code ----------
  
  // delegate declaration
  // delegate <type> <name>(<parameters>);
  delegate double BinaryOperator(double a, double b);

  // define functions with matching signature with the delegate
  // (in this case: 2 doubles as params, returning one double)

  double ComputeAverage (double first, double second)
  {
    return (first + second) * 0.5;
  }

  double ComputeSquaredSum(double m, double n)
  {
    return (m + n) * (m + n);
  }

  // define a function that has the delegate as a parameter
  void Foo(BinaryOperator bOperator, double a, double b)
  {
    double result = bOperator(a, b);
    Print(result.ToString());
  }
# ---------- end c_script ----------
# CS_05_delegates example
# 
# using delegates - a practical example
# 
# code by Alessio Erioli - from an example by Long Nguyen
# 
# © a3 _/TH.esis 2019 _ Creative Commons Attribution-NonCommercial-ShareAlike3.0 UnportedLicense.
panel = Panel(c_script.out)
